# Grasshopper definition Ex_01 - Custom method storing assemblages example.gh (Grasshopper 1.0.7)
# plug-ins: Anemone, Mesh Pipe, froGH, MeshEdit Components

mesh = Mesh(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)
pt = Point([Point(1.8, 1.8, 1.8), Point(5.4, 1.8, 1.8), Point(9, 1.8, 1.8), Point(12.6, 1.8, 1.8)])
crv = Curve([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])

f_plp = PlaneFromLPolyline(Polyline=crv)
panel = Panel("""0
0
0""")
prot = RotatePlane(Plane=f_plp, Angle=degrees(panel))
txt = Text("Component_A-Pos_0-Rot_0")
pln = Plane(prot)

panel_2 = Panel("Component A-Pos_0-Rot_0/1/2")
panel_3 = Panel("Component A-Pos_1-Rot_0/1/2")
# Connect, internalize & save the GH file
panel_4 = Panel("Component A-Pos_2-Rot_0/1/2")
panel_5 = Panel("Component_B-Pos_0-Rot_0/1/2")
panel_6 = Panel("Component_B-Pos_1-Rot_0/1/2")
panel_7 = Panel("Component_B-Pos_2-Rot_0/1/2")
panel_8 = Panel("Component_C-Pos_0-Rot_0/1/2")
panel_9 = Panel("Component_C-Pos_1-Rot_0/1/2")
panel_10 = Panel("Component_C-Pos_2-Rot_0/1/2")

data = Data()
data_2 = Data()
data_3 = Data()
data_4 = Data()
data_5 = Data()
data_6 = Data()
data_7 = Data()
data_8 = Data()
data_9 = Data()

data_10 = Data()
data_11 = Data()
data_12 = Data()
data_13 = Data()
data_14 = Data()
data_15 = Data()
data_16 = Data()
data_17 = Data()
data_18 = Data()

data_19 = Data()
data_20 = Data()
data_21 = Data()
data_22 = Data()
data_23 = Data()
data_24 = Data()
data_25 = Data()
data_26 = Data()
data_27 = Data()

# ----
# to extract your data
bang = ExplodeTree()  # -> Branch0, Branch1, Branch2, Branch3, Branch4, Branch5, Branch6
panel_11 = Panel(bang.Branch0)
pt_2 = Point(flatten(bang.Branch2))
pt_3 = Point(flatten(bang.Branch4))
pln_2 = Plane(flatten(bang.Branch5))
pln_3 = Plane(flatten(bang.Branch6))
mesh_2 = Mesh(flatten(bang.Branch1))
pln_4 = Plane(flatten(bang.Branch3))

# ----
# D0 >> elements pts 4 collisions
# D1 >> joint planes
# D2 >> Position frame
mesh_3 = Mesh(mesh)
pt_4 = Point(pt)
number_slider = Slider(0, range=0..10)
avr = Average(Input=pt_4)
xy = XYPlane(Origin=avr)
loop_start = LoopStart(N="100", T=Button(), D0=pt_4, D1=pln, D2=xy)  # -> port, Counter, Data, Data_2, Data_3
panel_12 = Panel(loop_start.Counter)

# ---- group: Re-orienting geometries
pflip = FlipPlane(Plane=loop_start.Data_2, ReverseX=Toggle(True), ReverseY=Toggle(False), SwapAxes=Toggle(False))
crossref = CrossReference(ListA=pln, ListB=pflip, CrossMode=1)  # -> ListA, ListB
group = Group(Objects=pln)
group_2 = Group(Objects=pt_4)
orient = Orient(Geometry=group_2, Source=crossref.ListA, Target=crossref.ListB)  # -> Geometry, Transform
orient_2 = Orient(Geometry=group, Source=crossref.ListA, Target=crossref.ListB)  # -> Geometry, Transform
orient_3 = Orient(Geometry=xy, Source=crossref.ListA, Target=crossref.ListB)  # -> Geometry, Transform

# ---- group: Check for collisions
ungroup = Ungroup(Group=orient.Geometry)  # -> simplify(Objects)
intersection = SetIntersection(SetA=loop_start.Data, SetB=ungroup)
lng = ListLength(List=intersection)
equals = Equality(FirstNumber=lng, SecondNumber="0")  # -> flatten(Equality), Inequality

# ---- group: Grow above Zero Z
pdecon = Deconstruct(Point=ungroup)  # -> XComponent, YComponent, ZComponent
larger = LargerThan(FirstNumber=pdecon.ZComponent, SecondNumber="0")  # -> LargerThan, OrEqualTo
avr_2 = Average(Input=larger.LargerThan)
equals_2 = Equality(FirstNumber=avr_2, SecondNumber="1")  # -> flatten(Equality), Inequality

# ---- group: Iterations
int = Integer("100")

# ----
and = GateAnd(A=equals.Equality, B=equals_2.Equality)
dispatch = Dispatch(List=orient.Geometry, DispatchPattern=and)  # -> ListA, ListB
dispatch_2 = Dispatch(List=orient_3.Geometry, DispatchPattern=and)  # -> ListA, ListB
dispatch_3 = Dispatch(List=orient_2.Geometry, DispatchPattern=and)  # -> ListA, ListB

# ---- group: COMPACTNESS
ungroup_2 = Ungroup(Group=dispatch.ListA)  # -> simplify(Objects)
sunion = SetUnion(SetA=loop_start.Data, SetB=ungroup_2)
# Replace it with your custom method !!
panel_13 = Panel("3.6")
voxel = Voxel(Points=sunion, X=panel_13, Y=panel_13, Z=panel_13)
area = MeshArea(Mesh=voxel)  # -> flatten(Area), Centroid
volume = MeshVolume(Mesh=voxel)  # -> flatten(Volume), Centroid
expression = Expression(x=area.Area, y=volume.Volume, Expression="(pow(x,1.5))/y")  # -> flatten(R)
bnd = Bounds(Numbers=expression)
remap = RemapNumbers(Value=expression, Source=bnd, Target="0 to 1")  # -> Mapped, Clipped

# ---- group: Closest points
pt_5 = Point([Point(-12, 23, 0), Point(11, 45, 0), Point(49, 33, 0)])
cp = ClosestPoint(Point=dispatch_2.ListA, Cloud=pt_5)  # -> ClosestPoint, CPIndex, Distance
bnd_2 = Bounds(Numbers=cp.Distance)
remap_2 = RemapNumbers(Value=cp.Distance, Source=bnd_2, Target="0 to 1")  # -> Mapped, Clipped

# ----
addition = Addition(A=remap_2.Mapped, B=remap.Mapped)
index = ItemIndex(List=dispatch_2.ListA, Item=dispatch_2.ListA)
sort = SortList(Keys=addition, ValuesA=index)  # -> Keys, ValuesA
item = ListItem(List=sort.ValuesA, Index=0, Wrap=True)

item_2 = ListItem(List=dispatch.ListA, Index=item, Wrap=True)
item_3 = ListItem(List=dispatch_2.ListA, Index=item, Wrap=True)
item_4 = ListItem(List=dispatch_3.ListA, Index=item, Wrap=True)
ungroup_3 = Ungroup(Group=item_2)
ungroup_4 = Ungroup(Group=item_4)
merge = Merge(Data1=flatten(loop_start.Data), Data2=flatten(ungroup_3))
merge_2 = Merge(Data1=flatten(loop_start.Data_2), Data2=flatten(ungroup_4))
merge_3 = Merge(Data1=flatten(loop_start.Data_3), Data2=flatten(item_3))

# ---- group: Used and occluded frame removal
voxel_2 = Voxel(Points=merge, X="3.6", Y="3.6", Z="3.6")
pt_6 = Point(merge_2)
meshcp = MeshClosestPoint(Point=pt_6, Mesh=voxel_2)  # -> Point, Index, Parameter
dist = Distance(PointA=pt_6, PointB=meshcp.Point)

# ----
smaller = SmallerThan(FirstNumber=dist, SecondNumber="0.0001")  # -> SmallerThan, OrEqualTo

# ---- group: Used and occluded frame removal (continued)
dispatch_4 = Dispatch(List=merge_2, DispatchPattern=smaller.SmallerThan)  # -> ListA, ListB

# ---- group: Running...
loop_end = LoopEnd(
    port=loop_start.port,
    Exit=False,
    Data=merge,
    Data_2=dispatch_4.ListA,
    Data_3=merge_3,
    TimeOutVal=0,
    pausedState=False,
    state="Constant output")  # -> D0, D1, D2

# ----
# {0;0} >> Name
# {0;1} >> Component mesh
# {0;2} >> Component points
# {0;3} >> Component joint frames
# {0;4} >> D0 (assemblage points)
# {0;5} >> D1 (available joint frames)
# {0;6} >> D2 (reference frames)
entwine = Entwine(
    Branch00=txt,
    Branch01=mesh_3,
    Branch02=pt_4,
    Branch03=pln,
    Branch04=loop_end.D0,
    Branch05=loop_end.D1,
    Branch06=loop_end.D2,
    FlattenInputs=True)

orient_4 = Orient(Geometry=mesh_3, Source=xy, Target=loop_end.D2)  # -> Geometry, Transform

# ---- group: D0
pt_7 = Point(loop_end.D0)

# ---- group: Oriented blocks
mesh_4 = Mesh(orient_4.Geometry)

# ---- group: D1
pln_5 = Plane(loop_end.D1)

# ----
# Grid
pdecon_2 = Deconstruct(Point=pt_7)  # -> XComponent, YComponent, ZComponent
bnd_3 = Bounds(Numbers=pdecon_2.XComponent)
bnd_4 = Bounds(Numbers=pdecon_2.YComponent)
dedomain = DeconstructDomain(Domain=bnd_4)  # -> Start, End
dedomain_2 = DeconstructDomain(Domain=bnd_3)  # -> Start, End
expression_2 = Expression(x=dedomain_2.Start, y="3.6", Expression="x-(y/2)*7")
expression_3 = Expression(x=dedomain.Start, y="3.6", Expression="x-(y/2)*7")
expression_4 = Expression(x=dedomain_2.End, y=dedomain_2.Start, z="3.6", Expression="((x-y)/z)+7")
expression_5 = Expression(x=dedomain.End, y=dedomain.Start, z="3.6", Expression="((x-y)/z)+7")
pt_8 = ConstructPoint(XCoordinate=expression_2, YCoordinate=expression_3, ZCoordinate=0)
sqgrid = Square(Plane=pt_8, Size="3.6", ExtentX=expression_4, ExtentY=expression_5)  # -> Cells, flatten(Points)
vec2pt = Vector2Pt(PointA="0,0,0", PointB=sqgrid.Points, Unitize=False)  # -> Vector, Length
crv_2 = Curve([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])
move = Move(Geometry=crv_2, Motion=graft(vec2pt.Vector))  # -> Geometry, Transform
preview = CustomPreview(Geometry=move.Geometry, Material=ColourSwatch(SwatchColor=RGB(48, 48, 48)))

data_28 = Data(entwine)

# ----
# Blocks
range = Range(Domain=Domain(0, 1), Steps=expr("x+1", int))
deplane = DeconstructPlane(Plane=pln_5)  # -> Origin, XAxis, YAxis, ZAxis
swatch = ColourSwatch(SwatchColor=RGB(61, 61, 61))
entwine_2 = Entwine(Branch00=deplane.XAxis, Branch01=deplane.YAxis, Branch02=deplane.ZAxis, FlattenInputs=True)
lng_2 = ListLength(List=mesh_4)  # -> expr("x-1", Length)
entwine_3 = Entwine(
    Branch00=ColourSwatch(SwatchColor=RGB(255, 2, 0)),
    Branch01=ColourSwatch(SwatchColor=RGB(0, 255, 0)),
    Branch02=ColourSwatch(SwatchColor=RGB(0, 0, 255)),
    FlattenInputs=True)
f_mseea = MeshExtractEdgesWithToleranceAngle(Mesh=mesh_4, Angle=Slider(18, range=0..100))  # -> InternalEdges, NakedEdges
amp = Amplitude(Vector=entwine_2, Amplitude=Slider(1, range=0..1))
preview_2 = CustomPreview(Geometry=f_mseea.InternalEdges, Material=swatch)
vdisex = VectorDisplayEx(Point=deplane.Origin, Vector=amp, Colour=entwine_3, Width=Slider(2, range=1..5))

# ---- group: Gradient
gradient = Gradient(LowerLimit=0, UpperLimit=1, Parameter=range, stops=[0: RGB(250, 128, 114), 1: RGB(95, 158, 160)])
subset = SubList(List=gradient, Domain=lng_2, Wrap=True)  # -> List, Index

# ----
mcol = MeshColours(Mesh=graft(mesh_4), Colours=graft(subset.List))
preview_3 = CustomPreview(Geometry=mcol, Material=swatch)
