# Grasshopper definition Ex_02 - Postprocess strategies v6.gh (Grasshopper 1.0.7)
# plug-ins: Bifocals, Mesh Pipe, MeshEdit Components, froGH

multiplication = Multiplication(A="3.6", B=Slider(45, range=0..100))
multiplication_2 = Multiplication(A="3.6", B=Slider(45, range=0..100))

data = Data()

# ----
# {0;0} >> Name
# {0;1} >> Component mesh
# {0;2} >> Component points
# {0;3} >> Component joint frames
# {0;4} >> D0 (assemblage points)
# {0;5} >> D1 (available joint frames)
# {0;6} >> D2 (reference frames)
# Imported
# assemblage
# data
bang = ExplodeTree(Data=data)  # -> Branch0, Branch1, Branch2, Branch3, Branch4, Branch5, Branch6
txt = Text(flatten(bang.Branch0))
mesh = Mesh(flatten(bang.Branch1))
pt = Point(flatten(bang.Branch2))
pln = Plane(flatten(bang.Branch5))
pln_2 = Plane(flatten(bang.Branch6))
pln_3 = Plane(flatten(bang.Branch3))
pt_2 = Point(flatten(bang.Branch4))

pt_3 = ConstructPoint(XCoordinate=expr("x*2", multiplication), YCoordinate=0, ZCoordinate=0)
pt_4 = ConstructPoint(XCoordinate=expr("x*1", multiplication), YCoordinate=multiplication_2, ZCoordinate=0)
pt_5 = ConstructPoint(XCoordinate=expr("x*1", multiplication), YCoordinate=0, ZCoordinate=0)
# 3
pt_6 = Point(flatten(pt_2))
pln_4 = Plane(flatten(pln))
pln_5 = Plane(flatten(pln_2))
# 2
pt_7 = Point(flatten(pt_2))
pln_6 = Plane(flatten(pln))
pln_7 = Plane(flatten(pln_2))
mesh_2 = Mesh(mesh)
pt_8 = Point(pt)
# 5
pt_9 = Point(flatten(pt_2))
pln_8 = Plane(flatten(pln))
# 6
pln_9 = Plane(flatten(pln_2))
panel = Panel("600,0,0")
pln_10 = Plane(flatten(pln))
pln_11 = Plane(flatten(pln_2))
# 4
pt_10 = Point(flatten(pt_2))
pt_11 = ConstructPoint(XCoordinate=0, YCoordinate=multiplication_2, ZCoordinate=0)
# MAA01 23/24
# ASSEMBLED ARCHITECTURE
# Computational Logic of Iterative Assemblage Processes
# BCN . Jan-Feb-Mar 2024
# Tutor: Andrea Graziano - Co-de-iT
# Assistant: Akshay Madapura
pt_12 = Point(flatten(pt_2))
# 1
pln_12 = Plane(flatten(pln))
pln_13 = Plane(flatten(pln_2))
avr = Average(Input=pt_8)
move = Move(Geometry=pt_6, Motion=pt_3)  # -> Geometry, Transform
move_2 = Move(Geometry=pln_5, Motion=pt_3)  # -> Geometry, Transform
move_3 = Move(Geometry=pt_7, Motion=pt_4)  # -> Geometry, Transform
move_4 = Move(Geometry=pt_10, Motion=pt_11)  # -> Geometry, Transform
move_5 = Move(Geometry=pt_9, Motion=pt_5)  # -> Geometry, Transform
# POROSITY
xy = XYPlane(Origin=avr)
# PRIVACY INDEX
pt_13 = Point(move_5.Geometry)

# ----
# Porosity (%) = { ( Total Volume - Volume of the Solid ) / Total Volume } x 100
pt_14 = Point(move_4.Geometry)
pdecon = Deconstruct(Point=pt_14)  # -> XComponent, YComponent, ZComponent
sort = SortList(Keys=pdecon.YComponent)  # -> Keys, ValuesA
sort_2 = SortList(Keys=pdecon.ZComponent)  # -> Keys, ValuesA
voxel = Voxel(Points=pt_14, X="3.6", Y="3.6", Z="3.6")
sort_3 = SortList(Keys=pdecon.XComponent)  # -> Keys, ValuesA
cset = CreateSet(List=sort.Keys)  # -> Set, Map
cset_2 = CreateSet(List=sort_3.Keys)  # -> Set, Map
cset_3 = CreateSet(List=sort_2.Keys)  # -> Set, Map
pt_15 = ConstructPoint(XCoordinate=cset_2.Set, YCoordinate=0, ZCoordinate=0)
crossref = CrossReference(ListA=cset_2.Set, ListB=cset.Set, ListC=cset_3.Set, CrossMode=1)  # -> ListA, ListB, ListC
mcol = MeshColours(Mesh=graft(voxel), Colours=ColourSwatch(SwatchColor=RGB(168, 168, 168)))
yz = YZPlane(Origin=pt_15)
pt_16 = ConstructPoint(XCoordinate=crossref.ListA, YCoordinate=crossref.ListB, ZCoordinate=crossref.ListC)
preview = CustomPreview(Geometry=mcol, Material=ColourSwatch(SwatchColor=RGB(255, 255, 255)))
pdecon_2 = Deconstruct(Point=pt_16)  # -> XComponent, YComponent, ZComponent
sec = MeshPlane(Mesh=voxel, Plane=yz)
sort_4 = SortList(Keys=pdecon_2.XComponent)  # -> Keys, ValuesA
disc = Discontinuity(Curve=sec, Level=1)  # -> Points, Parameters
cset_4 = CreateSet(List=sort_4.Keys)  # -> Set, Map
pshift = ShiftPaths(Data=disc.Points, Offset=-1)
mindex = MemberIndex(Set=pdecon_2.XComponent, Member=cset_4.Set)  # -> Index, Count
hull = ConvexHull(Points=pshift, Plane=graft(yz))  # -> simplify(Hull), HullZ, Indices
item = ListItem(List=pt_16, Index=mindex.Index, Wrap=True)  # -> simplify(Item)
incurve = PointInCurve(Point=item, Curve=hull.Hull)  # -> Relationship, Point
equals = Equality(FirstNumber=incurve.Relationship, SecondNumber="2")  # -> Equality, Inequality
dispatch = Dispatch(List=item, DispatchPattern=equals.Inequality)  # -> ListA, flatten(ListB)
voxel_2 = Voxel(Points=dispatch.ListB, X="3.6", Y="3.6", Z="3.6")
f_mseea = MeshExtractEdgesWithToleranceAngle(Mesh=voxel_2, Angle=45)  # -> InternalEdges, NakedEdges
volume = MeshVolume(Mesh=voxel)  # -> Volume, Centroid
volume_2 = MeshVolume(Mesh=voxel_2)  # -> Volume, Centroid
preview_2 = CustomPreview(Geometry=f_mseea.InternalEdges, Material=ColourSwatch(SwatchColor=RGB(255, 0, 0)))
expression = Expression(x=volume_2.Volume, y=volume.Volume, Expression="Round((x-y)/x,2)")
bbox = BoundingBox(Content=pt_14, Plane=PlaneXY(0, 0, 0), UnionBox=True)  # -> Box, Box_2
panel_2 = Panel("""Porosity index
------------------""")
edges = BrepEdges(Brep=bbox.Box)  # -> Naked, Interior, NonManifold
porosity = Panel(expression)
item_2 = ListItem(List=edges.Interior, Index=0, Wrap=True)
merge = Merge(Data1=flatten(panel_2), Data2=flatten(expression))
curvepoint = PointOnCurve(item_2, parameter=0.5)
join = TextJoin(Text=merge)
tag = TextTag3D(
    Location=curvepoint,
    Text=join,
    Size=Slider(2, range=0..10),
    Colour=ColourSwatch(SwatchColor=RGB(102, 102, 102)),
    Justification=2)

voxel_3 = Voxel(Points=move_3.Geometry, X="3.6", Y="3.6", Z="3.6")
pdecon_3 = Deconstruct(Point=move_3.Geometry)  # -> XComponent, YComponent, ZComponent
facen = FaceNormals(Mesh=voxel_3)  # -> flatten(Centers), Normals
cset_5 = CreateSet(List=pdecon_3.XComponent)  # -> Set, Map
cset_6 = CreateSet(List=pdecon_3.YComponent)  # -> Set, Map
pt_17 = ConstructPoint(XCoordinate=pdecon_3.XComponent, YCoordinate=pdecon_3.YComponent, ZCoordinate=0)
pdecon_4 = Deconstruct(Point=facen.Centers)  # -> XComponent, YComponent, ZComponent
smaller = SmallerThan(FirstNumber=pdecon_4.ZComponent, SecondNumber="0.01")  # -> SmallerThan, OrEqualTo
crossref_2 = CrossReference(ListA=cset_5.Set, ListB=cset_6.Set, CrossMode=1)  # -> ListA, ListB
cullpt = CullDuplicates(Points=pt_17, Tolerance=0.1, CullMode=3)  # -> Points, Indices, Valence
dispatch_2 = Dispatch(List=facen.Centers, DispatchPattern=smaller.OrEqualTo)  # -> ListA, ListB
pt_18 = ConstructPoint(XCoordinate=crossref_2.ListA, YCoordinate=crossref_2.ListB, ZCoordinate=0)
lng = ListLength(List=cullpt.Points)
lng_2 = ListLength(List=dispatch_2.ListA)
panel_3 = Panel("""1.8,1.8,0
-1.8,1.8,0
-1.8,-1.8,0
1.8,-1.8,0""")
division = Division(A=lng_2, B=lng)
difference = SetDifference(SetA=cullpt.Points, SetB=dispatch_2.ListA)
exdiff = SetDifferenceS(SetA=cullpt.Points, SetB=pt_18)
move_6 = Move(Geometry=graft(difference), Motion=panel_3)  # -> Geometry, Transform
move_7 = Move(Geometry=graft(exdiff), Motion=panel_3)  # -> Geometry, Transform
move_8 = Move(Geometry=graft(dispatch_2.ListA), Motion=panel_3)  # -> Geometry, Transform
conmesh = ConstructMesh(Vertices=move_7.Geometry, Faces={A=0, B=1, C=2, D=3})
conmesh_2 = ConstructMesh(Vertices=move_6.Geometry, Faces={A=0, B=1, C=2, D=3})
conmesh_3 = ConstructMesh(Vertices=move_8.Geometry, Faces={A=0, B=1, C=2, D=3})
mcol_2 = MeshColours(Mesh=graft(conmesh), Colours=ColourSwatch(SwatchColor=RGB(232, 232, 232)))
mcol_3 = MeshColours(Mesh=graft(conmesh_2), Colours=ColourSwatch(SwatchColor=RGB(191, 191, 191)))
mcol_4 = MeshColours(Mesh=graft(conmesh_3), Colours=ColourSwatch(SwatchColor=RGB(41, 41, 41)))
swatch = ColourSwatch(SwatchColor=RGB(255, 255, 255))
preview_3 = CustomPreview(Geometry=mcol_3, Material=swatch)
preview_4 = CustomPreview(Geometry=mcol_2, Material=swatch)
preview_5 = CustomPreview(Geometry=mcol_4, Material=swatch)
bbox_2 = BoundingBox(Content=move_3.Geometry, Plane=PlaneXY(0, 0, 0), UnionBox=True)  # -> Box, Box_2
expression_2 = Expression(x=division, Expression="Round(x,2)")
edges_2 = BrepEdges(Brep=bbox_2.Box)  # -> Naked, Interior, NonManifold
panel_4 = Panel("""Contact area index
------------------""")
item_3 = ListItem(List=edges_2.Interior, Index=0, Wrap=True)
contact_area_index = Panel(expression_2)
curvepoint_2 = PointOnCurve(item_3, parameter=0.5)
merge_2 = Merge(Data1=flatten(panel_4), Data2=flatten(expression_2))
join_2 = TextJoin(Text=merge_2)
tag_2 = TextTag3D(
    Location=curvepoint_2,
    Text=join_2,
    Size=Slider(2, range=0..10),
    Colour=ColourSwatch(SwatchColor=RGB(102, 102, 102)),
    Justification=flatten(2))

pt_19 = Point(pt_12)
# CONTACT AREA INDEX
panel_5 = Panel("3.6")
mbox = MeshBox(Base={Plane=PlaneXY(0, 0, 0), X=Domain(-10, 10), Y=Domain(-10, 10), Z=Domain(-10, 10)}, XCount=10, YCount=10, ZCount=10)
voxel_4 = Voxel(Points=pt_19, X=panel_5, Y=panel_5, Z=panel_5)
explode = MeshExplode(Mesh=voxel_4, Interpolate=False)
lng_3 = ListLength(List=pt_19)
lng_4 = ListLength(List=explode)
unifynormals = MeshUnifyNormals(Mesh=voxel_3)
expression_3 = Expression(x=lng_4, y=lng_3, Expression="Round((pow(x,1.5))/y,2)")  # -> flatten(R)
Z = UnitZ(Factor=1)
f_mseea_2 = MeshExtractEdgesWithToleranceAngle(Mesh=unifynormals, Angle=45)  # -> InternalEdges, NakedEdges
mcol_5 = MeshColours(Mesh=unifynormals, Colours=ColourSwatch(SwatchColor=RGBA(204, 204, 204, 42)))
preview_6 = CustomPreview(Geometry=f_mseea_2.InternalEdges, Material=ColourSwatch(SwatchColor=RGB(102, 102, 102)))
panel_6 = Panel(expression_3)
panel_7 = Panel("""Occlusion index
------------------""")
panel_8 = Panel("""Privacy index
------------------""")

txt_2 = Text(txt)  # disabled
mesh_3 = Mesh(mesh)  # disabled
pt_20 = Point(pt)  # disabled
pln_14 = Plane(pln_3)  # disabled
pt_21 = Point(pt_2)  # disabled
pln_15 = Plane(pln)  # disabled
pln_16 = Plane(pln_2)  # disabled

avr_2 = Average(Input=pt_20)  # disabled
pt_22 = Point(pt_21)  # disabled
panel_9 = Panel("3.6")  # disabled
pt_23 = Point(pt_21)  # disabled
panel_10 = Panel("3.6")  # disabled
panel_11 = Panel("3.6")  # disabled
pt_24 = Point(pt_21)  # disabled
pt_25 = Point(pt_21)  # disabled
panel_12 = Panel("3.6")  # disabled
xy_2 = XYPlane(Origin=avr_2)  # disabled
voxel_5 = Voxel(Points=pt_22, X=panel_9, Y=panel_9, Z=panel_9)  # disabled
pdecon_5 = Deconstruct(Point=pt_23)  # -> XComponent, YComponent, ZComponent; disabled
voxel_6 = Voxel(Points=pt_23, X=panel_11, Y=panel_11, Z=panel_11)  # disabled
voxel_7 = Voxel(Points=pt_24, X=panel_12, Y=panel_12, Z=panel_12)  # disabled
pdecon_6 = Deconstruct(Point=pt_24)  # -> XComponent, YComponent, ZComponent; disabled
voxel_8 = Voxel(Points=pt_25, X=panel_10, Y=panel_10, Z=panel_10)  # disabled
panel_13 = Panel("3.6")  # disabled
voxel_9 = Voxel(Points=pt_21, X=panel_13, Y=panel_13, Z=panel_13)  # disabled
orient = Orient(Geometry=mesh_3, Source=xy_2, Target=pln_16)  # -> Geometry, Transform; disabled
area = MeshArea(Mesh=voxel_5)  # -> Area, Centroid; disabled
volume_3 = MeshVolume(Mesh=voxel_5)  # -> Volume, Centroid; disabled
facen_2 = FaceNormals(Mesh=voxel_6)  # -> Centers, Normals; disabled
sort_5 = SortList(Keys=pdecon_6.XComponent)  # -> Keys, ValuesA; disabled
sort_6 = SortList(Keys=pdecon_6.YComponent)  # -> Keys, ValuesA; disabled
sort_7 = SortList(Keys=pdecon_6.ZComponent)  # -> Keys, ValuesA; disabled
pt_26 = ConstructPoint(XCoordinate=pdecon_5.XComponent, YCoordinate=pdecon_5.YComponent, ZCoordinate=0)  # disabled
facen_3 = FaceNormals(Mesh=voxel_8)  # -> Centers, Normals; disabled
Z_2 = UnitZ(Factor=1)  # disabled
facen_4 = FaceNormals(Mesh=voxel_9)  # -> Centers, Normals; disabled
facen_5 = FaceNormals(Mesh=orient.Geometry)  # -> Centers, Normals; disabled
expression_4 = Expression(x=area.Area, y=volume_3.Volume, Expression="Pow(x,1.5)/y")  # disabled
pdecon_7 = Deconstruct(Point=facen_2.Centers)  # -> XComponent, YComponent, ZComponent; disabled
cset_7 = CreateSet(List=sort_5.Keys)  # -> Set, Map; disabled
cset_8 = CreateSet(List=sort_6.Keys)  # -> Set, Map; disabled
cset_9 = CreateSet(List=sort_7.Keys)  # -> Set, Map; disabled
cullpt_2 = CullDuplicates(Points=pt_26, Tolerance=0.1, CullMode=1)  # -> Points, Indices, Valence; disabled
panel_14 = Panel("0.01")  # disabled
dprod = DotProduct(VectorA=facen_3.Normals, VectorB=Z_2, Unitize=False)  # disabled
panel_15 = Panel("15 to 3000")  # disabled
mindex_2 = MemberIndex(Set=facen_4.Centers, Member=facen_5.Centers)  # -> Index, Count; disabled
smaller_2 = SmallerThan(FirstNumber=pdecon_7.ZComponent, SecondNumber=panel_14)  # -> SmallerThan, OrEqualTo; disabled
panel_16 = Panel("0 to 1")  # disabled
int = Integer(dprod)  # disabled
lng_5 = ListLength(List=cullpt_2.Points)  # disabled
pt_27 = ConstructPoint(XCoordinate=cset_7.Set, YCoordinate=0, ZCoordinate=0)  # disabled
panel_17 = Panel("0")  # disabled
crossref_3 = CrossReference(ListA=cset_7.Set, ListB=cset_8.Set, ListC=cset_9.Set, CrossMode=1)  # -> ListA, ListB, ListC; disabled
dispatch_3 = Dispatch(List=facen_2.Centers, DispatchPattern=smaller_2.SmallerThan)  # -> ListA, ListB; disabled
pshift_2 = ShiftPaths(Data=mindex_2.Index, Offset=-1)  # disabled
equals_2 = Equality(FirstNumber=int, SecondNumber=panel_17)  # -> Equality, Inequality; disabled
remap = RemapNumbers(Value=expression_4, Source=panel_15, Target=panel_16)  # -> Mapped, Clipped; disabled
yz_2 = YZPlane(Origin=pt_27)  # disabled
pt_28 = ConstructPoint(XCoordinate=crossref_3.ListA, YCoordinate=crossref_3.ListB, ZCoordinate=crossref_3.ListC)  # disabled
cullf = CullFaces(Mesh=voxel_8, Pattern=equals_2.Inequality)  # disabled
lng_6 = ListLength(List=dispatch_3.ListA)  # disabled
item_4 = ListItem(List=facen_4.Normals, Index=pshift_2, Wrap=True)  # disabled
sec_2 = MeshPlane(Mesh=voxel_7, Plane=yz_2)  # -> simplify(Curves); disabled
expression_5 = Expression(x=remap.Mapped, Expression="Round(x,2)")  # disabled
pdecon_8 = Deconstruct(Point=pt_28)  # -> XComponent, YComponent, ZComponent; disabled
expression_6 = Expression(x=lng_6, y=lng_5, Expression="Round(x/y,2)")  # disabled
facen_6 = FaceNormals(Mesh=cullf)  # -> Centers, Normals; disabled
Z_3 = UnitZ(Factor=1)  # disabled
panel_18 = Panel("0.01")  # disabled
disc_2 = Discontinuity(Curve=sec_2, Level=1)  # -> Points, Parameters; disabled
sort_8 = SortList(Keys=pdecon_8.XComponent)  # -> Keys, ValuesA; disabled
amp = Amplitude(Vector=facen_6.Normals, Amplitude=panel_18)  # disabled
dprod_2 = DotProduct(VectorA=item_4, VectorB=Z_3, Unitize=False)  # disabled
# THE SAME METHODS WE DID IN CLASS
compactness_index = Panel(expression_5)  # disabled
pshift_3 = ShiftPaths(Data=disc_2.Points, Offset=-1)  # disabled
cset_10 = CreateSet(List=sort_8.Keys)  # -> Set, Map; disabled
move_9 = Move(Geometry=facen_6.Centers, Motion=amp)  # -> Geometry, Transform; disabled
deplane = DeconstructPlane(Plane=pln_16)  # -> Origin, XAxis, YAxis, ZAxis; disabled
Z_4 = UnitZ(Factor=1)  # disabled
contact_area_index_2 = Panel(expression_6)  # disabled
abs = Absolute(Value=dprod_2)  # disabled
panel_19 = Panel("12")  # disabled
mindex_3 = MemberIndex(Set=pdecon_8.XComponent, Member=cset_10.Set)  # -> Index, Count; disabled
line = LineSDL(Start=move_9.Geometry, Direction=facen_6.Normals, Length=panel_19)  # disabled
dprod_3 = DotProduct(VectorA=deplane.XAxis, VectorB=Z_4, Unitize=False)  # disabled
not = GateNot(A=abs)  # disabled
hull_2 = ConvexHull(Points=pshift_3, Plane=graft(yz_2))  # -> simplify(Hull), HullZ, Indices; disabled
item_5 = ListItem(List=pt_28, Index=mindex_3.Index, Wrap=True)  # -> simplify(Item); disabled
mcx = MeshCurve(Mesh=voxel_8, Curve=line)  # -> Points, Faces; disabled
abs_2 = Absolute(Value=dprod_3)  # disabled
ma = MassAddition(Input=not)  # -> Result, PartialResults; disabled
panel_20 = Panel("10")  # disabled
panel_21 = Panel("16")  # disabled
panel_22 = Panel("0")  # disabled
item_6 = ListItem(List=mcx.Points, Index=0, Wrap=True)  # disabled
weave = Weave(Pattern=graft(abs_2), Stream0=panel_20, Stream1=panel_21, NullGaps=False)  # disabled
nullrep = ReplaceNulls(Items=ma.Result, Replacements=panel_22)  # -> Items, Count; disabled
incurve_2 = PointInCurve(Point=item_5, Curve=hull_2.Hull)  # -> Relationship, Point; disabled
panel_23 = Panel("2")  # disabled
dist = Distance(PointA=graft(facen_6.Centers), PointB=item_6)  # -> simplify(Distance); disabled
expression_7 = Expression(x=nullrep.Items, y=weave, Expression="x/y")  # -> flatten(R); disabled
equals_3 = Equality(FirstNumber=incurve_2.Relationship, SecondNumber=panel_23)  # -> Equality, Inequality; disabled
panel_24 = Panel("14.4")  # disabled
nullrep_2 = ReplaceNulls(Items=dist, Replacements=panel_24)  # -> flatten(Items), Count; disabled
avr_3 = Average(Input=expression_7)  # disabled
dispatch_4 = Dispatch(List=item_5, DispatchPattern=equals_3.Equality)  # -> ListA, ListB; disabled
panel_25 = Panel("3.6")  # disabled
expression_8 = Expression(x=avr_3, Expression="Round(x,2)")  # disabled
panel_26 = Panel("3.6 to 14.4")  # disabled
pt_29 = Point(dispatch_4.ListA)  # disabled
panel_27 = Panel("0 to 1")  # disabled
voxel_10 = Voxel(Points=flatten(pt_29), X=panel_25, Y=panel_25, Z=panel_25)  # disabled
lng_7 = ListLength(List=flatten(pt_24))  # disabled
lng_8 = ListLength(List=flatten(pt_29))  # disabled
remap_2 = RemapNumbers(Value=nullrep_2.Items, Source=panel_26, Target=panel_27)  # -> Mapped, Clipped; disabled
volume_4 = MeshVolume(Mesh=voxel_10)  # -> Volume, Centroid; disabled
volume_5 = MeshVolume(Mesh=voxel_7)  # -> Volume, Centroid; disabled
occlusion_index = Panel(expression_8)  # disabled
avr_4 = Average(Input=remap_2.Mapped)  # disabled
expression_9 = Expression(x=lng_8, y=lng_7, Expression="Round((x-y)/x,2)")  # disabled
expression_10 = Expression(x=volume_4.Volume, y=volume_5.Volume, Expression="Round((x-y)/x,2)")  # disabled
expression_11 = Expression(x=avr_4, Expression="Round(x,2)")  # disabled
porosity_index = Panel(expression_9)  # disabled
panel_28 = Panel(expression_10)  # disabled
privacy_index = Panel(expression_11)  # disabled

# ---- group: extract walls
voxel_11 = Voxel(Points=pt_13, X="3.6", Y="3.6", Z="3.6")
facen_7 = FaceNormals(Mesh=voxel_11)  # -> Centers, Normals
# ADD YOUR NEW EVALUATION CRITERIA HERE !!!
Z_5 = UnitZ(Factor=1)
vdis = VectorDisplay(Anchor=facen_7.Centers, Vector=facen_7.Normals)
# ... AND INSERT THE INDEX VALUE THERE !!!
panel_29 = Panel("14.4")
swatch_2 = ColourSwatch(SwatchColor=RGB(255, 255, 255))

# ----
dprod_4 = DotProduct(VectorA=facen_7.Normals, VectorB=Z_5, Unitize=False)
int_2 = Integer(dprod_4)
bbox_3 = BoundingBox(Content=voxel_11, Plane=PlaneXY(0, 0, 0), UnionBox=True)  # -> Box, Box_2
edges_3 = BrepEdges(Brep=bbox_3.Box)  # -> Naked, Interior, NonManifold
item_7 = ListItem(List=edges_3.Interior, Index=0, Wrap=True)
curvepoint_3 = PointOnCurve(item_7, parameter=0.5)

# ---- group: Assemblage Data
# https://en.wikipedia.org/wiki/Compactness_measure
panel_30 = Panel("3.6")
voxel_12 = Voxel(Points=pt_12, X=panel_30, Y=panel_30, Z=panel_30)
bbox_4 = BoundingBox(Content=voxel_12, Plane=PlaneXY(0, 0, 0), UnionBox=True)  # -> Box, Box_2
area_2 = MeshArea(Mesh=voxel_12)  # -> Area, Centroid
volume_6 = MeshVolume(Mesh=voxel_12)  # -> Volume, Centroid
edges_4 = BrepEdges(Brep=bbox_4.Box)  # -> Naked, Interior, NonManifold
expression_12 = Expression(x=area_2.Area, y=volume_6.Volume, Expression="Round((pow(x,1.5))/y,2)")  # -> flatten(R)
panel_31 = Panel("""0
1
9""")
item_8 = ListItem(List=edges_4.Interior, Index=panel_31, Wrap=True)
len = Length(Curve=item_8)
item_9 = ListItem(List=len, Index=0, Wrap=True)  # -> Item, Item1, Item2
panel_32 = Panel(expression_12)
format = Format(Format="{0} x {1} x {2} m", Culture=127, Data0=item_9.Item, Data1=item_9.Item1, Data2=item_9.Item2)
panel_33 = Panel(format)
panel_34 = Panel("""Compactness index
---------------""")
concat = Concatenate(FragmentA="Volume", FragmentB=" =", FragmentC=volume_6.Volume, FragmentD=" sqm")
concat_2 = Concatenate(FragmentA="Size", FragmentB=" =", FragmentC=panel_33)

# ----
# SIZE, VOLUME & COMPACTNESS
unifynormals_2 = MeshUnifyNormals(Mesh=voxel_12)
remap_3 = RemapNumbers(Value=expression_12, Source="15 to 200", Target="0 to 1")  # -> simplify(Mapped), simplify(Clipped)
expression_13 = Expression(x=remap_3.Clipped, Expression="Round(x,2)")
item_10 = ListItem(List=item_8, Index=0, Wrap=True)
compactness_index_2 = Panel(expression_13)
curvepoint_4 = PointOnCurve(item_10, parameter=0.5)

# ---- group: Assemblage Data (continued)
# seminar
mcol_6 = MeshColours(Mesh=unifynormals_2, Colours=ColourSwatch(SwatchColor=RGB(102, 102, 102)))
# Plugins:
# Meshedit2000
# MeshPipe
# Weaverbird
# froGH
preview_7 = CustomPreview(Geometry=mcol_6, Material=ColourSwatch(SwatchColor=RGB(255, 255, 255)))
merge_3 = Merge(Data1=flatten(panel_34), Data2=flatten(expression_13))
join_3 = TextJoin(Text=merge_3)
tag_3 = TextTag3D(
    Location=curvepoint_4,
    Text=join_3,
    Size=Slider(2, range=0..10),
    Colour=ColourSwatch(SwatchColor=RGB(102, 102, 102)),
    Justification=2)

# ---- group: Vertical & horizontal blocks
# OCCLUSION INDEX
voxel_13 = Voxel(Points=move.Geometry, X="3.6", Y="3.6", Z="3.6")
orient_2 = Orient(Geometry=mesh_2, Source=xy, Target=move_2.Geometry)  # -> Geometry, Transform
mesh_4 = Mesh(orient_2.Geometry)
facen_8 = FaceNormals(Mesh=mesh_4)  # -> Centers, Normals
Z_6 = UnitZ(Factor=1)

# ----
mesh_5 = Mesh(voxel_13)
dprod_5 = DotProduct(VectorA=facen_8.Normals, VectorB=Z, Unitize=False)
abs_3 = Absolute(Value=dprod_5)
int_3 = Integer(abs_3)
equals_4 = Equality(FirstNumber=int_3, SecondNumber="0")  # -> Equality, Inequality
dispatch_5 = Dispatch(List=facen_8.Centers, DispatchPattern=equals_4.Equality)  # -> ListA, ListB
lng_9 = ListLength(List=dispatch_5.ListA)
bbox_5 = BoundingBox(Content=mesh_5, Plane=PlaneXY(0, 0, 0), UnionBox=True)  # -> Box, Box_2
edges_5 = BrepEdges(Brep=bbox_5.Box)  # -> Naked, Interior, NonManifold
item_11 = ListItem(List=edges_5.Interior, Index=0, Wrap=True)
curvepoint_5 = PointOnCurve(item_11, parameter=0.5)

# ---- group: Vertical & horizontal blocks (continued)
facen_9 = FaceNormals(Mesh=mesh_5)  # -> Centers, Normals
mindex_4 = MemberIndex(Set=facen_9.Centers, Member=facen_8.Centers)  # -> Index, Count
pshift_4 = ShiftPaths(Data=mindex_4.Index, Offset=-1)
item_12 = ListItem(List=facen_9.Normals, Index=pshift_4, Wrap=True)
dprod_6 = DotProduct(VectorA=item_12, VectorB=Z_6, Unitize=False)

# ----
abs_4 = Absolute(Value=dprod_6)
not_2 = GateNot(A=abs_4)
ma_2 = MassAddition(Input=not_2)  # -> Result, PartialResults
nullrep_3 = ReplaceNulls(Items=ma_2.Result, Replacements="0")  # -> Items, Count
division_2 = Division(A=nullrep_3.Items, B=lng_9)  # -> flatten(Result)

# ---- group: Vertical & horizontal blocks (continued)
gradient = Gradient(LowerLimit=0, UpperLimit=1, Parameter=division_2, stops=[0: RGB(0, 0, 0), 0.5: RGB(255, 255, 0), 1: RGB(0, 192, 0)])
smaller_3 = SmallerThan(FirstNumber=division_2, SecondNumber=Slider(1, range=0..1))  # -> SmallerThan, OrEqualTo
dispatch_6 = Dispatch(List=mesh_4, DispatchPattern=smaller_3.OrEqualTo)  # -> ListA, ListB
dispatch_7 = Dispatch(List=gradient, DispatchPattern=smaller_3.OrEqualTo)  # -> ListA, ListB
mcol_7 = MeshColours(Mesh=graft(mesh_4), Colours=graft(gradient))
mcol_8 = MeshColours(Mesh=graft(dispatch_6.ListA), Colours=graft(dispatch_7.ListA))
preview_8 = CustomPreview(Geometry=mcol_7, Material=ColourSwatch(SwatchColor=RGB(255, 255, 255)))
preview_9 = CustomPreview(Geometry=mcol_8, Material=ColourSwatch(SwatchColor=RGB(255, 255, 255)))

# ----
num = Number(division_2)
avr_5 = Average(Input=num)
expression_14 = Expression(x=avr_5, Expression="Round(x,2)")
occlusion_index_2 = Panel(expression_14)
merge_4 = Merge(Data1=flatten(panel_7), Data2=flatten(expression_14))
join_4 = TextJoin(Text=merge_4)
tag_4 = TextTag3D(
    Location=curvepoint_5,
    Text=join_4,
    Size=Slider(2, range=0..10),
    Colour=ColourSwatch(SwatchColor=RGB(102, 102, 102)),
    Justification=2)

# ---- group: extract walls (continued)
equals_5 = Equality(FirstNumber=int_2, SecondNumber="0")  # -> Equality, Inequality
cullf_2 = CullFaces(Mesh=voxel_11, Pattern=equals_5.Inequality)
cullf_3 = CullFaces(Mesh=voxel_11, Pattern=equals_5.Equality)
facen_10 = FaceNormals(Mesh=cullf_2)  # -> Centers, Normals
amp_2 = Amplitude(Vector=facen_10.Normals, Amplitude="0.01")
move_10 = Move(Geometry=facen_10.Centers, Motion=amp_2)  # -> Geometry, Transform
line_2 = LineSDL(Start=move_10.Geometry, Direction=facen_10.Normals, Length="12")
mcx_2 = MeshCurve(Mesh=voxel_11, Curve=line_2)  # -> Points, Faces
explode_2 = MeshExplode(Mesh=cullf_2, Interpolate=False)
mcol_9 = MeshColours(Mesh=graft(cullf_3), Colours=ColourSwatch(SwatchColor=RGB(99, 99, 99)))
preview_10 = CustomPreview(Geometry=mcol_9, Material=swatch_2)

# ----
item_13 = ListItem(List=mcx_2.Points, Index=0, Wrap=True)

# ---- group: extract walls (continued)
dist_2 = Distance(PointA=graft(facen_10.Centers), PointB=item_13)  # -> simplify(Distance)
nullrep_4 = ReplaceNulls(Items=dist_2, Replacements=panel_29)  # -> Items, Count
item_14 = ListItem(List=nullrep_4.Items, Index=0, Wrap=True)
bnd = Bounds(Numbers=flatten(item_14))
dedomain = DeconstructDomain(Domain=bnd)  # -> Start, End
gradient_2 = Gradient(
    LowerLimit=dedomain.End,
    UpperLimit=dedomain.Start,
    Parameter=item_14,
    stops=[0: RGB(0, 192, 0), 0.5: RGB(255, 255, 0), 1: RGB(255, 0, 0)])
remap_4 = RemapNumbers(Value=item_14, Source="3.6 to 14.4", Target="0 to 1")  # -> Mapped, Clipped
avr_6 = Average(Input=flatten(remap_4.Mapped))
mcol_10 = MeshColours(Mesh=graft(explode_2), Colours=gradient_2)
preview_11 = CustomPreview(Geometry=mcol_10, Material=swatch_2)

# ----
expression_15 = Expression(x=avr_6, Expression="Round(x,2)")

# ---- group: extract walls (continued)
privacy_index_2 = Panel(expression_15)

# ----
merge_5 = Merge(
    Data1=flatten(txt),
    Data2=flatten(expression_13),
    Data3=flatten(expression_2),
    Data4=flatten(expression_14),
    Data5=flatten(expression),
    Data6=flatten(expression_15))
panel_35 = Panel(merge_5)
merge_6 = Merge(Data1=flatten(panel_8), Data2=flatten(expression_15))
rec = DataRecorder(merge_5, DataLimit=-10, RecordData=False)
join_5 = TextJoin(Text=merge_6)

# ----
# Record your data here !!!
panel_36 = Panel(rec)

tag_5 = TextTag3D(
    Location=curvepoint_3,
    Text=join_5,
    Size=Slider(2, range=0..10),
    Colour=ColourSwatch(SwatchColor=RGB(102, 102, 102)),
    Justification=2)
