# Grasshopper definition Ex_02 - Postprocess strategies v7.gh (Grasshopper 1.0.7)
# plug-ins: Bifocals, Mesh Pipe, MeshEdit Components, froGH, eleFront Rhino 6 Legacy, MetaHopper

panel = Panel("targeting compactness = 50")
panel_2 = Panel("0 to 1")
panel_3 = Panel("1 to 0")
panel_7 = Panel("0 to 0")

panel_10 = Panel("Component A-Pos_0-Rot_0/1/2")
panel_11 = Panel("Component A-Pos_1-Rot_0/1/2")
panel_12 = Panel("Component A-Pos_2-Rot_0/1/2")
panel_13 = Panel("Component_B-Pos_0-Rot_0/1/2")
panel_14 = Panel("Component_B-Pos_1-Rot_0/1/2")
panel_15 = Panel("Component_B-Pos_2-Rot_0/1/2")
panel_16 = Panel("Component_C-Pos_0-Rot_0/1/2")
panel_17 = Panel("Component_C-Pos_1-Rot_0/1/2")
# {0;0} >> Name
# {0;1} >> Component mesh
# {0;2} >> Component points
# {0;3} >> Component joint frames
# {0;4} >> D0 (assemblage points)
# {0;5} >> D1 (available joint frames)
# {0;6} >> D2 (reference frames)
panel_18 = Panel("Component_C-Pos_2-Rot_0/1/2")

data = Data(Tree({0;0}: ["Component A-Pos_0-Rot_0"], {0;1}: [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], {0;2}: [Point(1.8, 1.8, 1.8), Point(5.4, 1.8, 1.8), Point(9, 1.8, 1.8), Point(12.6, 1.8, 1.8)], {0;3}: [PlaneXZ(12.6, 0, 1.8), Plane(origin=(0, 1.8, 1.8), x=(0, 0, 1), y=(0, 1, 0)), Plane(origin=(5.4, 1.8, 3.6), x=(0, -1, 0), y=(1, 0, 0))], {0;4}: [Point(1.8, 1.8, 1.8), Point(5.4, 1.8, 1.8), Point(9, 1.8, 1.8), Point(12.6, 1.8, 1.8), Point(-1.8, 1.8, 1.8), Point(-5.4, 1.8, 1.8)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], {0;5}: [PlaneXZ(12.6, 0, 1.8), Plane(origin=(-5.4, 1.8, 0), x=(0, -1, 0), y=(-1, 0, 0)), Plane(origin=(-25.2, -1.8, 1.8), x=(0, 0, -1), y=(0, -1, 0)), Plane(origin=(-19.8, -1.8, 0), x=(0, 1, 0), y=(1, 0, 0)), Plane(origin=(3.6, 1.8, 16.2), x=(0, 0, 1), y=(0, 1, 0)), Plane(origin=(7.2, 9, 9), x=(0, 0, -1), y=(0, 1, 0))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], {0;6}: [PlaneXY(7.2, 1.8, 1.8), Plane(origin=(-7.2, 1.8, 1.8), x=(-1, 0, 0), y=(0, 1, 0)), Plane(origin=(-18, -1.8, 1.8), x=(1, 0, 0), y=(0, -1, 0)), Plane(origin=(5.4, 1.8, 10.8), x=(0, 0, 1), y=(1, 0, 0)), PlaneYZ(5.4, 10.8, 9), Plane(origin=(5.4, 21.6, 5.4), x=(0, -1, 0), y=(0, 0, -1))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]))
data_2 = Data(Tree({0;0}: ["Component A-Pos_0-Rot_2"], {0;1}: [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], {0;2}: [Point(1.8, 1.8, 1.8), Point(5.4, 1.8, 1.8), Point(9, 1.8, 1.8), Point(12.6, 1.8, 1.8)], {0;3}: [PlaneXZ(12.6, 0, 1.8), Plane(origin=(0, 1.8, 1.8), x=(0, 0, 1), y=(0, 1, 0)), PlaneXY(5.4, 1.8, 3.6)], {0;4}: [Point(1.8, 1.8, 1.8), Point(5.4, 1.8, 1.8), Point(9, 1.8, 1.8), Point(12.6, 1.8, 1.8), Point(-1.8, 1.8, 1.8), Point(-5.4, 1.8, 1.8)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], {0;5}: [PlaneXZ(12.6, 0, 1.8), Plane(origin=(-5.4, 1.8, 0), x=(-1, 0, 0), y=(0, 1, 0)), Plane(origin=(-25.2, -1.8, 1.8), x=(0, 0, -1), y=(0, -1, 0)), Plane(origin=(-19.8, -1.8, 0), x=(1, 0, 0), y=(0, -1, 0)), Plane(origin=(5.4, 0, 16.2), x=(0, 0, 1), y=(-1, 0, 0)), Plane(origin=(-1.8, 1.8, 7.2), x=(-1, 0, 0), y=(0, 1, 0))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], {0;6}: [PlaneXY(7.2, 1.8, 1.8), Plane(origin=(-7.2, 1.8, 1.8), x=(-1, 0, 0), y=(0, 1, 0)), Plane(origin=(-18, -1.8, 1.8), x=(1, 0, 0), y=(0, -1, 0)), Plane(origin=(5.4, 1.8, 10.8), x=(0, 0, 1), y=(0, 1, 0)), Plane(origin=(-3.6, 1.8, 9), x=(-1, 0, 0), y=(0, 1, 0)), Plane(origin=(-14.4, -1.8, 9), x=(1, 0, 0), y=(0, -1, 0))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]))
data_3 = Data(Tree({0;0}: ["Component A-Pos_0-Rot_0"], {0;1}: [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], {0;2}: [Point(1.8, 1.8, 1.8), Point(5.4, 1.8, 1.8), Point(9, 1.8, 1.8), Point(12.6, 1.8, 1.8)], {0;3}: [PlaneXZ(12.6, 0, 1.8), Plane(origin=(0, 1.8, 1.8), x=(0, -1, 0), y=(0, 0, 1)), Plane(origin=(5.4, 1.8, 3.6), x=(0, -1, 0), y=(1, 0, 0))], {0;4}: [Point(1.8, 1.8, 1.8), Point(5.4, 1.8, 1.8), Point(9, 1.8, 1.8), Point(12.6, 1.8, 1.8), Point(-1.8, 1.8, 1.8), Point(-5.4, 1.8, 1.8)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], {0;5}: [PlaneXZ(12.6, 0, 1.8), Plane(origin=(5.4, 1.8, 3.6), x=(0, -1, 0), y=(1, 0, 0)), Plane(origin=(-5.4, 1.8, 3.6), x=(0, 1, 0), y=(-1, 0, 0)), PlaneXY(-12.6, 9, 3.6), Plane(origin=(-21.6, 23.4, 5.4), x=(0, 0, -1), y=(0, -1, 0)), PlaneXY(-23.4, 23.4, 3.6)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], {0;6}: [PlaneXY(7.2, 1.8, 1.8), Plane(origin=(-7.2, 1.8, 1.8), x=(-1, 0, 0), y=(0, -1, 0)), Plane(origin=(-12.6, 10.8, 1.8), x=(0, 1, 0), y=(-1, 0, 0)), Plane(origin=(-9, 21.6, 1.8), x=(0, -1, 0), y=(1, 0, 0)), PlaneXZ(-14.4, 23.4, 5.4), PlaneXY(-14.4, 30.6, 1.8)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]))
data_4 = Data(Tree({0;0}: ["Component A-Pos_1-Rot_0"], {0;1}: [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], {0;2}: [Point(1.8, 1.8, 1.8), Point(5.4, 1.8, 1.8), Point(9, 1.8, 1.8), Point(12.6, 1.8, 1.8)], {0;3}: [PlaneXZ(12.6, 0, 1.8), Plane(origin=(0, 1.8, 1.8), x=(0, 0, 1), y=(0, 1, 0)), Plane(origin=(12.6, 1.8, 3.6), x=(0, -1, 0), y=(1, 0, 0))], {0;4}: [Point(1.8, 1.8, 1.8), Point(5.4, 1.8, 1.8), Point(9, 1.8, 1.8), Point(12.6, 1.8, 1.8), Point(-1.8, 1.8, 1.8), Point(-5.4, 1.8, 1.8)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], {0;5}: [PlaneXZ(12.6, 0, 1.8), Plane(origin=(12.6, 1.8, 3.6), x=(0, -1, 0), y=(1, 0, 0)), Plane(origin=(-12.6, 1.8, 0), x=(0, -1, 0), y=(-1, 0, 0)), Plane(origin=(-12.6, -1.8, 0), x=(0, 1, 0), y=(1, 0, 0)), Plane(origin=(-27, -1.8, 3.6), x=(0, -1, 0), y=(1, 0, 0)), Plane(origin=(-27, 12.6, 0), x=(0, -1, 0), y=(-1, 0, 0))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], {0;6}: [PlaneXY(7.2, 1.8, 1.8), Plane(origin=(-7.2, 1.8, 1.8), x=(-1, 0, 0), y=(0, 1, 0)), Plane(origin=(-18, -1.8, 1.8), x=(1, 0, 0), y=(0, -1, 0)), Plane(origin=(-27, 3.6, 1.8), x=(0, -1, 0), y=(0, 0, -1)), Plane(origin=(-21.6, 12.6, 1.8), x=(-1, 0, 0), y=(0, 1, 0)), PlaneXY(-7.2, 12.6, 1.8)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]))
data_5 = Data(Tree({0;0}: ["Component A-Pos_1-Rot_1"], {0;1}: [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], {0;2}: [Point(1.8, 1.8, 1.8), Point(5.4, 1.8, 1.8), Point(9, 1.8, 1.8), Point(12.6, 1.8, 1.8)], {0;3}: [Plane(origin=(12.6, 0, 1.8), x=(0, 0, 1), y=(-1, 0, 0)), Plane(origin=(0, 1.8, 1.8), x=(0, 0, 1), y=(0, 1, 0)), Plane(origin=(12.6, 1.8, 3.6), x=(0, -1, 0), y=(1, 0, 0))], {0;4}: [Point(1.8, 1.8, 1.8), Point(5.4, 1.8, 1.8), Point(9, 1.8, 1.8), Point(12.6, 1.8, 1.8), Point(-1.8, 12.6, 1.8), Point(-1.8, 9, 1.8)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], {0;5}: [Plane(origin=(12.6, 0, 1.8), x=(0, 0, 1), y=(-1, 0, 0)), Plane(origin=(12.6, 1.8, 3.6), x=(0, -1, 0), y=(1, 0, 0)), Plane(origin=(-1.8, 1.8, 0), x=(1, 0, 0), y=(0, -1, 0)), Plane(origin=(-16.2, 16.2, 0), x=(1, 0, 0), y=(0, -1, 0)), Plane(origin=(-28.8, 30.6, 5.4), x=(0, 0, -1), y=(0, -1, 0)), Plane(origin=(12.6, 48.6, 0), x=(-1, 0, 0), y=(0, 1, 0))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], {0;6}: [PlaneXY(7.2, 1.8, 1.8), Plane(origin=(-1.8, 7.2, 1.8), x=(0, -1, 0), y=(-1, 0, 0)), PlaneXY(-7.2, 16.2, 1.8), Plane(origin=(-16.2, 21.6, 1.8), x=(0, -1, 0), y=(-1, 0, 0)), Plane(origin=(-10.8, 30.6, 1.8), x=(-1, 0, 0), y=(0, 0, -1)), Plane(origin=(-21.6, 30.6, 5.4), x=(1, 0, 0), y=(0, -1, 0))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]))
data_6 = Data(Tree({0;0}: ["Component A-Pos_1-Rot_2"], {0;1}: [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], {0;2}: [Point(1.8, 1.8, 1.8), Point(5.4, 1.8, 1.8), Point(9, 1.8, 1.8), Point(12.6, 1.8, 1.8)], {0;3}: [Plane(origin=(12.6, 0, 1.8), x=(0, 0, 1), y=(-1, 0, 0)), Plane(origin=(0, 1.8, 1.8), x=(0, 0, 1), y=(0, 1, 0)), Plane(origin=(12.6, 1.8, 3.6), x=(-1, 0, 0), y=(0, -1, 0))], {0;4}: [Point(1.8, 1.8, 1.8), Point(5.4, 1.8, 1.8), Point(9, 1.8, 1.8), Point(12.6, 1.8, 1.8), Point(-1.8, 12.6, 1.8), Point(-1.8, 9, 1.8)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], {0;5}: [Plane(origin=(12.6, 0, 1.8), x=(0, 0, 1), y=(-1, 0, 0)), Plane(origin=(12.6, 1.8, 3.6), x=(-1, 0, 0), y=(0, -1, 0)), Plane(origin=(-1.8, 1.8, 0), x=(0, 1, 0), y=(1, 0, 0)), Plane(origin=(-16.2, 16.2, 0), x=(0, 1, 0), y=(1, 0, 0)), PlaneXY(-19.8, 30.6, 3.6), PlaneYZ(-3.6, 30.6, 16.2)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], {0;6}: [PlaneXY(7.2, 1.8, 1.8), Plane(origin=(-1.8, 7.2, 1.8), x=(0, -1, 0), y=(-1, 0, 0)), PlaneXY(-7.2, 16.2, 1.8), Plane(origin=(-16.2, 21.6, 1.8), x=(0, -1, 0), y=(-1, 0, 0)), Plane(origin=(-16.2, 30.6, 7.2), x=(0, 0, -1), y=(1, 0, 0)), Plane(origin=(-19.8, 36, 1.8), x=(0, -1, 0), y=(0, 0, -1))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]))
data_7 = Data(Tree({0;0}: ["Component A-Pos_2-Rot_1"], {0;1}: [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], {0;2}: [Point(1.8, 1.8, 1.8), Point(5.4, 1.8, 1.8), Point(9, 1.8, 1.8), Point(12.6, 1.8, 1.8)], {0;3}: [PlaneXZ(5.4, 0, 1.8), Plane(origin=(0, 1.8, 1.8), x=(0, 1, 0), y=(0, 0, -1)), Plane(origin=(5.4, 1.8, 3.6), x=(0, -1, 0), y=(1, 0, 0))], {0;4}: [Point(1.8, 1.8, 1.8), Point(5.4, 1.8, 1.8), Point(9, 1.8, 1.8), Point(12.6, 1.8, 1.8), Point(-1.8, 1.8, 1.8), Point(-5.4, 1.8, 1.8)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], {0;5}: [PlaneXZ(5.4, 0, 1.8), Plane(origin=(5.4, 1.8, 3.6), x=(0, -1, 0), y=(1, 0, 0)), Plane(origin=(-5.4, 9, 0), x=(-1, 0, 0), y=(0, 1, 0)), Plane(origin=(-12.6, 16.2, 0), x=(-1, 0, 0), y=(0, 1, 0)), Plane(origin=(-19.8, 23.4, 0), x=(-1, 0, 0), y=(0, 1, 0)), PlaneYZ(-18, 16.2, 9)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], {0;6}: [PlaneXY(7.2, 1.8, 1.8), Plane(origin=(-7.2, 1.8, 1.8), x=(-1, 0, 0), y=(0, -1, 0)), Plane(origin=(-5.4, 10.8, 1.8), x=(0, 1, 0), y=(1, 0, 0)), Plane(origin=(-14.4, 9, 1.8), x=(-1, 0, 0), y=(0, -1, 0)), Plane(origin=(-12.6, 18, 1.8), x=(0, 1, 0), y=(1, 0, 0)), Plane(origin=(-21.6, 16.2, 1.8), x=(-1, 0, 0), y=(0, -1, 0))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]))
data_8 = Data(Tree({0;0}: ["Component A-Pos_2-Rot_2"], {0;1}: [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], {0;2}: [Point(1.8, 1.8, 1.8), Point(5.4, 1.8, 1.8), Point(9, 1.8, 1.8), Point(12.6, 1.8, 1.8)], {0;3}: [PlaneXZ(5.4, 0, 1.8), Plane(origin=(0, 1.8, 1.8), x=(0, 1, 0), y=(0, 0, -1)), Plane(origin=(5.4, 1.8, 3.6), x=(-1, 0, 0), y=(0, -1, 0))], {0;4}: [Point(1.8, 1.8, 1.8), Point(5.4, 1.8, 1.8), Point(9, 1.8, 1.8), Point(12.6, 1.8, 1.8), Point(-1.8, 1.8, 1.8), Point(-5.4, 1.8, 1.8)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], {0;5}: [PlaneXZ(5.4, 0, 1.8), Plane(origin=(5.4, 1.8, 3.6), x=(-1, 0, 0), y=(0, -1, 0)), Plane(origin=(-5.4, 9, 0), x=(0, -1, 0), y=(-1, 0, 0)), Plane(origin=(-12.6, 16.2, 0), x=(0, -1, 0), y=(-1, 0, 0)), Plane(origin=(-19.8, 23.4, 0), x=(0, -1, 0), y=(-1, 0, 0)), PlaneXY(-19.8, 23.4, 10.8)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], {0;6}: [PlaneXY(7.2, 1.8, 1.8), Plane(origin=(-7.2, 1.8, 1.8), x=(-1, 0, 0), y=(0, -1, 0)), Plane(origin=(-5.4, 10.8, 1.8), x=(0, 1, 0), y=(1, 0, 0)), Plane(origin=(-14.4, 9, 1.8), x=(-1, 0, 0), y=(0, -1, 0)), Plane(origin=(-12.6, 18, 1.8), x=(0, 1, 0), y=(1, 0, 0)), Plane(origin=(-21.6, 16.2, 1.8), x=(-1, 0, 0), y=(0, -1, 0))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]))
data_9 = Data(Tree({0;0}: ["Component A-Pos_2-Rot_0"], {0;1}: [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], {0;2}: [Point(1.8, 1.8, 1.8), Point(5.4, 1.8, 1.8), Point(9, 1.8, 1.8), Point(12.6, 1.8, 1.8)], {0;3}: [PlaneXZ(5.4, 0, 1.8), Plane(origin=(0, 1.8, 1.8), x=(0, 0, 1), y=(0, 1, 0)), Plane(origin=(5.4, 1.8, 3.6), x=(0, -1, 0), y=(1, 0, 0))], {0;4}: [Point(1.8, 1.8, 1.8), Point(5.4, 1.8, 1.8), Point(9, 1.8, 1.8), Point(12.6, 1.8, 1.8), Point(-1.8, 1.8, 1.8), Point(-5.4, 1.8, 1.8)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], {0;5}: [PlaneXZ(5.4, 0, 1.8), Plane(origin=(-5.4, 1.8, 0), x=(0, -1, 0), y=(-1, 0, 0)), Plane(origin=(-3.6, -5.4, 1.8), x=(0, 0, 1), y=(0, -1, 0)), Plane(origin=(-12.6, -5.4, 0), x=(0, -1, 0), y=(-1, 0, 0)), Plane(origin=(3.6, 1.8, 16.2), x=(0, 0, 1), y=(0, -1, 0)), Plane(origin=(-12.6, 0, 5.4), x=(-1, 0, 0), y=(0, 0, -1))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], {0;6}: [PlaneXY(7.2, 1.8, 1.8), Plane(origin=(-7.2, 1.8, 1.8), x=(-1, 0, 0), y=(0, 1, 0)), PlaneYZ(5.4, 3.6, 5.4), Plane(origin=(-5.4, -7.2, 1.8), x=(0, -1, 0), y=(0, 0, -1)), Plane(origin=(-3.6, -5.4, 5.4), x=(1, 0, 0), y=(0, -1, 0)), Plane(origin=(-5.4, 3.6, 5.4), x=(0, 1, 0), y=(0, 0, -1))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]))

data_10 = Data(Tree({0;0}: ["Component A-Pos_0-Rot_0"], {0;1}: [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], {0;2}: [Point(1.8, 1.8, 1.8), Point(5.4, 1.8, 1.8), Point(9, 1.8, 1.8), Point(12.6, 1.8, 1.8)], {0;3}: [PlaneXZ(12.6, 0, 1.8), Plane(origin=(0, 1.8, 1.8), x=(0, 0, 1), y=(0, 1, 0)), Plane(origin=(5.4, 1.8, 3.6), x=(0, -1, 0), y=(1, 0, 0))], {0;4}: [Point(1.8, 1.8, 1.8), Point(5.4, 1.8, 1.8), Point(9, 1.8, 1.8), Point(12.6, 1.8, 1.8), Point(1.8, 1.8, 5.4), Point(5.4, 1.8, 5.4)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], {0;5}: [PlaneXZ(12.6, 0, 1.8), Plane(origin=(-10.8, -1.8, 5.4), x=(0, 0, -1), y=(0, -1, 0)), Plane(origin=(-5.4, 1.8, 18), x=(0, -1, 0), y=(1, 0, 0)), Plane(origin=(-18, 12.6, 19.8), x=(0, 0, 1), y=(0, 1, 0)), Plane(origin=(-16.2, 28.8, 1.8), x=(-1, 0, 0), y=(0, 0, 1)), Plane(origin=(-9, 23.4, 0), x=(0, 1, 0), y=(1, 0, 0))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], {0;6}: [PlaneXY(7.2, 1.8, 1.8), Plane(origin=(7.2, 1.8, 5.4), x=(1, 0, 0), y=(0, -1, 0)), Plane(origin=(-1.8, 1.8, 7.2), x=(0, 0, -1), y=(-1, 0, 0)), Plane(origin=(-1.8, 5.4, 7.2), x=(0, 0, -1), y=(1, 0, 0)), Plane(origin=(-5.4, 3.6, 1.8), x=(0, -1, 0), y=(0, 0, -1)), Plane(origin=(-3.6, -1.8, 5.4), x=(1, 0, 0), y=(0, -1, 0))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]))
data_11 = Data(Tree({0;0}: ["Component A-Pos_0-Rot_0"], {0;1}: [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], {0;2}: [Point(1.8, 1.8, 1.8), Point(5.4, 1.8, 1.8), Point(9, 1.8, 1.8), Point(12.6, 1.8, 1.8)], {0;3}: [PlaneXZ(12.6, 0, 1.8), Plane(origin=(0, 1.8, 1.8), x=(0, -1, 0), y=(0, 0, 1)), Plane(origin=(5.4, 1.8, 3.6), x=(0, -1, 0), y=(1, 0, 0))], {0;4}: [Point(1.8, 1.8, 1.8), Point(5.4, 1.8, 1.8), Point(9, 1.8, 1.8), Point(12.6, 1.8, 1.8), Point(1.8, 1.8, 5.4), Point(5.4, 1.8, 5.4)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], {0;5}: [Plane(origin=(7.2, 12.6, 1.8), x=(0, -1, 0), y=(0, 0, 1)), Plane(origin=(19.8, 57.6, 5.4), x=(1, 0, 0), y=(0, 0, -1)), Plane(origin=(-18, 12.6, 5.4), x=(0, -1, 0), y=(0, 0, -1)), Plane(origin=(-34.2, 14.4, 1.8), x=(-1, 0, 0), y=(0, 0, 1)), Plane(origin=(-34.2, 10.8, 5.4), x=(-1, 0, 0), y=(0, 0, -1)), Plane(origin=(-21.6, 41.4, 5.4), x=(0, 1, 0), y=(0, 0, -1))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], {0;6}: [PlaneXY(7.2, 1.8, 1.8), Plane(origin=(7.2, 1.8, 5.4), x=(1, 0, 0), y=(0, -1, 0)), Plane(origin=(-1.8, -3.6, 1.8), x=(0, 1, 0), y=(-1, 0, 0)), Plane(origin=(-1.8, -3.6, 5.4), x=(0, 1, 0), y=(1, 0, 0)), Plane(origin=(-5.4, 7.2, 5.4), x=(0, -1, 0), y=(-1, 0, 0)), Plane(origin=(-5.4, 7.2, 1.8), x=(0, -1, 0), y=(1, 0, 0))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]))
data_12 = Data(Tree({0;0}: ["Component A-Pos_0-Rot_2"], {0;1}: [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], {0;2}: [Point(1.8, 1.8, 1.8), Point(5.4, 1.8, 1.8), Point(9, 1.8, 1.8), Point(12.6, 1.8, 1.8)], {0;3}: [PlaneXZ(12.6, 0, 1.8), Plane(origin=(0, 1.8, 1.8), x=(0, 0, 1), y=(0, 1, 0)), PlaneXY(5.4, 1.8, 3.6)], {0;4}: [Point(1.8, 1.8, 1.8), Point(5.4, 1.8, 1.8), Point(9, 1.8, 1.8), Point(12.6, 1.8, 1.8), Point(9, 1.8, 5.4), Point(5.4, 1.8, 5.4)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], {0;5}: [Plane(origin=(10.8, 1.8, 5.4), x=(0, 0, -1), y=(0, 1, 0)), Plane(origin=(5.4, -1.8, 0), x=(-1, 0, 0), y=(0, 1, 0)), PlaneYZ(18, -1.8, 1.8), Plane(origin=(10.8, -1.8, 9), x=(0, 0, -1), y=(0, 1, 0)), PlaneXY(5.4, -5.4, 10.8), Plane(origin=(-5.4, 1.8, 0), x=(-1, 0, 0), y=(0, 1, 0))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], {0;6}: [PlaneXY(7.2, 1.8, 1.8), Plane(origin=(3.6, 1.8, 5.4), x=(-1, 0, 0), y=(0, 1, 0)), Plane(origin=(0, -1.8, 5.4), x=(1, 0, 0), y=(0, 0, -1)), Plane(origin=(10.8, -1.8, 1.8), x=(-1, 0, 0), y=(0, 0, 1)), Plane(origin=(3.6, -1.8, 9), x=(-1, 0, 0), y=(0, 1, 0)), Plane(origin=(0, -5.4, 9), x=(1, 0, 0), y=(0, 0, -1))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]))
data_13 = Data(Tree({0;0}: ["Component A-Pos_1-Rot_0"], {0;1}: [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], {0;2}: [Point(1.8, 1.8, 1.8), Point(5.4, 1.8, 1.8), Point(9, 1.8, 1.8), Point(12.6, 1.8, 1.8)], {0;3}: [PlaneXZ(12.6, 0, 1.8), Plane(origin=(0, 1.8, 1.8), x=(0, 0, 1), y=(0, 1, 0)), Plane(origin=(12.6, 1.8, 3.6), x=(0, -1, 0), y=(1, 0, 0))], {0;4}: [Point(1.8, 1.8, 1.8), Point(5.4, 1.8, 1.8), Point(9, 1.8, 1.8), Point(12.6, 1.8, 1.8), Point(1.8, 1.8, 5.4), Point(5.4, 1.8, 5.4)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], {0;5}: [PlaneXZ(12.6, 0, 1.8), Plane(origin=(-1.8, 12.6, 32.4), x=(0, -1, 0), y=(1, 0, 0)), Plane(origin=(-1.8, 1.8, 32.4), x=(0, 1, 0), y=(-1, 0, 0)), Plane(origin=(14.4, 5.4, 5.4), x=(0, 0, 1), y=(0, -1, 0)), Plane(origin=(-19.8, 28.8, 19.8), x=(-1, 0, 0), y=(0, 0, 1)), Plane(origin=(-28.8, 1.8, 23.4), x=(0, 0, -1), y=(0, -1, 0))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], {0;6}: [PlaneXY(7.2, 1.8, 1.8), Plane(origin=(7.2, 1.8, 5.4), x=(1, 0, 0), y=(0, -1, 0)), Plane(origin=(-1.8, 1.8, 7.2), x=(0, 0, -1), y=(-1, 0, 0)), Plane(origin=(-1.8, 5.4, 7.2), x=(0, 0, -1), y=(1, 0, 0)), Plane(origin=(-1.8, 7.2, 16.2), x=(0, -1, 0), y=(0, 0, 1)), Plane(origin=(-5.4, 7.2, 16.2), x=(0, -1, 0), y=(0, 0, -1))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]))
data_14 = Data(Tree({0;0}: ["Component A-Pos_1-Rot_1"], {0;1}: [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], {0;2}: [Point(1.8, 1.8, 1.8), Point(5.4, 1.8, 1.8), Point(9, 1.8, 1.8), Point(12.6, 1.8, 1.8)], {0;3}: [Plane(origin=(12.6, 0, 1.8), x=(0, 0, 1), y=(-1, 0, 0)), Plane(origin=(0, 1.8, 1.8), x=(0, 0, 1), y=(0, 1, 0)), Plane(origin=(12.6, 1.8, 3.6), x=(0, -1, 0), y=(1, 0, 0))], {0;4}: [Point(1.8, 1.8, 1.8), Point(5.4, 1.8, 1.8), Point(9, 1.8, 1.8), Point(12.6, 1.8, 1.8), Point(1.8, 1.8, 5.4), Point(5.4, 1.8, 5.4)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], {0;5}: [Plane(origin=(0, 1.8, 1.8), x=(0, 0, 1), y=(0, 1, 0)), Plane(origin=(0, 1.8, 5.4), x=(0, 0, -1), y=(0, -1, 0)), Plane(origin=(0, -1.8, 1.8), x=(0, 0, -1), y=(0, -1, 0)), Plane(origin=(12.6, -1.8, 0), x=(0, 1, 0), y=(1, 0, 0)), Plane(origin=(12.6, 25.2, 27), x=(0, 0, -1), y=(-1, 0, 0)), Plane(origin=(0, 23.4, 27), x=(0, 0, -1), y=(0, -1, 0))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], {0;6}: [PlaneXY(7.2, 1.8, 1.8), Plane(origin=(7.2, 1.8, 5.4), x=(1, 0, 0), y=(0, -1, 0)), PlaneXY(7.2, 5.4, 5.4), Plane(origin=(7.2, 5.4, 9), x=(1, 0, 0), y=(0, -1, 0)), PlaneXY(7.2, 9, 9), Plane(origin=(7.2, 9, 12.6), x=(1, 0, 0), y=(0, -1, 0))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]))
data_15 = Data(Tree({0;0}: ["Component A-Pos_1-Rot_2"], {0;1}: [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], {0;2}: [Point(1.8, 1.8, 1.8), Point(5.4, 1.8, 1.8), Point(9, 1.8, 1.8), Point(12.6, 1.8, 1.8)], {0;3}: [Plane(origin=(12.6, 0, 1.8), x=(0, 0, 1), y=(-1, 0, 0)), Plane(origin=(0, 1.8, 1.8), x=(0, 0, 1), y=(0, 1, 0)), Plane(origin=(12.6, 1.8, 3.6), x=(-1, 0, 0), y=(0, -1, 0))], {0;4}: [Point(1.8, 1.8, 1.8), Point(5.4, 1.8, 1.8), Point(9, 1.8, 1.8), Point(12.6, 1.8, 1.8), Point(1.8, -1.8, 1.8), Point(5.4, -1.8, 1.8)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], {0;5}: [Plane(origin=(12.6, -1.8, 0), x=(-1, 0, 0), y=(0, 1, 0)), PlaneXZ(12.6, -10.8, 5.4), PlaneXY(-1.8, -1.8, 14.4), Plane(origin=(-1.8, -5.4, 14.4), x=(-1, 0, 0), y=(0, -1, 0)), Plane(origin=(-1.8, 1.8, 0), x=(0, 1, 0), y=(1, 0, 0)), Plane(origin=(-5.4, -5.4, 0), x=(0, 1, 0), y=(1, 0, 0))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], {0;6}: [PlaneXY(7.2, 1.8, 1.8), Plane(origin=(7.2, -1.8, 1.8), x=(1, 0, 0), y=(0, -1, 0)), PlaneYZ(12.6, -3.6, 5.4), Plane(origin=(-1.8, -1.8, 7.2), x=(0, 0, -1), y=(0, 1, 0)), Plane(origin=(-1.8, -5.4, 7.2), x=(0, 0, -1), y=(0, -1, 0)), Plane(origin=(-1.8, 7.2, 1.8), x=(0, -1, 0), y=(-1, 0, 0))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]))
data_16 = Data(Tree({0;0}: ["Component A-Pos_2-Rot_0"], {0;1}: [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], {0;2}: [Point(1.8, 1.8, 1.8), Point(5.4, 1.8, 1.8), Point(9, 1.8, 1.8), Point(12.6, 1.8, 1.8)], {0;3}: [PlaneXZ(5.4, 0, 1.8), Plane(origin=(0, 1.8, 1.8), x=(0, 0, 1), y=(0, 1, 0)), Plane(origin=(5.4, 1.8, 3.6), x=(0, -1, 0), y=(1, 0, 0))], {0;4}: [Point(1.8, 1.8, 1.8), Point(5.4, 1.8, 1.8), Point(9, 1.8, 1.8), Point(12.6, 1.8, 1.8), Point(1.8, 1.8, 5.4), Point(5.4, 1.8, 5.4)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], {0;5}: [PlaneXZ(5.4, 0, 1.8), Plane(origin=(-1.8, 1.8, 0), x=(0, -1, 0), y=(-1, 0, 0)), Plane(origin=(-1.8, -1.8, 0), x=(0, 1, 0), y=(1, 0, 0)), Plane(origin=(-1.8, 9, 0), x=(0, -1, 0), y=(-1, 0, 0)), Plane(origin=(-1.8, 16.2, 0), x=(0, -1, 0), y=(-1, 0, 0)), Plane(origin=(12.6, 12.6, 0), x=(0, 1, 0), y=(1, 0, 0))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], {0;6}: [PlaneXY(7.2, 1.8, 1.8), Plane(origin=(7.2, 1.8, 5.4), x=(1, 0, 0), y=(0, -1, 0)), Plane(origin=(3.6, 5.4, 5.4), x=(-1, 0, 0), y=(0, 1, 0)), Plane(origin=(3.6, 5.4, 1.8), x=(-1, 0, 0), y=(0, -1, 0)), Plane(origin=(-1.8, 1.8, 7.2), x=(0, 0, 1), y=(-1, 0, 0)), Plane(origin=(-1.8, -1.8, 7.2), x=(0, 0, 1), y=(1, 0, 0))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]))
data_17 = Data(Tree({0;0}: ["Component A-Pos_2-Rot_1"], {0;1}: [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], {0;2}: [Point(1.8, 1.8, 1.8), Point(5.4, 1.8, 1.8), Point(9, 1.8, 1.8), Point(12.6, 1.8, 1.8)], {0;3}: [PlaneXZ(5.4, 0, 1.8), Plane(origin=(0, 1.8, 1.8), x=(0, 1, 0), y=(0, 0, -1)), Plane(origin=(5.4, 1.8, 3.6), x=(0, -1, 0), y=(1, 0, 0))], {0;4}: [Point(1.8, 1.8, 1.8), Point(5.4, 1.8, 1.8), Point(9, 1.8, 1.8), Point(12.6, 1.8, 1.8), Point(1.8, 1.8, 5.4), Point(5.4, 1.8, 5.4)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], {0;5}: [Plane(origin=(-1.8, 1.8, 0), x=(0, -1, 0), y=(-1, 0, 0)), Plane(origin=(-1.8, 9, 0), x=(0, -1, 0), y=(-1, 0, 0)), Plane(origin=(-1.8, 16.2, 0), x=(0, -1, 0), y=(-1, 0, 0)), Plane(origin=(12.6, 12.6, 0), x=(0, 1, 0), y=(1, 0, 0)), Plane(origin=(-1.8, 23.4, 0), x=(0, -1, 0), y=(-1, 0, 0)), Plane(origin=(12.6, 19.8, 0), x=(0, 1, 0), y=(1, 0, 0))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], {0;6}: [PlaneXY(7.2, 1.8, 1.8), Plane(origin=(7.2, 1.8, 5.4), x=(1, 0, 0), y=(0, -1, 0)), Plane(origin=(3.6, 5.4, 5.4), x=(-1, 0, 0), y=(0, 1, 0)), Plane(origin=(3.6, 5.4, 1.8), x=(-1, 0, 0), y=(0, -1, 0)), Plane(origin=(-1.8, 1.8, 7.2), x=(0, 0, 1), y=(0, -1, 0)), PlaneXY(7.2, 9, 1.8)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]))
data_18 = Data(Tree({0;0}: ["Component A-Pos_2-Rot_2"], {0;1}: [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], {0;2}: [Point(1.8, 1.8, 1.8), Point(5.4, 1.8, 1.8), Point(9, 1.8, 1.8), Point(12.6, 1.8, 1.8)], {0;3}: [PlaneXZ(5.4, 0, 1.8), Plane(origin=(0, 1.8, 1.8), x=(0, 1, 0), y=(0, 0, -1)), Plane(origin=(5.4, 1.8, 3.6), x=(-1, 0, 0), y=(0, -1, 0))], {0;4}: [Point(1.8, 1.8, 1.8), Point(5.4, 1.8, 1.8), Point(9, 1.8, 1.8), Point(12.6, 1.8, 1.8), Point(1.8, 1.8, 5.4), Point(5.4, 1.8, 5.4)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], {0;5}: [Plane(origin=(-1.8, 1.8, 0), x=(0, 1, 0), y=(1, 0, 0)), Plane(origin=(-1.8, -3.6, 1.8), x=(0, 0, 1), y=(-1, 0, 0)), PlaneXZ(1.8, -7.2, 9), Plane(origin=(-32.4, -9, 34.2), x=(0, 0, -1), y=(0, -1, 0)), Plane(origin=(-32.4, -12.6, 34.2), x=(0, 0, 1), y=(0, 1, 0)), Plane(origin=(-34.2, 0, 30.6), x=(0, 0, 1), y=(1, 0, 0))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], {0;6}: [PlaneXY(7.2, 1.8, 1.8), PlaneXZ(7.2, 1.8, 5.4), Plane(origin=(7.2, -1.8, 1.8), x=(1, 0, 0), y=(0, 0, -1)), Plane(origin=(7.2, -1.8, 5.4), x=(1, 0, 0), y=(0, -1, 0)), PlaneYZ(-1.8, 3.6, 1.8), Plane(origin=(-1.8, 0, 5.4), x=(0, 1, 0), y=(-1, 0, 0))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]))

data_19 = Data(Tree({0;0}: ["Component A-Pos_0-Rot_0"], {0;1}: [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], {0;2}: [Point(1.8, 1.8, 1.8), Point(5.4, 1.8, 1.8), Point(9, 1.8, 1.8), Point(12.6, 1.8, 1.8)], {0;3}: [PlaneXZ(12.6, 0, 1.8), Plane(origin=(0, 1.8, 1.8), x=(0, 0, 1), y=(0, 1, 0)), Plane(origin=(5.4, 1.8, 3.6), x=(0, -1, 0), y=(1, 0, 0))], {0;4}: [Point(1.8, 1.8, 1.8), Point(5.4, 1.8, 1.8), Point(9, 1.8, 1.8), Point(12.6, 1.8, 1.8), Point(-1.8, 1.8, 1.8), Point(-5.4, 1.8, 1.8)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], {0;5}: [PlaneXZ(12.6, 0, 1.8), Plane(origin=(-5.4, 1.8, 0), x=(0, -1, 0), y=(-1, 0, 0)), Plane(origin=(-25.2, -1.8, 1.8), x=(0, 0, -1), y=(0, -1, 0)), Plane(origin=(-19.8, -1.8, 0), x=(0, 1, 0), y=(1, 0, 0)), Plane(origin=(12.6, 3.6, 5.4), x=(1, 0, 0), y=(0, 0, -1)), Plane(origin=(-5.4, 1.8, 7.2), x=(0, 1, 0), y=(-1, 0, 0))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], {0;6}: [PlaneXY(7.2, 1.8, 1.8), Plane(origin=(-7.2, 1.8, 1.8), x=(-1, 0, 0), y=(0, 1, 0)), Plane(origin=(-18, -1.8, 1.8), x=(1, 0, 0), y=(0, -1, 0)), Plane(origin=(7.2, 1.8, 5.4), x=(1, 0, 0), y=(0, -1, 0)), Plane(origin=(-7.2, 1.8, 5.4), x=(-1, 0, 0), y=(0, -1, 0)), PlaneYZ(-12.6, 10.8, 5.4)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]))
data_20 = Data(Tree({0;0}: ["Component A-Pos_0-Rot_0"], {0;1}: [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], {0;2}: [Point(1.8, 1.8, 1.8), Point(5.4, 1.8, 1.8), Point(9, 1.8, 1.8), Point(12.6, 1.8, 1.8)], {0;3}: [PlaneXZ(12.6, 0, 1.8), Plane(origin=(0, 1.8, 1.8), x=(0, -1, 0), y=(0, 0, 1)), Plane(origin=(5.4, 1.8, 3.6), x=(0, -1, 0), y=(1, 0, 0))], {0;4}: [Point(1.8, 1.8, 1.8), Point(5.4, 1.8, 1.8), Point(9, 1.8, 1.8), Point(12.6, 1.8, 1.8), Point(-1.8, 1.8, 1.8), Point(-5.4, 1.8, 1.8)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], {0;5}: [PlaneXZ(12.6, 0, 1.8), Plane(origin=(5.4, 1.8, 3.6), x=(0, -1, 0), y=(1, 0, 0)), Plane(origin=(-5.4, 1.8, 3.6), x=(0, 1, 0), y=(-1, 0, 0)), Plane(origin=(-12.6, 25.2, 1.8), x=(0, 0, -1), y=(1, 0, 0)), Plane(origin=(-5.4, 7.2, 1.8), x=(0, 0, 1), y=(-1, 0, 0)), Plane(origin=(-7.2, 27, 5.4), x=(0, 0, -1), y=(0, -1, 0))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], {0;6}: [PlaneXY(7.2, 1.8, 1.8), Plane(origin=(-7.2, 1.8, 1.8), x=(-1, 0, 0), y=(0, -1, 0)), Plane(origin=(-12.6, 10.8, 1.8), x=(0, 1, 0), y=(-1, 0, 0)), Plane(origin=(-9, 21.6, 1.8), x=(0, -1, 0), y=(1, 0, 0)), PlaneXZ(-14.4, 23.4, 5.4), Plane(origin=(-14.4, 19.8, 5.4), x=(1, 0, 0), y=(0, 0, -1))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]))
data_21 = Data(Tree({0;0}: ["Component A-Pos_0-Rot_2"], {0;1}: [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], {0;2}: [Point(1.8, 1.8, 1.8), Point(5.4, 1.8, 1.8), Point(9, 1.8, 1.8), Point(12.6, 1.8, 1.8)], {0;3}: [PlaneXZ(12.6, 0, 1.8), Plane(origin=(0, 1.8, 1.8), x=(0, 0, 1), y=(0, 1, 0)), PlaneXY(5.4, 1.8, 3.6)], {0;4}: [Point(1.8, 1.8, 1.8), Point(5.4, 1.8, 1.8), Point(9, 1.8, 1.8), Point(12.6, 1.8, 1.8), Point(-1.8, 1.8, 1.8), Point(-5.4, 1.8, 1.8)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], {0;5}: [PlaneXZ(12.6, 0, 1.8), PlaneXY(5.4, 1.8, 3.6), Plane(origin=(-5.4, 1.8, 0), x=(-1, 0, 0), y=(0, 1, 0)), PlaneXY(-5.4, -1.8, 3.6), Plane(origin=(-19.8, 5.4, 0), x=(0, -1, 0), y=(-1, 0, 0)), Plane(origin=(-5.4, 23.4, 0), x=(1, 0, 0), y=(0, -1, 0))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], {0;6}: [PlaneXY(7.2, 1.8, 1.8), Plane(origin=(-7.2, 1.8, 1.8), x=(-1, 0, 0), y=(0, 1, 0)), Plane(origin=(-10.8, -1.8, 1.8), x=(1, 0, 0), y=(0, 0, -1)), Plane(origin=(-19.8, 3.6, 1.8), x=(0, -1, 0), y=(-1, 0, 0)), Plane(origin=(-19.8, 18, 1.8), x=(0, 1, 0), y=(-1, 0, 0)), PlaneXZ(-10.8, 23.4, 1.8)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]))
data_22 = Data(Tree({0;0}: ["Component A-Pos_1-Rot_0"], {0;1}: [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], {0;2}: [Point(1.8, 1.8, 1.8), Point(5.4, 1.8, 1.8), Point(9, 1.8, 1.8), Point(12.6, 1.8, 1.8)], {0;3}: [PlaneXZ(12.6, 0, 1.8), Plane(origin=(0, 1.8, 1.8), x=(0, 0, 1), y=(0, 1, 0)), Plane(origin=(12.6, 1.8, 3.6), x=(0, -1, 0), y=(1, 0, 0))], {0;4}: [Point(1.8, 1.8, 1.8), Point(5.4, 1.8, 1.8), Point(9, 1.8, 1.8), Point(12.6, 1.8, 1.8), Point(-1.8, 1.8, 1.8), Point(-5.4, 1.8, 1.8)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], {0;5}: [PlaneXZ(12.6, 0, 1.8), Plane(origin=(12.6, 1.8, 3.6), x=(0, -1, 0), y=(1, 0, 0)), Plane(origin=(-12.6, 1.8, 0), x=(0, -1, 0), y=(-1, 0, 0)), Plane(origin=(-12.6, -1.8, 0), x=(0, 1, 0), y=(1, 0, 0)), Plane(origin=(-27, -1.8, 3.6), x=(0, -1, 0), y=(1, 0, 0)), Plane(origin=(-27, 12.6, 0), x=(0, -1, 0), y=(-1, 0, 0))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], {0;6}: [PlaneXY(7.2, 1.8, 1.8), Plane(origin=(-7.2, 1.8, 1.8), x=(-1, 0, 0), y=(0, 1, 0)), Plane(origin=(-18, -1.8, 1.8), x=(1, 0, 0), y=(0, -1, 0)), Plane(origin=(-27, 3.6, 1.8), x=(0, -1, 0), y=(0, 0, -1)), Plane(origin=(-21.6, 12.6, 1.8), x=(-1, 0, 0), y=(0, 1, 0)), PlaneXY(-7.2, 12.6, 1.8)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]))
data_23 = Data(Tree({0;0}: ["Component A-Pos_1-Rot_1"], {0;1}: [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], {0;2}: [Point(1.8, 1.8, 1.8), Point(5.4, 1.8, 1.8), Point(9, 1.8, 1.8), Point(12.6, 1.8, 1.8)], {0;3}: [Plane(origin=(12.6, 0, 1.8), x=(0, 0, 1), y=(-1, 0, 0)), Plane(origin=(0, 1.8, 1.8), x=(0, 0, 1), y=(0, 1, 0)), Plane(origin=(12.6, 1.8, 3.6), x=(0, -1, 0), y=(1, 0, 0))], {0;4}: [Point(1.8, 1.8, 1.8), Point(5.4, 1.8, 1.8), Point(9, 1.8, 1.8), Point(12.6, 1.8, 1.8), Point(-1.8, 12.6, 1.8), Point(-1.8, 9, 1.8)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], {0;5}: [Plane(origin=(12.6, 0, 1.8), x=(0, 0, 1), y=(-1, 0, 0)), Plane(origin=(12.6, 1.8, 3.6), x=(0, -1, 0), y=(1, 0, 0)), Plane(origin=(-1.8, 1.8, 0), x=(1, 0, 0), y=(0, -1, 0)), Plane(origin=(-16.2, 16.2, 0), x=(1, 0, 0), y=(0, -1, 0)), Plane(origin=(-16.2, 28.8, 9), x=(-1, 0, 0), y=(0, 0, 1)), Plane(origin=(-16.2, 12.6, 0), x=(0, 1, 0), y=(1, 0, 0))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], {0;6}: [PlaneXY(7.2, 1.8, 1.8), Plane(origin=(-1.8, 7.2, 1.8), x=(0, -1, 0), y=(-1, 0, 0)), PlaneXY(-7.2, 16.2, 1.8), Plane(origin=(-16.2, 21.6, 1.8), x=(0, -1, 0), y=(-1, 0, 0)), Plane(origin=(-10.8, 30.6, 1.8), x=(-1, 0, 0), y=(0, 0, -1)), Plane(origin=(-10.8, 30.6, 5.4), x=(-1, 0, 0), y=(0, 0, 1))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]))
data_24 = Data(Tree({0;0}: ["Component A-Pos_1-Rot_2"], {0;1}: [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], {0;2}: [Point(1.8, 1.8, 1.8), Point(5.4, 1.8, 1.8), Point(9, 1.8, 1.8), Point(12.6, 1.8, 1.8)], {0;3}: [Plane(origin=(12.6, 0, 1.8), x=(0, 0, 1), y=(-1, 0, 0)), Plane(origin=(0, 1.8, 1.8), x=(0, 0, 1), y=(0, 1, 0)), Plane(origin=(12.6, 1.8, 3.6), x=(-1, 0, 0), y=(0, -1, 0))], {0;4}: [Point(1.8, 1.8, 1.8), Point(5.4, 1.8, 1.8), Point(9, 1.8, 1.8), Point(12.6, 1.8, 1.8), Point(-1.8, 12.6, 1.8), Point(-1.8, 9, 1.8)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], {0;5}: [Plane(origin=(12.6, 0, 1.8), x=(0, 0, 1), y=(-1, 0, 0)), Plane(origin=(12.6, 1.8, 3.6), x=(-1, 0, 0), y=(0, -1, 0)), Plane(origin=(-1.8, 1.8, 0), x=(0, 1, 0), y=(1, 0, 0)), Plane(origin=(-16.2, 16.2, 0), x=(0, 1, 0), y=(1, 0, 0)), Plane(origin=(-19.8, 34.2, 0), x=(1, 0, 0), y=(0, -1, 0)), Plane(origin=(-5.4, 34.2, 14.4), x=(-1, 0, 0), y=(0, -1, 0))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], {0;6}: [PlaneXY(7.2, 1.8, 1.8), Plane(origin=(-1.8, 7.2, 1.8), x=(0, -1, 0), y=(-1, 0, 0)), PlaneXY(-7.2, 16.2, 1.8), Plane(origin=(-16.2, 21.6, 1.8), x=(0, -1, 0), y=(-1, 0, 0)), Plane(origin=(-16.2, 30.6, 7.2), x=(0, 0, -1), y=(1, 0, 0)), Plane(origin=(-19.8, 30.6, 7.2), x=(0, 0, -1), y=(-1, 0, 0))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]))
data_25 = Data(Tree({0;0}: ["Component A-Pos_2-Rot_0"], {0;1}: [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], {0;2}: [Point(1.8, 1.8, 1.8), Point(5.4, 1.8, 1.8), Point(9, 1.8, 1.8), Point(12.6, 1.8, 1.8)], {0;3}: [PlaneXZ(5.4, 0, 1.8), Plane(origin=(0, 1.8, 1.8), x=(0, 0, 1), y=(0, 1, 0)), Plane(origin=(5.4, 1.8, 3.6), x=(0, -1, 0), y=(1, 0, 0))], {0;4}: [Point(1.8, 1.8, 1.8), Point(5.4, 1.8, 1.8), Point(9, 1.8, 1.8), Point(12.6, 1.8, 1.8), Point(-1.8, 1.8, 1.8), Point(-5.4, 1.8, 1.8)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], {0;5}: [PlaneXZ(5.4, 0, 1.8), Plane(origin=(-5.4, 1.8, 0), x=(0, -1, 0), y=(-1, 0, 0)), Plane(origin=(-5.4, -1.8, 0), x=(0, 1, 0), y=(1, 0, 0)), Plane(origin=(-16.2, 5.4, 0), x=(0, 1, 0), y=(1, 0, 0)), Plane(origin=(-5.4, 3.6, 9), x=(-1, 0, 0), y=(0, 0, -1)), Plane(origin=(1.8, 0, 9), x=(-1, 0, 0), y=(0, 0, -1))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], {0;6}: [PlaneXY(7.2, 1.8, 1.8), Plane(origin=(-7.2, 1.8, 1.8), x=(-1, 0, 0), y=(0, 1, 0)), Plane(origin=(-3.6, -1.8, 1.8), x=(1, 0, 0), y=(0, -1, 0)), Plane(origin=(-18, -1.8, 1.8), x=(-1, 0, 0), y=(0, -1, 0)), PlaneYZ(-16.2, 7.2, 1.8), PlaneXY(-7.2, 5.4, 1.8)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]))
data_26 = Data(Tree({0;0}: ["Component A-Pos_2-Rot_1"], {0;1}: [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], {0;2}: [Point(1.8, 1.8, 1.8), Point(5.4, 1.8, 1.8), Point(9, 1.8, 1.8), Point(12.6, 1.8, 1.8)], {0;3}: [PlaneXZ(5.4, 0, 1.8), Plane(origin=(0, 1.8, 1.8), x=(0, 1, 0), y=(0, 0, -1)), Plane(origin=(5.4, 1.8, 3.6), x=(0, -1, 0), y=(1, 0, 0))], {0;4}: [Point(1.8, 1.8, 1.8), Point(5.4, 1.8, 1.8), Point(9, 1.8, 1.8), Point(12.6, 1.8, 1.8), Point(-1.8, 1.8, 1.8), Point(-5.4, 1.8, 1.8)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], {0;5}: [PlaneXZ(5.4, 0, 1.8), Plane(origin=(5.4, 1.8, 3.6), x=(0, -1, 0), y=(1, 0, 0)), Plane(origin=(-5.4, 1.8, 3.6), x=(0, 1, 0), y=(-1, 0, 0)), Plane(origin=(-5.4, 9, 0), x=(-1, 0, 0), y=(0, 1, 0)), Plane(origin=(-12.6, 16.2, 0), x=(-1, 0, 0), y=(0, 1, 0)), Plane(origin=(-19.8, 23.4, 0), x=(-1, 0, 0), y=(0, 1, 0))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], {0;6}: [PlaneXY(7.2, 1.8, 1.8), Plane(origin=(-7.2, 1.8, 1.8), x=(-1, 0, 0), y=(0, -1, 0)), Plane(origin=(-5.4, 10.8, 1.8), x=(0, 1, 0), y=(1, 0, 0)), Plane(origin=(-14.4, 9, 1.8), x=(-1, 0, 0), y=(0, -1, 0)), Plane(origin=(-12.6, 18, 1.8), x=(0, 1, 0), y=(1, 0, 0)), Plane(origin=(-21.6, 16.2, 1.8), x=(-1, 0, 0), y=(0, -1, 0))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]))
data_27 = Data(Tree({0;0}: ["Component A-Pos_2-Rot_2"], {0;1}: [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], {0;2}: [Point(1.8, 1.8, 1.8), Point(5.4, 1.8, 1.8), Point(9, 1.8, 1.8), Point(12.6, 1.8, 1.8)], {0;3}: [PlaneXZ(5.4, 0, 1.8), Plane(origin=(0, 1.8, 1.8), x=(0, 1, 0), y=(0, 0, -1)), Plane(origin=(5.4, 1.8, 3.6), x=(-1, 0, 0), y=(0, -1, 0))], {0;4}: [Point(1.8, 1.8, 1.8), Point(5.4, 1.8, 1.8), Point(9, 1.8, 1.8), Point(12.6, 1.8, 1.8), Point(-1.8, 1.8, 1.8), Point(-5.4, 1.8, 1.8)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], {0;5}: [Plane(origin=(-5.4, 9, 0), x=(0, -1, 0), y=(-1, 0, 0)), Plane(origin=(-9, 9, 0), x=(0, 1, 0), y=(1, 0, 0)), Plane(origin=(18, -9, 1.8), x=(0, -1, 0), y=(0, 0, -1)), Plane(origin=(14.4, -12.6, 5.4), x=(0, 0, 1), y=(0, -1, 0)), Plane(origin=(14.4, -12.6, 1.8), x=(0, -1, 0), y=(0, 0, -1)), Plane(origin=(18, -12.6, 12.6), x=(0, 0, 1), y=(0, -1, 0))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], {0;6}: [PlaneXY(7.2, 1.8, 1.8), Plane(origin=(-7.2, 1.8, 1.8), x=(-1, 0, 0), y=(0, -1, 0)), Plane(origin=(-5.4, 10.8, 1.8), x=(0, 1, 0), y=(1, 0, 0)), PlaneYZ(-9, 10.8, 1.8), Plane(origin=(-7.2, 1.8, 5.4), x=(-1, 0, 0), y=(0, 0, 1)), Plane(origin=(-5.4, 10.8, 5.4), x=(0, 1, 0), y=(-1, 0, 0))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]))

data_28 = Data(Tree({0;0}: ["Component A-Pos_0-Rot_0"], {0;1}: [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], {0;2}: [Point(1.8, 1.8, 1.8), Point(5.4, 1.8, 1.8), Point(9, 1.8, 1.8), Point(12.6, 1.8, 1.8)], {0;3}: [PlaneXZ(12.6, 0, 1.8), Plane(origin=(0, 1.8, 1.8), x=(0, 0, 1), y=(0, 1, 0)), Plane(origin=(5.4, 1.8, 3.6), x=(0, -1, 0), y=(1, 0, 0))], {0;4}: [Point(1.8, 1.8, 1.8), Point(5.4, 1.8, 1.8), Point(9, 1.8, 1.8), Point(12.6, 1.8, 1.8), Point(-1.8, 1.8, 1.8), Point(-5.4, 1.8, 1.8)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], {0;5}: [PlaneXZ(12.6, 0, 1.8), Plane(origin=(-5.4, 1.8, 0), x=(0, -1, 0), y=(-1, 0, 0)), Plane(origin=(-25.2, -1.8, 1.8), x=(0, 0, -1), y=(0, -1, 0)), Plane(origin=(-19.8, -1.8, 0), x=(0, 1, 0), y=(1, 0, 0)), Plane(origin=(3.6, 1.8, 16.2), x=(0, 0, 1), y=(0, 1, 0)), Plane(origin=(1.8, 57.6, 5.4), x=(-1, 0, 0), y=(0, 0, 1))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], {0;6}: [PlaneXY(7.2, 1.8, 1.8), Plane(origin=(-7.2, 1.8, 1.8), x=(-1, 0, 0), y=(0, 1, 0)), Plane(origin=(-18, -1.8, 1.8), x=(1, 0, 0), y=(0, -1, 0)), Plane(origin=(5.4, 1.8, 10.8), x=(0, 0, 1), y=(1, 0, 0)), PlaneYZ(5.4, 10.8, 9), Plane(origin=(5.4, 21.6, 5.4), x=(0, -1, 0), y=(0, 0, -1))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]))
data_29 = Data(Tree({0;0}: ["Component A-Pos_0-Rot_0"], {0;1}: [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], {0;2}: [Point(1.8, 1.8, 1.8), Point(5.4, 1.8, 1.8), Point(9, 1.8, 1.8), Point(12.6, 1.8, 1.8)], {0;3}: [PlaneXZ(12.6, 0, 1.8), Plane(origin=(0, 1.8, 1.8), x=(0, -1, 0), y=(0, 0, 1)), Plane(origin=(5.4, 1.8, 3.6), x=(0, -1, 0), y=(1, 0, 0))], {0;4}: [Point(1.8, 1.8, 1.8), Point(5.4, 1.8, 1.8), Point(9, 1.8, 1.8), Point(12.6, 1.8, 1.8), Point(-1.8, 1.8, 1.8), Point(-5.4, 1.8, 1.8)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], {0;5}: [Plane(origin=(-16.2, 18, 9), x=(1, 0, 0), y=(0, 0, -1)), Plane(origin=(-5.4, 23.4, 18), x=(0, 1, 0), y=(-1, 0, 0)), Plane(origin=(-19.8, 25.2, 9), x=(0, 0, -1), y=(1, 0, 0)), Plane(origin=(-12.6, 23.4, 21.6), x=(0, 1, 0), y=(-1, 0, 0)), Plane(origin=(-10.8, 34.2, 1.8), x=(0, 0, 1), y=(0, -1, 0)), Plane(origin=(-27, 34.2, 21.6), x=(0, -1, 0), y=(1, 0, 0))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], {0;6}: [PlaneXY(7.2, 1.8, 1.8), Plane(origin=(-7.2, 1.8, 1.8), x=(-1, 0, 0), y=(0, -1, 0)), Plane(origin=(-12.6, 10.8, 1.8), x=(0, 1, 0), y=(-1, 0, 0)), Plane(origin=(-9, 21.6, 1.8), x=(0, -1, 0), y=(1, 0, 0)), PlaneXZ(-14.4, 23.4, 5.4), PlaneXY(-14.4, 30.6, 1.8)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]))
data_30 = Data(Tree({0;0}: ["Component A-Pos_0-Rot_2"], {0;1}: [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], {0;2}: [Point(1.8, 1.8, 1.8), Point(5.4, 1.8, 1.8), Point(9, 1.8, 1.8), Point(12.6, 1.8, 1.8)], {0;3}: [PlaneXZ(12.6, 0, 1.8), Plane(origin=(0, 1.8, 1.8), x=(0, 0, 1), y=(0, 1, 0)), PlaneXY(5.4, 1.8, 3.6)], {0;4}: [Point(1.8, 1.8, 1.8), Point(5.4, 1.8, 1.8), Point(9, 1.8, 1.8), Point(12.6, 1.8, 1.8), Point(-1.8, 1.8, 1.8), Point(-5.4, 1.8, 1.8)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], {0;5}: [PlaneXZ(12.6, 0, 1.8), Plane(origin=(-5.4, 1.8, 0), x=(-1, 0, 0), y=(0, 1, 0)), Plane(origin=(-19.8, -1.8, 0), x=(1, 0, 0), y=(0, -1, 0)), Plane(origin=(-34.2, 25.2, 5.4), x=(1, 0, 0), y=(0, 0, -1)), Plane(origin=(-30.6, 32.4, 9), x=(0, 0, -1), y=(-1, 0, 0)), Plane(origin=(-27, 32.4, 12.6), x=(0, 0, -1), y=(-1, 0, 0))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], {0;6}: [PlaneXY(7.2, 1.8, 1.8), Plane(origin=(-7.2, 1.8, 1.8), x=(-1, 0, 0), y=(0, 1, 0)), Plane(origin=(-18, -1.8, 1.8), x=(1, 0, 0), y=(0, -1, 0)), Plane(origin=(5.4, 1.8, 10.8), x=(0, 0, 1), y=(0, 1, 0)), Plane(origin=(-3.6, 1.8, 9), x=(-1, 0, 0), y=(0, 1, 0)), Plane(origin=(-14.4, -1.8, 9), x=(1, 0, 0), y=(0, -1, 0))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]))
data_31 = Data(Tree({0;0}: ["Component A-Pos_1-Rot_1"], {0;1}: [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], {0;2}: [Point(1.8, 1.8, 1.8), Point(5.4, 1.8, 1.8), Point(9, 1.8, 1.8), Point(12.6, 1.8, 1.8)], {0;3}: [Plane(origin=(12.6, 0, 1.8), x=(0, 0, 1), y=(-1, 0, 0)), Plane(origin=(0, 1.8, 1.8), x=(0, 0, 1), y=(0, 1, 0)), Plane(origin=(12.6, 1.8, 3.6), x=(0, -1, 0), y=(1, 0, 0))], {0;4}: [Point(1.8, 1.8, 1.8), Point(5.4, 1.8, 1.8), Point(9, 1.8, 1.8), Point(12.6, 1.8, 1.8), Point(-1.8, 12.6, 1.8), Point(-1.8, 9, 1.8)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], {0;5}: [Plane(origin=(12.6, 0, 1.8), x=(0, 0, 1), y=(-1, 0, 0)), Plane(origin=(12.6, 1.8, 3.6), x=(0, -1, 0), y=(1, 0, 0)), Plane(origin=(-1.8, 1.8, 0), x=(1, 0, 0), y=(0, -1, 0)), Plane(origin=(-16.2, 16.2, 0), x=(1, 0, 0), y=(0, -1, 0)), Plane(origin=(-28.8, 30.6, 5.4), x=(0, 0, -1), y=(0, -1, 0)), Plane(origin=(12.6, 48.6, 0), x=(-1, 0, 0), y=(0, 1, 0))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], {0;6}: [PlaneXY(7.2, 1.8, 1.8), Plane(origin=(-1.8, 7.2, 1.8), x=(0, -1, 0), y=(-1, 0, 0)), PlaneXY(-7.2, 16.2, 1.8), Plane(origin=(-16.2, 21.6, 1.8), x=(0, -1, 0), y=(-1, 0, 0)), Plane(origin=(-10.8, 30.6, 1.8), x=(-1, 0, 0), y=(0, 0, -1)), Plane(origin=(-21.6, 30.6, 5.4), x=(1, 0, 0), y=(0, -1, 0))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]))
data_32 = Data(Tree({0;0}: ["Component A-Pos_1-Rot_0"], {0;1}: [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], {0;2}: [Point(1.8, 1.8, 1.8), Point(5.4, 1.8, 1.8), Point(9, 1.8, 1.8), Point(12.6, 1.8, 1.8)], {0;3}: [PlaneXZ(12.6, 0, 1.8), Plane(origin=(0, 1.8, 1.8), x=(0, 0, 1), y=(0, 1, 0)), Plane(origin=(12.6, 1.8, 3.6), x=(0, -1, 0), y=(1, 0, 0))], {0;4}: [Point(1.8, 1.8, 1.8), Point(5.4, 1.8, 1.8), Point(9, 1.8, 1.8), Point(12.6, 1.8, 1.8), Point(-1.8, 1.8, 1.8), Point(-5.4, 1.8, 1.8)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], {0;5}: [PlaneXZ(12.6, 0, 1.8), Plane(origin=(-12.6, 1.8, 0), x=(0, -1, 0), y=(-1, 0, 0)), Plane(origin=(-12.6, -1.8, 0), x=(0, 1, 0), y=(1, 0, 0)), Plane(origin=(-27, -1.8, 3.6), x=(0, -1, 0), y=(1, 0, 0)), Plane(origin=(-27, 12.6, 0), x=(0, -1, 0), y=(-1, 0, 0)), PlaneXZ(-1.8, 10.8, 1.8)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], {0;6}: [PlaneXY(7.2, 1.8, 1.8), Plane(origin=(-7.2, 1.8, 1.8), x=(-1, 0, 0), y=(0, 1, 0)), Plane(origin=(-18, -1.8, 1.8), x=(1, 0, 0), y=(0, -1, 0)), Plane(origin=(-27, 3.6, 1.8), x=(0, -1, 0), y=(0, 0, -1)), Plane(origin=(-21.6, 12.6, 1.8), x=(-1, 0, 0), y=(0, 1, 0)), PlaneXY(-7.2, 12.6, 1.8)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]))
data_33 = Data(Tree({0;0}: ["Component A-Pos_1-Rot_2"], {0;1}: [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], {0;2}: [Point(1.8, 1.8, 1.8), Point(5.4, 1.8, 1.8), Point(9, 1.8, 1.8), Point(12.6, 1.8, 1.8)], {0;3}: [Plane(origin=(12.6, 0, 1.8), x=(0, 0, 1), y=(-1, 0, 0)), Plane(origin=(0, 1.8, 1.8), x=(0, 0, 1), y=(0, 1, 0)), Plane(origin=(12.6, 1.8, 3.6), x=(-1, 0, 0), y=(0, -1, 0))], {0;4}: [Point(1.8, 1.8, 1.8), Point(5.4, 1.8, 1.8), Point(9, 1.8, 1.8), Point(12.6, 1.8, 1.8), Point(-1.8, 12.6, 1.8), Point(-1.8, 9, 1.8)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], {0;5}: [Plane(origin=(-1.8, 1.8, 0), x=(0, 1, 0), y=(1, 0, 0)), Plane(origin=(-16.2, 16.2, 0), x=(0, 1, 0), y=(1, 0, 0)), Plane(origin=(-19.8, 43.2, 1.8), x=(1, 0, 0), y=(0, 0, -1)), Plane(origin=(-32.4, 30.6, 5.4), x=(0, 0, -1), y=(0, -1, 0)), Plane(origin=(-18, 34.2, 16.2), x=(0, 0, -1), y=(0, -1, 0)), Plane(origin=(-16.2, 37.8, 0), x=(1, 0, 0), y=(0, -1, 0))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], {0;6}: [PlaneXY(7.2, 1.8, 1.8), Plane(origin=(-1.8, 7.2, 1.8), x=(0, -1, 0), y=(-1, 0, 0)), PlaneXY(-7.2, 16.2, 1.8), Plane(origin=(-16.2, 21.6, 1.8), x=(0, -1, 0), y=(-1, 0, 0)), Plane(origin=(-16.2, 30.6, 7.2), x=(0, 0, -1), y=(1, 0, 0)), Plane(origin=(-19.8, 36, 1.8), x=(0, -1, 0), y=(0, 0, -1))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]))
data_34 = Data(Tree({0;0}: ["Component A-Pos_2-Rot_1"], {0;1}: [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], {0;2}: [Point(1.8, 1.8, 1.8), Point(5.4, 1.8, 1.8), Point(9, 1.8, 1.8), Point(12.6, 1.8, 1.8)], {0;3}: [PlaneXZ(5.4, 0, 1.8), Plane(origin=(0, 1.8, 1.8), x=(0, 1, 0), y=(0, 0, -1)), Plane(origin=(5.4, 1.8, 3.6), x=(0, -1, 0), y=(1, 0, 0))], {0;4}: [Point(1.8, 1.8, 1.8), Point(5.4, 1.8, 1.8), Point(9, 1.8, 1.8), Point(12.6, 1.8, 1.8), Point(-1.8, 1.8, 1.8), Point(-5.4, 1.8, 1.8)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], {0;5}: [PlaneXZ(5.4, 0, 1.8), Plane(origin=(5.4, 1.8, 3.6), x=(0, -1, 0), y=(1, 0, 0)), Plane(origin=(-5.4, 9, 0), x=(-1, 0, 0), y=(0, 1, 0)), Plane(origin=(-12.6, 16.2, 0), x=(-1, 0, 0), y=(0, 1, 0)), Plane(origin=(-21.6, 23.4, 1.8), x=(0, 1, 0), y=(0, 0, -1)), Plane(origin=(-19.8, 23.4, 0), x=(-1, 0, 0), y=(0, 1, 0))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], {0;6}: [PlaneXY(7.2, 1.8, 1.8), Plane(origin=(-7.2, 1.8, 1.8), x=(-1, 0, 0), y=(0, -1, 0)), Plane(origin=(-5.4, 10.8, 1.8), x=(0, 1, 0), y=(1, 0, 0)), Plane(origin=(-14.4, 9, 1.8), x=(-1, 0, 0), y=(0, -1, 0)), Plane(origin=(-12.6, 18, 1.8), x=(0, 1, 0), y=(1, 0, 0)), Plane(origin=(-21.6, 16.2, 1.8), x=(-1, 0, 0), y=(0, -1, 0))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]))
data_35 = Data(Tree({0;0}: ["Component A-Pos_2-Rot_0"], {0;1}: [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], {0;2}: [Point(1.8, 1.8, 1.8), Point(5.4, 1.8, 1.8), Point(9, 1.8, 1.8), Point(12.6, 1.8, 1.8)], {0;3}: [PlaneXZ(5.4, 0, 1.8), Plane(origin=(0, 1.8, 1.8), x=(0, 0, 1), y=(0, 1, 0)), Plane(origin=(5.4, 1.8, 3.6), x=(0, -1, 0), y=(1, 0, 0))], {0;4}: [Point(1.8, 1.8, 1.8), Point(5.4, 1.8, 1.8), Point(9, 1.8, 1.8), Point(12.6, 1.8, 1.8), Point(-1.8, 1.8, 1.8), Point(-5.4, 1.8, 1.8)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], {0;5}: [Plane(origin=(-5.4, 1.8, 0), x=(0, -1, 0), y=(-1, 0, 0)), Plane(origin=(-12.6, -5.4, 0), x=(0, -1, 0), y=(-1, 0, 0)), Plane(origin=(-12.6, 0, 5.4), x=(-1, 0, 0), y=(0, 0, -1)), Plane(origin=(-1.8, -5.4, 0), x=(0, -1, 0), y=(-1, 0, 0)), Plane(origin=(-1.8, -1.8, 14.4), x=(0, 1, 0), y=(1, 0, 0)), Plane(origin=(7.2, -1.8, 12.6), x=(0, 0, 1), y=(0, 1, 0))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], {0;6}: [PlaneXY(7.2, 1.8, 1.8), Plane(origin=(-7.2, 1.8, 1.8), x=(-1, 0, 0), y=(0, 1, 0)), PlaneYZ(5.4, 3.6, 5.4), Plane(origin=(-5.4, -7.2, 1.8), x=(0, -1, 0), y=(0, 0, -1)), Plane(origin=(-3.6, -5.4, 5.4), x=(1, 0, 0), y=(0, -1, 0)), Plane(origin=(-5.4, 3.6, 5.4), x=(0, 1, 0), y=(0, 0, -1))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]))
data_36 = Data(Tree({0;0}: ["Component A-Pos_2-Rot_2"], {0;1}: [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], {0;2}: [Point(1.8, 1.8, 1.8), Point(5.4, 1.8, 1.8), Point(9, 1.8, 1.8), Point(12.6, 1.8, 1.8)], {0;3}: [PlaneXZ(5.4, 0, 1.8), Plane(origin=(0, 1.8, 1.8), x=(0, 1, 0), y=(0, 0, -1)), Plane(origin=(5.4, 1.8, 3.6), x=(-1, 0, 0), y=(0, -1, 0))], {0;4}: [Point(1.8, 1.8, 1.8), Point(5.4, 1.8, 1.8), Point(9, 1.8, 1.8), Point(12.6, 1.8, 1.8), Point(-1.8, 1.8, 1.8), Point(-5.4, 1.8, 1.8)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], {0;5}: [PlaneXZ(5.4, 0, 1.8), Plane(origin=(-5.4, 9, 0), x=(0, -1, 0), y=(-1, 0, 0)), Plane(origin=(-12.6, 16.2, 0), x=(0, -1, 0), y=(-1, 0, 0)), Plane(origin=(-19.8, 23.4, 0), x=(0, -1, 0), y=(-1, 0, 0)), Plane(origin=(-18, 19.8, 12.6), x=(0, 0, 1), y=(0, 1, 0)), Plane(origin=(-23.4, 23.4, 0), x=(0, 1, 0), y=(1, 0, 0))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], {0;6}: [PlaneXY(7.2, 1.8, 1.8), Plane(origin=(-7.2, 1.8, 1.8), x=(-1, 0, 0), y=(0, -1, 0)), Plane(origin=(-5.4, 10.8, 1.8), x=(0, 1, 0), y=(1, 0, 0)), Plane(origin=(-14.4, 9, 1.8), x=(-1, 0, 0), y=(0, -1, 0)), Plane(origin=(-12.6, 18, 1.8), x=(0, 1, 0), y=(1, 0, 0)), Plane(origin=(-21.6, 16.2, 1.8), x=(-1, 0, 0), y=(0, -1, 0))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]))

data_37 = Data(Tree({0;0}: ["Component_B-Pos_0-Rot_1"], {0;1}: [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], {0;2}: [Point(1.8, 19.8, 1.8), Point(5.4, 19.8, 1.8), Point(9, 19.8, 1.8), Point(12.6, 19.8, 1.8), Point(5.4, 19.8, 5.4)], {0;3}: [PlaneXZ(12.6, 18, 1.8), Plane(origin=(0, 19.8, 1.8), x=(0, 0, 1), y=(0, 1, 0)), Plane(origin=(5.4, 19.8, 7.2), x=(0, -1, 0), y=(1, 0, 0))], {0;4}: [Point(1.8, 19.8, 1.8), Point(5.4, 19.8, 1.8), Point(9, 19.8, 1.8), Point(12.6, 19.8, 1.8), Point(5.4, 19.8, 5.4), Point(-5.4, 16.2, 1.8)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], {0;5}: [Plane(origin=(-5.4, 27, 0), x=(0, 1, 0), y=(1, 0, 0)), Plane(origin=(-5.4, 1.8, 0), x=(0, -1, 0), y=(-1, 0, 0)), Plane(origin=(-23.4, 23.4, 0), x=(0, 1, 0), y=(1, 0, 0)), Plane(origin=(-16.2, 37.8, 0), x=(0, -1, 0), y=(-1, 0, 0)), Plane(origin=(-9, 19.8, 0), x=(0, -1, 0), y=(-1, 0, 0)), Plane(origin=(-21.6, 5.4, 5.4), x=(0, 0, -1), y=(0, -1, 0))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], {0;6}: [PlaneXY(6.84, 19.8, 2.52), PlaneYZ(-4.68, 21.24, 1.8), Plane(origin=(-6.12, 7.56, 1.8), x=(0, -1, 0), y=(0, 0, 1)), PlaneYZ(6.12, 14.04, 9), Plane(origin=(-17.64, 9, 2.52), x=(-1, 0, 0), y=(0, -1, 0)), PlaneYZ(-22.68, 17.64, 1.8)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]))
data_38 = Data(Tree({0;0}: ["Component_B-Pos_0-Rot_2"], {0;1}: [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], {0;2}: [Point(1.8, 19.8, 1.8), Point(5.4, 19.8, 1.8), Point(9, 19.8, 1.8), Point(12.6, 19.8, 1.8), Point(5.4, 19.8, 5.4)], {0;3}: [PlaneXZ(12.6, 18, 1.8), Plane(origin=(0, 19.8, 1.8), x=(0, 0, 1), y=(0, 1, 0)), PlaneXY(5.4, 19.8, 7.2)], {0;4}: [Point(1.8, 19.8, 1.8), Point(5.4, 19.8, 1.8), Point(9, 19.8, 1.8), Point(12.6, 19.8, 1.8), Point(5.4, 19.8, 5.4), Point(-1.8, 19.8, 12.6)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], {0;5}: [PlaneXY(5.4, 19.8, 7.2), Plane(origin=(-1.8, 19.8, 14.4), x=(0, 1, 0), y=(-1, 0, 0)), Plane(origin=(-1.8, 30.6, 3.6), x=(0, -1, 0), y=(-1, 0, 0)), Plane(origin=(5.4, 50.4, 16.2), x=(0, 0, -1), y=(-1, 0, 0)), Plane(origin=(5.4, 39.6, 5.4), x=(0, 0, 1), y=(-1, 0, 0)), Plane(origin=(1.8, 30.6, 3.6), x=(0, -1, 0), y=(1, 0, 0))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], {0;6}: [PlaneXY(6.84, 19.8, 2.52), Plane(origin=(-1.8, 20.52, 7.56), x=(0, 0, -1), y=(-1, 0, 0)), Plane(origin=(-1.8, 29.88, 10.44), x=(0, 0, 1), y=(-1, 0, 0)), Plane(origin=(6.84, 30.6, 15.48), x=(1, 0, 0), y=(0, -1, 0)), Plane(origin=(11.88, 39.24, 16.2), x=(0, 1, 0), y=(0, 0, -1)), Plane(origin=(5.4, 43.56, 15.48), x=(0, -1, 0), y=(-1, 0, 0))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]))
data_39 = Data(Tree({0;0}: ["Component_B-Pos_0-Rot_0"], {0;1}: [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], {0;2}: [Point(1.8, 19.8, 1.8), Point(5.4, 19.8, 1.8), Point(9, 19.8, 1.8), Point(12.6, 19.8, 1.8), Point(5.4, 19.8, 5.4)], {0;3}: [PlaneXZ(12.6, 18, 1.8), Plane(origin=(0, 19.8, 1.8), x=(0, -1, 0), y=(0, 0, 1)), Plane(origin=(5.4, 19.8, 7.2), x=(0, -1, 0), y=(1, 0, 0))], {0;4}: [Point(1.8, 19.8, 1.8), Point(5.4, 19.8, 1.8), Point(9, 19.8, 1.8), Point(12.6, 19.8, 1.8), Point(5.4, 19.8, 5.4), Point(-1.8, 9, 1.8)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], {0;5}: [PlaneXZ(12.6, 18, 1.8), Plane(origin=(-25.2, 12.6, 9), x=(0, 0, -1), y=(0, -1, 0)), PlaneXZ(-27, 7.2, 1.8), PlaneXY(-27, 12.6, 7.2), Plane(origin=(-5.4, 21.6, 16.2), x=(0, 0, 1), y=(-1, 0, 0)), Plane(origin=(-9, 19.8, 3.6), x=(0, -1, 0), y=(-1, 0, 0))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], {0;6}: [PlaneXY(6.84, 19.8, 2.52), Plane(origin=(-1.8, 14.04, 2.52), x=(0, 1, 0), y=(-1, 0, 0)), Plane(origin=(-1.8, 13.32, 14.04), x=(0, 0, 1), y=(1, 0, 0)), PlaneXY(-7.56, 19.8, 13.32), Plane(origin=(-19.08, 19.8, 14.04), x=(0, 0, 1), y=(0, -1, 0)), PlaneXY(-18.36, 19.8, 2.52)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]))
data_40 = Data(Tree({0;0}: ["Component_B-Pos_1-Rot_0"], {0;1}: [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], {0;2}: [Point(1.8, 19.8, 1.8), Point(5.4, 19.8, 1.8), Point(9, 19.8, 1.8), Point(12.6, 19.8, 1.8), Point(5.4, 19.8, 5.4)], {0;3}: [PlaneXZ(5.4, 18, 1.8), Plane(origin=(0, 19.8, 1.8), x=(0, -1, 0), y=(0, 0, 1)), Plane(origin=(5.4, 19.8, 7.2), x=(0, -1, 0), y=(1, 0, 0))], {0;4}: [Point(1.8, 19.8, 1.8), Point(5.4, 19.8, 1.8), Point(9, 19.8, 1.8), Point(12.6, 19.8, 1.8), Point(5.4, 19.8, 5.4), Point(-1.8, 19.8, 1.8)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], {0;5}: [Plane(origin=(0, 27, 9), x=(0, 0, -1), y=(0, 1, 0)), PlaneXZ(1.8, 25.2, 1.8), Plane(origin=(1.8, 27, 7.2), x=(0, -1, 0), y=(1, 0, 0)), Plane(origin=(-3.6, 12.6, 12.6), x=(0, 0, -1), y=(0, 1, 0)), Plane(origin=(3.6, 52.2, 12.6), x=(0, 0, -1), y=(0, -1, 0)), Plane(origin=(1.8, 19.8, 7.2), x=(-1, 0, 0), y=(0, 1, 0))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], {0;6}: [PlaneXY(6.84, 19.8, 2.52), Plane(origin=(-6.84, 19.8, 2.52), x=(-1, 0, 0), y=(0, -1, 0)), Plane(origin=(-5.4, 28.44, 2.52), x=(0, 1, 0), y=(-1, 0, 0)), Plane(origin=(-6.84, 27.72, 9), x=(-1, 0, 0), y=(0, 0, 1)), Plane(origin=(-6.84, 19.8, 11.88), x=(-1, 0, 0), y=(0, 1, 0)), PlaneXY(3.24, 27, 2.52)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]))
data_41 = Data(Tree({0;0}: ["Component_B-Pos_1-Rot_1"], {0;1}: [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], {0;2}: [Point(1.8, 19.8, 1.8), Point(5.4, 19.8, 1.8), Point(9, 19.8, 1.8), Point(12.6, 19.8, 1.8), Point(5.4, 19.8, 5.4)], {0;3}: [Plane(origin=(5.4, 18, 1.8), x=(0, 0, 1), y=(-1, 0, 0)), Plane(origin=(0, 19.8, 1.8), x=(0, -1, 0), y=(0, 0, 1)), Plane(origin=(5.4, 19.8, 7.2), x=(0, -1, 0), y=(1, 0, 0))], {0;4}: [Point(1.8, 19.8, 1.8), Point(5.4, 19.8, 1.8), Point(9, 19.8, 1.8), Point(12.6, 19.8, 1.8), Point(5.4, 19.8, 5.4), Point(9, 12.6, 1.8)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], {0;5}: [Plane(origin=(5.4, 19.8, 7.2), x=(0, -1, 0), y=(1, 0, 0)), Plane(origin=(5.4, 12.6, 0), x=(0, 1, 0), y=(1, 0, 0)), Plane(origin=(10.8, 12.6, 1.8), x=(0, 0, -1), y=(0, 1, 0)), Plane(origin=(-5.4, 27, 0), x=(0, -1, 0), y=(-1, 0, 0)), Plane(origin=(-5.4, 28.8, 9), x=(0, 0, -1), y=(1, 0, 0)), Plane(origin=(5.4, 32.4, 1.8), x=(0, 0, 1), y=(-1, 0, 0))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], {0;6}: [PlaneXY(6.84, 19.8, 2.52), Plane(origin=(3.96, 13.32, 1.8), x=(-1, 0, 0), y=(0, 0, 1)), Plane(origin=(-6.84, 19.8, 2.52), x=(-1, 0, 0), y=(0, -1, 0)), PlaneXZ(-3.96, 26.28, 1.8), Plane(origin=(-17.64, 26.28, 1.8), x=(-1, 0, 0), y=(0, 0, -1)), Plane(origin=(-14.76, 27, 8.28), x=(1, 0, 0), y=(0, -1, 0))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]))
data_42 = Data(Tree({0;0}: ["Component_B-Pos_1-Rot_2"], {0;1}: [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], {0;2}: [Point(1.8, 19.8, 1.8), Point(5.4, 19.8, 1.8), Point(9, 19.8, 1.8), Point(12.6, 19.8, 1.8), Point(5.4, 19.8, 5.4)], {0;3}: [Plane(origin=(5.4, 18, 1.8), x=(0, 0, -1), y=(1, 0, 0)), Plane(origin=(0, 19.8, 1.8), x=(0, -1, 0), y=(0, 0, 1)), Plane(origin=(5.4, 19.8, 7.2), x=(0, -1, 0), y=(1, 0, 0))], {0;4}: [Point(1.8, 19.8, 1.8), Point(5.4, 19.8, 1.8), Point(9, 19.8, 1.8), Point(12.6, 19.8, 1.8), Point(5.4, 19.8, 5.4), Point(1.8, 19.8, 9)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], {0;5}: [Plane(origin=(0, 19.8, 9), x=(0, 0, -1), y=(0, -1, 0)), Plane(origin=(0, 27, 1.8), x=(0, 0, 1), y=(0, -1, 0)), Plane(origin=(0, 19.8, 12.6), x=(0, -1, 0), y=(0, 0, -1)), Plane(origin=(5.4, 27, 14.4), x=(0, 1, 0), y=(-1, 0, 0)), Plane(origin=(-5.4, 34.2, 0), x=(0, -1, 0), y=(-1, 0, 0)), PlaneXY(-5.4, 45, 3.6)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], {0;6}: [PlaneXY(6.84, 19.8, 2.52), PlaneXZ(6.84, 19.08, 9), Plane(origin=(-6.84, 19.8, 2.52), x=(-1, 0, 0), y=(0, -1, 0)), Plane(origin=(-6.84, 26.28, 1.8), x=(-1, 0, 0), y=(0, 0, -1)), Plane(origin=(-6.84, 27, 8.28), x=(-1, 0, 0), y=(0, 1, 0)), Plane(origin=(-6.84, 19.8, 11.88), x=(-1, 0, 0), y=(0, 1, 0))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]))
data_43 = Data(Tree({0;0}: ["Component_B-Pos_2-Rot_0"], {0;1}: [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], {0;2}: [Point(1.8, 19.8, 1.8), Point(5.4, 19.8, 1.8), Point(9, 19.8, 1.8), Point(12.6, 19.8, 1.8), Point(5.4, 19.8, 5.4)], {0;3}: [PlaneXZ(12.6, 18, 1.8), Plane(origin=(0, 19.8, 1.8), x=(0, -1, 0), y=(0, 0, 1)), Plane(origin=(12.6, 19.8, 3.6), x=(0, -1, 0), y=(1, 0, 0))], {0;4}: [Point(1.8, 19.8, 1.8), Point(5.4, 19.8, 1.8), Point(9, 19.8, 1.8), Point(12.6, 19.8, 1.8), Point(5.4, 19.8, 5.4), Point(-1.8, 9, 1.8)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], {0;5}: [Plane(origin=(-1.8, -5.4, 3.6), x=(-1, 0, 0), y=(0, -1, 0)), Plane(origin=(-16.2, -5.4, 3.6), x=(0, 1, 0), y=(-1, 0, 0)), Plane(origin=(-12.6, 9, 3.6), x=(-1, 0, 0), y=(0, -1, 0)), Plane(origin=(-1.8, 21.6, 16.2), x=(-1, 0, 0), y=(0, 0, 1)), Plane(origin=(1.8, 30.6, 3.6), x=(0, 1, 0), y=(-1, 0, 0)), PlaneYZ(18, 45, 16.2)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], {0;6}: [PlaneXY(6.84, 19.8, 2.52), Plane(origin=(-1.8, 14.04, 2.52), x=(0, 1, 0), y=(-1, 0, 0)), Plane(origin=(-1.8, 0.36, 2.52), x=(0, -1, 0), y=(1, 0, 0)), Plane(origin=(-10.44, -5.4, 2.52), x=(-1, 0, 0), y=(0, -1, 0)), Plane(origin=(-16.2, 3.24, 2.52), x=(0, 1, 0), y=(-1, 0, 0)), Plane(origin=(-12.6, 14.76, 2.52), x=(0, -1, 0), y=(1, 0, 0))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]))
data_44 = Data(Tree({0;0}: ["Component_B-Pos_2-Rot_1"], {0;1}: [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], {0;2}: [Point(1.8, 19.8, 1.8), Point(5.4, 19.8, 1.8), Point(9, 19.8, 1.8), Point(12.6, 19.8, 1.8), Point(5.4, 19.8, 5.4)], {0;3}: [PlaneXZ(12.6, 18, 1.8), Plane(origin=(0, 19.8, 1.8), x=(0, -1, 0), y=(0, 0, 1)), Plane(origin=(12.6, 19.8, 3.6), x=(-1, 0, 0), y=(0, -1, 0))], {0;4}: [Point(1.8, 19.8, 1.8), Point(5.4, 19.8, 1.8), Point(9, 19.8, 1.8), Point(12.6, 19.8, 1.8), Point(5.4, 19.8, 5.4), Point(-1.8, 9, 1.8)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], {0;5}: [Plane(origin=(0, 19.8, 5.4), x=(0, -1, 0), y=(0, 0, -1)), PlaneXZ(-1.8, 32.4, 1.8), Plane(origin=(23.4, 34.2, 0), x=(1, 0, 0), y=(0, -1, 0)), Plane(origin=(-16.2, 19.8, 0), x=(0, 1, 0), y=(1, 0, 0)), Plane(origin=(-12.6, 19.8, 0), x=(0, -1, 0), y=(-1, 0, 0)), Plane(origin=(-28.8, 19.8, 9), x=(0, 1, 0), y=(0, 0, -1))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], {0;6}: [PlaneXY(6.84, 19.8, 2.52), Plane(origin=(-1.8, 14.04, 2.52), x=(0, 1, 0), y=(-1, 0, 0)), Plane(origin=(-1.8, 25.56, 4.68), x=(0, -1, 0), y=(-1, 0, 0)), PlaneXZ(-7.56, 33.48, 5.4), Plane(origin=(3.96, 33.48, 1.8), x=(-1, 0, 0), y=(0, 0, -1)), PlaneXZ(17.64, 33.48, 1.8)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]))
data_45 = Data(Tree({0;0}: ["Component_B-Pos_2-Rot_2"], {0;1}: [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], {0;2}: [Point(1.8, 19.8, 1.8), Point(5.4, 19.8, 1.8), Point(9, 19.8, 1.8), Point(12.6, 19.8, 1.8), Point(5.4, 19.8, 5.4)], {0;3}: [Plane(origin=(12.6, 18, 1.8), x=(0, 0, 1), y=(-1, 0, 0)), Plane(origin=(0, 19.8, 1.8), x=(0, -1, 0), y=(0, 0, 1)), Plane(origin=(12.6, 19.8, 3.6), x=(-1, 0, 0), y=(0, -1, 0))], {0;4}: [Point(1.8, 19.8, 1.8), Point(5.4, 19.8, 1.8), Point(9, 19.8, 1.8), Point(12.6, 19.8, 1.8), Point(5.4, 19.8, 5.4), Point(-1.8, 19.8, 12.6)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], {0;5}: [Plane(origin=(12.6, 19.8, 3.6), x=(-1, 0, 0), y=(0, -1, 0)), Plane(origin=(-1.8, 34.2, 0), x=(1, 0, 0), y=(0, -1, 0)), Plane(origin=(1.8, 34.2, 0), x=(-1, 0, 0), y=(0, 1, 0)), PlaneXY(-1.8, 48.6, 3.6), Plane(origin=(-1.8, 61.2, 1.8), x=(0, 0, 1), y=(1, 0, 0)), Plane(origin=(-19.8, 45, 0), x=(1, 0, 0), y=(0, -1, 0))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], {0;6}: [PlaneXY(6.84, 19.8, 2.52), Plane(origin=(-1.8, 20.52, 7.56), x=(0, 0, -1), y=(-1, 0, 0)), Plane(origin=(-7.56, 19.8, 15.48), x=(1, 0, 0), y=(0, -1, 0)), Plane(origin=(-16.2, 19.08, 10.44), x=(0, 0, 1), y=(-1, 0, 0)), Plane(origin=(-16.92, 14.04, 1.8), x=(0, 1, 0), y=(0, 0, -1)), Plane(origin=(-19.08, 25.56, 1.8), x=(0, -1, 0), y=(0, 0, -1))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]))

data_46 = Data(Tree({0;0}: ["Component_B-Pos_0-Rot_0"], {0;1}: [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], {0;2}: [Point(1.8, 19.8, 1.8), Point(5.4, 19.8, 1.8), Point(9, 19.8, 1.8), Point(12.6, 19.8, 1.8), Point(5.4, 19.8, 5.4)], {0;3}: [PlaneXZ(12.6, 18, 1.8), Plane(origin=(0, 19.8, 1.8), x=(0, -1, 0), y=(0, 0, 1)), Plane(origin=(5.4, 19.8, 7.2), x=(0, -1, 0), y=(1, 0, 0))], {0;4}: [Point(1.8, 19.8, 1.8), Point(5.4, 19.8, 1.8), Point(9, 19.8, 1.8), Point(12.6, 19.8, 1.8), Point(5.4, 19.8, 5.4), Point(-1.8, 19.8, 1.8)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], {0;5}: [PlaneXZ(12.6, 18, 1.8), Plane(origin=(5.4, 19.8, 7.2), x=(0, -1, 0), y=(1, 0, 0)), Plane(origin=(-16.2, 19.8, 21.6), x=(0, 1, 0), y=(-1, 0, 0)), Plane(origin=(-5.4, 34.2, 0), x=(0, -1, 0), y=(-1, 0, 0)), Plane(origin=(-16.2, 28.8, 12.6), x=(0, 0, -1), y=(1, 0, 0)), PlaneYZ(-14.4, 37.8, 1.8)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], {0;6}: [PlaneXY(6.84, 19.8, 2.52), Plane(origin=(-6.84, 19.8, 2.52), x=(-1, 0, 0), y=(0, -1, 0)), PlaneXY(-18.36, 23.4, 2.52), Plane(origin=(-6.12, 25.56, 9), x=(0, -1, 0), y=(0, 0, 1)), Plane(origin=(-17.64, 26.28, 9), x=(-1, 0, 0), y=(0, 0, -1)), Plane(origin=(-18.36, 23.4, 11.88), x=(1, 0, 0), y=(0, -1, 0))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]))
data_47 = Data(Tree({0;0}: ["Component_B-Pos_0-Rot_1"], {0;1}: [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], {0;2}: [Point(1.8, 19.8, 1.8), Point(5.4, 19.8, 1.8), Point(9, 19.8, 1.8), Point(12.6, 19.8, 1.8), Point(5.4, 19.8, 5.4)], {0;3}: [PlaneXZ(12.6, 18, 1.8), Plane(origin=(0, 19.8, 1.8), x=(0, 0, 1), y=(0, 1, 0)), Plane(origin=(5.4, 19.8, 7.2), x=(0, -1, 0), y=(1, 0, 0))], {0;4}: [Point(1.8, 19.8, 1.8), Point(5.4, 19.8, 1.8), Point(9, 19.8, 1.8), Point(12.6, 19.8, 1.8), Point(5.4, 19.8, 5.4), Point(-5.4, 16.2, 1.8)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], {0;5}: [Plane(origin=(-5.4, 27, 0), x=(0, 1, 0), y=(1, 0, 0)), Plane(origin=(-5.4, 1.8, 0), x=(0, -1, 0), y=(-1, 0, 0)), Plane(origin=(-23.4, 23.4, 0), x=(0, 1, 0), y=(1, 0, 0)), Plane(origin=(-16.2, 37.8, 0), x=(0, -1, 0), y=(-1, 0, 0)), Plane(origin=(-9, 19.8, 0), x=(0, -1, 0), y=(-1, 0, 0)), Plane(origin=(-21.6, 5.4, 5.4), x=(0, 0, -1), y=(0, -1, 0))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], {0;6}: [PlaneXY(6.84, 19.8, 2.52), PlaneYZ(-4.68, 21.24, 1.8), Plane(origin=(-6.12, 7.56, 1.8), x=(0, -1, 0), y=(0, 0, 1)), PlaneYZ(6.12, 14.04, 9), Plane(origin=(-17.64, 9, 2.52), x=(-1, 0, 0), y=(0, -1, 0)), PlaneYZ(-22.68, 17.64, 1.8)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]))
data_48 = Data(Tree({0;0}: ["Component_B-Pos_0-Rot_2"], {0;1}: [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], {0;2}: [Point(1.8, 19.8, 1.8), Point(5.4, 19.8, 1.8), Point(9, 19.8, 1.8), Point(12.6, 19.8, 1.8), Point(5.4, 19.8, 5.4)], {0;3}: [PlaneXZ(12.6, 18, 1.8), Plane(origin=(0, 19.8, 1.8), x=(0, 0, 1), y=(0, 1, 0)), PlaneXY(5.4, 19.8, 7.2)], {0;4}: [Point(1.8, 19.8, 1.8), Point(5.4, 19.8, 1.8), Point(9, 19.8, 1.8), Point(12.6, 19.8, 1.8), Point(5.4, 19.8, 5.4), Point(-1.8, 19.8, 12.6)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], {0;5}: [Plane(origin=(-1.8, 30.6, 3.6), x=(0, -1, 0), y=(-1, 0, 0)), Plane(origin=(9, 16.2, 0), x=(1, 0, 0), y=(0, -1, 0)), Plane(origin=(5.4, 12.6, 0), x=(-1, 0, 0), y=(0, 1, 0)), Plane(origin=(30.6, 12.6, 0), x=(1, 0, 0), y=(0, -1, 0)), PlaneXZ(23.4, 7.2, 1.8), Plane(origin=(19.8, 16.2, 0), x=(1, 0, 0), y=(0, -1, 0))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], {0;6}: [PlaneXY(6.84, 19.8, 2.52), Plane(origin=(-1.8, 20.52, 7.56), x=(0, 0, -1), y=(-1, 0, 0)), Plane(origin=(4.68, 19.8, 14.04), x=(0, 0, 1), y=(0, 1, 0)), Plane(origin=(-1.8, 29.88, 10.44), x=(0, 0, 1), y=(-1, 0, 0)), Plane(origin=(-1.8, 18.36, 19.08), x=(0, -1, 0), y=(-1, 0, 0)), Plane(origin=(-1.8, 32.04, 20.52), x=(0, 1, 0), y=(-1, 0, 0))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]))
data_49 = Data(Tree({0;0}: ["Component_B-Pos_1-Rot_0"], {0;1}: [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], {0;2}: [Point(1.8, 19.8, 1.8), Point(5.4, 19.8, 1.8), Point(9, 19.8, 1.8), Point(12.6, 19.8, 1.8), Point(5.4, 19.8, 5.4)], {0;3}: [PlaneXZ(5.4, 18, 1.8), Plane(origin=(0, 19.8, 1.8), x=(0, -1, 0), y=(0, 0, 1)), Plane(origin=(5.4, 19.8, 7.2), x=(0, -1, 0), y=(1, 0, 0))], {0;4}: [Point(1.8, 19.8, 1.8), Point(5.4, 19.8, 1.8), Point(9, 19.8, 1.8), Point(12.6, 19.8, 1.8), Point(5.4, 19.8, 5.4), Point(9, 16.2, 1.8)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], {0;5}: [PlaneYZ(10.8, 16.2, 1.8), Plane(origin=(-5.4, 27, 3.6), x=(0, -1, 0), y=(-1, 0, 0)), Plane(origin=(-16.2, 30.6, 3.6), x=(0, -1, 0), y=(-1, 0, 0)), Plane(origin=(-32.4, 30.6, 1.8), x=(0, -1, 0), y=(0, 0, 1)), Plane(origin=(-27, 34.2, 3.6), x=(0, -1, 0), y=(-1, 0, 0)), Plane(origin=(-32.4, 34.2, 9), x=(0, -1, 0), y=(0, 0, 1))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], {0;6}: [PlaneXY(6.84, 19.8, 2.52), Plane(origin=(3.96, 16.2, 2.52), x=(-1, 0, 0), y=(0, -1, 0)), Plane(origin=(-6.84, 19.8, 2.52), x=(-1, 0, 0), y=(0, -1, 0)), PlaneXY(-3.96, 23.4, 2.52), Plane(origin=(-17.64, 23.4, 2.52), x=(-1, 0, 0), y=(0, -1, 0)), PlaneXY(-14.76, 27, 2.52)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]))
data_50 = Data(Tree({0;0}: ["Component_B-Pos_1-Rot_1"], {0;1}: [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], {0;2}: [Point(1.8, 19.8, 1.8), Point(5.4, 19.8, 1.8), Point(9, 19.8, 1.8), Point(12.6, 19.8, 1.8), Point(5.4, 19.8, 5.4)], {0;3}: [Plane(origin=(5.4, 18, 1.8), x=(0, 0, 1), y=(-1, 0, 0)), Plane(origin=(0, 19.8, 1.8), x=(0, -1, 0), y=(0, 0, 1)), Plane(origin=(5.4, 19.8, 7.2), x=(0, -1, 0), y=(1, 0, 0))], {0;4}: [Point(1.8, 19.8, 1.8), Point(5.4, 19.8, 1.8), Point(9, 19.8, 1.8), Point(12.6, 19.8, 1.8), Point(5.4, 19.8, 5.4), Point(-1.8, 19.8, 1.8)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], {0;5}: [Plane(origin=(-5.4, 27, 0), x=(1, 0, 0), y=(0, -1, 0)), Plane(origin=(5.4, 12.6, 7.2), x=(0, 1, 0), y=(1, 0, 0)), Plane(origin=(-5.4, 9, 18), x=(0, 1, 0), y=(-1, 0, 0)), Plane(origin=(5.4, 12.6, 0), x=(0, 1, 0), y=(1, 0, 0)), Plane(origin=(10.8, 12.6, 1.8), x=(0, 0, -1), y=(0, 1, 0)), Plane(origin=(-1.8, 30.6, 3.6), x=(1, 0, 0), y=(0, -1, 0))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], {0;6}: [PlaneXY(6.84, 19.8, 2.52), Plane(origin=(-6.84, 19.8, 2.52), x=(-1, 0, 0), y=(0, -1, 0)), PlaneYZ(-4.68, 28.44, 1.8), Plane(origin=(4.68, 28.44, 1.8), x=(0, 1, 0), y=(0, 0, -1)), PlaneYZ(6.12, 28.44, 5.4), Plane(origin=(3.96, 20.52, 9), x=(-1, 0, 0), y=(0, 0, 1))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]))
data_51 = Data(Tree({0;0}: ["Component_B-Pos_1-Rot_2"], {0;1}: [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], {0;2}: [Point(1.8, 19.8, 1.8), Point(5.4, 19.8, 1.8), Point(9, 19.8, 1.8), Point(12.6, 19.8, 1.8), Point(5.4, 19.8, 5.4)], {0;3}: [Plane(origin=(5.4, 18, 1.8), x=(0, 0, -1), y=(1, 0, 0)), Plane(origin=(0, 19.8, 1.8), x=(0, -1, 0), y=(0, 0, 1)), Plane(origin=(5.4, 19.8, 7.2), x=(0, -1, 0), y=(1, 0, 0))], {0;4}: [Point(1.8, 19.8, 1.8), Point(5.4, 19.8, 1.8), Point(9, 19.8, 1.8), Point(12.6, 19.8, 1.8), Point(5.4, 19.8, 5.4), Point(-1.8, 19.8, 1.8)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], {0;5}: [Plane(origin=(5.4, 18, 1.8), x=(0, 0, -1), y=(1, 0, 0)), Plane(origin=(1.8, 27, 0), x=(-1, 0, 0), y=(0, 1, 0)), PlaneYZ(10.8, 19.8, 12.6), Plane(origin=(0, 23.4, 12.6), x=(0, -1, 0), y=(0, 0, 1)), Plane(origin=(5.4, 30.6, 3.6), x=(0, 1, 0), y=(-1, 0, 0)), Plane(origin=(12.6, 36, 1.8), x=(-1, 0, 0), y=(0, 0, 1))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], {0;6}: [PlaneXY(6.84, 19.8, 2.52), Plane(origin=(-6.84, 19.8, 2.52), x=(-1, 0, 0), y=(0, -1, 0)), Plane(origin=(-6.12, 28.44, 1.8), x=(0, 1, 0), y=(0, 0, -1)), PlaneYZ(-4.68, 28.44, 5.4), Plane(origin=(-12.6, 28.44, 2.52), x=(0, 1, 0), y=(-1, 0, 0)), Plane(origin=(-6.84, 20.52, 9), x=(-1, 0, 0), y=(0, 0, 1))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]))
data_52 = Data(Tree({0;0}: ["Component_B-Pos_2-Rot_0"], {0;1}: [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], {0;2}: [Point(1.8, 19.8, 1.8), Point(5.4, 19.8, 1.8), Point(9, 19.8, 1.8), Point(12.6, 19.8, 1.8), Point(5.4, 19.8, 5.4)], {0;3}: [PlaneXZ(12.6, 18, 1.8), Plane(origin=(0, 19.8, 1.8), x=(0, -1, 0), y=(0, 0, 1)), Plane(origin=(12.6, 19.8, 3.6), x=(0, -1, 0), y=(1, 0, 0))], {0;4}: [Point(1.8, 19.8, 1.8), Point(5.4, 19.8, 1.8), Point(9, 19.8, 1.8), Point(12.6, 19.8, 1.8), Point(5.4, 19.8, 5.4), Point(-1.8, 19.8, 1.8)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], {0;5}: [PlaneXZ(12.6, 18, 1.8), PlaneXZ(-27, 10.8, 1.8), Plane(origin=(-30.6, 36, 12.6), x=(0, 0, 1), y=(1, 0, 0)), Plane(origin=(-39.6, 27, 16.2), x=(0, -1, 0), y=(0, 0, 1)), Plane(origin=(-25.2, 34.2, 19.8), x=(0, -1, 0), y=(0, 0, 1)), Plane(origin=(-25.2, 34.2, 5.4), x=(0, 0, 1), y=(0, 1, 0))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], {0;6}: [PlaneXY(6.84, 19.8, 2.52), Plane(origin=(-6.84, 19.8, 2.52), x=(-1, 0, 0), y=(0, -1, 0)), Plane(origin=(-13.32, 25.56, 5.4), x=(0, -1, 0), y=(0, 0, 1)), PlaneXY(-18.36, 23.4, 2.52), Plane(origin=(-21.24, 19.08, 5.4), x=(-1, 0, 0), y=(0, 0, -1)), Plane(origin=(-27, 17.64, 2.52), x=(0, 1, 0), y=(-1, 0, 0))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]))
data_53 = Data(Tree({0;0}: ["Component_B-Pos_2-Rot_1"], {0;1}: [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], {0;2}: [Point(1.8, 19.8, 1.8), Point(5.4, 19.8, 1.8), Point(9, 19.8, 1.8), Point(12.6, 19.8, 1.8), Point(5.4, 19.8, 5.4)], {0;3}: [PlaneXZ(12.6, 18, 1.8), Plane(origin=(0, 19.8, 1.8), x=(0, -1, 0), y=(0, 0, 1)), Plane(origin=(12.6, 19.8, 3.6), x=(-1, 0, 0), y=(0, -1, 0))], {0;4}: [Point(1.8, 19.8, 1.8), Point(5.4, 19.8, 1.8), Point(9, 19.8, 1.8), Point(12.6, 19.8, 1.8), Point(5.4, 19.8, 5.4), Point(-1.8, 19.8, 1.8)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], {0;5}: [PlaneXZ(12.6, 18, 1.8), Plane(origin=(0, 23.4, 1.8), x=(0, -1, 0), y=(0, 0, 1)), Plane(origin=(-27, 34.2, 3.6), x=(1, 0, 0), y=(0, -1, 0)), Plane(origin=(-1.8, 34.2, 3.6), x=(-1, 0, 0), y=(0, 1, 0)), Plane(origin=(-1.8, 48.6, 3.6), x=(0, -1, 0), y=(-1, 0, 0)), Plane(origin=(-36, 9, 1.8), x=(0, -1, 0), y=(0, 0, 1))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], {0;6}: [PlaneXY(6.84, 19.8, 2.52), Plane(origin=(-6.84, 19.8, 2.52), x=(-1, 0, 0), y=(0, -1, 0)), PlaneXY(-18.36, 23.4, 2.52), Plane(origin=(-6.84, 23.4, 4.68), x=(-1, 0, 0), y=(0, 1, 0)), Plane(origin=(-18.36, 19.8, 4.68), x=(1, 0, 0), y=(0, -1, 0)), Plane(origin=(1.8, 17.64, 4.68), x=(0, 1, 0), y=(1, 0, 0))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]))
data_54 = Data(Tree({0;0}: ["Component_B-Pos_2-Rot_2"], {0;1}: [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], {0;2}: [Point(1.8, 19.8, 1.8), Point(5.4, 19.8, 1.8), Point(9, 19.8, 1.8), Point(12.6, 19.8, 1.8), Point(5.4, 19.8, 5.4)], {0;3}: [Plane(origin=(12.6, 18, 1.8), x=(0, 0, 1), y=(-1, 0, 0)), Plane(origin=(0, 19.8, 1.8), x=(0, -1, 0), y=(0, 0, 1)), Plane(origin=(12.6, 19.8, 3.6), x=(-1, 0, 0), y=(0, -1, 0))], {0;4}: [Point(1.8, 19.8, 1.8), Point(5.4, 19.8, 1.8), Point(9, 19.8, 1.8), Point(12.6, 19.8, 1.8), Point(5.4, 19.8, 5.4), Point(-1.8, 19.8, 1.8)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], {0;5}: [Plane(origin=(12.6, 18, 1.8), x=(0, 0, 1), y=(-1, 0, 0)), Plane(origin=(12.6, 19.8, 3.6), x=(-1, 0, 0), y=(0, -1, 0)), Plane(origin=(-12.6, 34.2, 0), x=(1, 0, 0), y=(0, -1, 0)), Plane(origin=(-10.8, 34.2, 1.8), x=(0, -1, 0), y=(0, 0, -1)), Plane(origin=(-25.2, 34.2, 5.4), x=(0, -1, 0), y=(0, 0, 1)), Plane(origin=(-16.2, 19.8, 0), x=(1, 0, 0), y=(0, -1, 0))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], {0;6}: [PlaneXY(6.84, 19.8, 2.52), Plane(origin=(-6.84, 19.8, 2.52), x=(-1, 0, 0), y=(0, -1, 0)), Plane(origin=(-13.32, 25.56, 5.4), x=(0, -1, 0), y=(0, 0, 1)), PlaneYZ(-11.88, 28.44, 1.8), PlaneXY(-18.36, 34.2, 6.12), PlaneYZ(-11.88, 28.44, 9)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]))

data_55 = Data(Tree({0;0}: ["Component_B-Pos_0-Rot_0"], {0;1}: [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], {0;2}: [Point(1.8, 19.8, 1.8), Point(5.4, 19.8, 1.8), Point(9, 19.8, 1.8), Point(12.6, 19.8, 1.8), Point(5.4, 19.8, 5.4)], {0;3}: [PlaneXZ(12.6, 18, 1.8), Plane(origin=(0, 19.8, 1.8), x=(0, -1, 0), y=(0, 0, 1)), Plane(origin=(5.4, 19.8, 7.2), x=(0, -1, 0), y=(1, 0, 0))], {0;4}: [Point(1.8, 19.8, 1.8), Point(5.4, 19.8, 1.8), Point(9, 19.8, 1.8), Point(12.6, 19.8, 1.8), Point(5.4, 19.8, 5.4), Point(-1.8, 19.8, 1.8)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], {0;5}: [PlaneXZ(12.6, 18, 1.8), Plane(origin=(-9, 12.6, 0), x=(-1, 0, 0), y=(0, 1, 0)), Plane(origin=(-1.8, 30.6, 0), x=(0, -1, 0), y=(-1, 0, 0)), Plane(origin=(12.6, 52.2, 0), x=(1, 0, 0), y=(0, -1, 0)), Plane(origin=(12.6, 41.4, 0), x=(-1, 0, 0), y=(0, 1, 0)), Plane(origin=(5.4, 34.2, 0), x=(0, 1, 0), y=(1, 0, 0))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], {0;6}: [PlaneXY(6.84, 19.8, 2.52), Plane(origin=(-6.84, 19.8, 2.52), x=(-1, 0, 0), y=(0, -1, 0)), Plane(origin=(-12.6, 28.44, 2.52), x=(0, 1, 0), y=(-1, 0, 0)), Plane(origin=(-6.12, 25.56, 9), x=(0, -1, 0), y=(0, 0, 1)), Plane(origin=(-15.48, 25.56, 9), x=(0, -1, 0), y=(0, 0, -1)), PlaneXY(-3.96, 34.2, 2.52)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]))
data_56 = Data(Tree({0;0}: ["Component_B-Pos_0-Rot_1"], {0;1}: [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], {0;2}: [Point(1.8, 19.8, 1.8), Point(5.4, 19.8, 1.8), Point(9, 19.8, 1.8), Point(12.6, 19.8, 1.8), Point(5.4, 19.8, 5.4)], {0;3}: [PlaneXZ(12.6, 18, 1.8), Plane(origin=(0, 19.8, 1.8), x=(0, 0, 1), y=(0, 1, 0)), Plane(origin=(5.4, 19.8, 7.2), x=(0, -1, 0), y=(1, 0, 0))], {0;4}: [Point(1.8, 19.8, 1.8), Point(5.4, 19.8, 1.8), Point(9, 19.8, 1.8), Point(12.6, 19.8, 1.8), Point(5.4, 19.8, 5.4), Point(-5.4, 16.2, 1.8)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], {0;5}: [PlaneXZ(12.6, 18, 1.8), Plane(origin=(-5.4, 27, 0), x=(0, 1, 0), y=(1, 0, 0)), Plane(origin=(7.2, 12.6, 1.8), x=(0, 0, 1), y=(0, -1, 0)), Plane(origin=(-9, 19.8, 0), x=(0, -1, 0), y=(-1, 0, 0)), Plane(origin=(12.6, 45, 0), x=(0, 1, 0), y=(1, 0, 0)), Plane(origin=(9, 52.2, 0), x=(0, -1, 0), y=(-1, 0, 0))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], {0;6}: [PlaneXY(6.84, 19.8, 2.52), PlaneYZ(-4.68, 21.24, 1.8), Plane(origin=(0.36, 12.6, 2.52), x=(-1, 0, 0), y=(0, -1, 0)), Plane(origin=(1.08, 18.36, 9), x=(0, -1, 0), y=(0, 0, 1)), Plane(origin=(-10.44, 19.8, 9.72), x=(-1, 0, 0), y=(0, -1, 0)), PlaneYZ(-15.48, 28.44, 9)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]))
data_57 = Data(Tree({0;0}: ["Component_B-Pos_0-Rot_2"], {0;1}: [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], {0;2}: [Point(1.8, 19.8, 1.8), Point(5.4, 19.8, 1.8), Point(9, 19.8, 1.8), Point(12.6, 19.8, 1.8), Point(5.4, 19.8, 5.4)], {0;3}: [PlaneXZ(12.6, 18, 1.8), Plane(origin=(0, 19.8, 1.8), x=(0, 0, 1), y=(0, 1, 0)), PlaneXY(5.4, 19.8, 7.2)], {0;4}: [Point(1.8, 19.8, 1.8), Point(5.4, 19.8, 1.8), Point(9, 19.8, 1.8), Point(12.6, 19.8, 1.8), Point(5.4, 19.8, 5.4), Point(-1.8, 19.8, 12.6)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], {0;5}: [PlaneXZ(12.6, 18, 1.8), PlaneXY(5.4, 19.8, 7.2), Plane(origin=(-1.8, 19.8, 14.4), x=(0, 1, 0), y=(-1, 0, 0)), Plane(origin=(5.4, 30.6, 10.8), x=(1, 0, 0), y=(0, -1, 0)), Plane(origin=(5.4, 50.4, 16.2), x=(0, 0, -1), y=(-1, 0, 0)), Plane(origin=(25.2, 48.6, 9), x=(0, 0, -1), y=(0, 1, 0))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], {0;6}: [PlaneXY(6.84, 19.8, 2.52), Plane(origin=(-1.8, 20.52, 7.56), x=(0, 0, -1), y=(-1, 0, 0)), Plane(origin=(-1.8, 29.88, 10.44), x=(0, 0, 1), y=(-1, 0, 0)), Plane(origin=(6.84, 30.6, 15.48), x=(1, 0, 0), y=(0, -1, 0)), Plane(origin=(11.88, 39.24, 16.2), x=(0, 1, 0), y=(0, 0, -1)), Plane(origin=(5.4, 43.56, 15.48), x=(0, -1, 0), y=(-1, 0, 0))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]))
data_58 = Data(Tree({0;0}: ["Component_B-Pos_1-Rot_0"], {0;1}: [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], {0;2}: [Point(1.8, 19.8, 1.8), Point(5.4, 19.8, 1.8), Point(9, 19.8, 1.8), Point(12.6, 19.8, 1.8), Point(5.4, 19.8, 5.4)], {0;3}: [PlaneXZ(5.4, 18, 1.8), Plane(origin=(0, 19.8, 1.8), x=(0, -1, 0), y=(0, 0, 1)), Plane(origin=(5.4, 19.8, 7.2), x=(0, -1, 0), y=(1, 0, 0))], {0;4}: [Point(1.8, 19.8, 1.8), Point(5.4, 19.8, 1.8), Point(9, 19.8, 1.8), Point(12.6, 19.8, 1.8), Point(5.4, 19.8, 5.4), Point(-1.8, 19.8, 1.8)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], {0;5}: [Plane(origin=(-16.2, 30.6, 3.6), x=(0, -1, 0), y=(-1, 0, 0)), Plane(origin=(-10.8, 30.6, 12.6), x=(0, 0, -1), y=(0, -1, 0)), PlaneYZ(10.8, 16.2, 1.8), Plane(origin=(10.8, 34.2, 1.8), x=(0, -1, 0), y=(0, 0, 1)), PlaneYZ(0, 37.8, 1.8), Plane(origin=(12.6, 39.6, 12.6), x=(1, 0, 0), y=(0, 0, -1))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], {0;6}: [PlaneXY(6.84, 19.8, 2.52), Plane(origin=(-6.84, 19.8, 2.52), x=(-1, 0, 0), y=(0, -1, 0)), PlaneXY(-3.96, 23.4, 2.52), Plane(origin=(-17.64, 23.4, 2.52), x=(-1, 0, 0), y=(0, -1, 0)), PlaneXY(-14.76, 27, 2.52), Plane(origin=(-16.92, 21.96, 9), x=(0, -1, 0), y=(0, 0, 1))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]))
data_59 = Data(Tree({0;0}: ["Component_B-Pos_1-Rot_1"], {0;1}: [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], {0;2}: [Point(1.8, 19.8, 1.8), Point(5.4, 19.8, 1.8), Point(9, 19.8, 1.8), Point(12.6, 19.8, 1.8), Point(5.4, 19.8, 5.4)], {0;3}: [Plane(origin=(5.4, 18, 1.8), x=(0, 0, 1), y=(-1, 0, 0)), Plane(origin=(0, 19.8, 1.8), x=(0, -1, 0), y=(0, 0, 1)), Plane(origin=(5.4, 19.8, 7.2), x=(0, -1, 0), y=(1, 0, 0))], {0;4}: [Point(1.8, 19.8, 1.8), Point(5.4, 19.8, 1.8), Point(9, 19.8, 1.8), Point(12.6, 19.8, 1.8), Point(5.4, 19.8, 5.4), Point(-1.8, 19.8, 1.8)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], {0;5}: [Plane(origin=(-5.4, 27, 0), x=(0, -1, 0), y=(-1, 0, 0)), Plane(origin=(-16.2, 37.8, 0), x=(0, -1, 0), y=(-1, 0, 0)), Plane(origin=(-23.4, 16.2, 0), x=(-1, 0, 0), y=(0, 1, 0)), Plane(origin=(-12.6, 27, 21.6), x=(0, -1, 0), y=(1, 0, 0)), PlaneXY(-19.8, 27, 21.6), Plane(origin=(-10.8, 9, 9), x=(0, 0, 1), y=(0, 1, 0))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], {0;6}: [PlaneXY(6.84, 19.8, 2.52), Plane(origin=(-6.84, 19.8, 2.52), x=(-1, 0, 0), y=(0, -1, 0)), PlaneXZ(-3.96, 26.28, 1.8), Plane(origin=(-15.48, 25.56, 1.8), x=(0, -1, 0), y=(0, 0, -1)), Plane(origin=(-16.92, 25.56, 5.4), x=(0, -1, 0), y=(0, 0, 1)), PlaneXZ(-3.96, 19.08, 9)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]))
data_60 = Data(Tree({0;0}: ["Component_B-Pos_1-Rot_2"], {0;1}: [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], {0;2}: [Point(1.8, 19.8, 1.8), Point(5.4, 19.8, 1.8), Point(9, 19.8, 1.8), Point(12.6, 19.8, 1.8), Point(5.4, 19.8, 5.4)], {0;3}: [Plane(origin=(5.4, 18, 1.8), x=(0, 0, -1), y=(1, 0, 0)), Plane(origin=(0, 19.8, 1.8), x=(0, -1, 0), y=(0, 0, 1)), Plane(origin=(5.4, 19.8, 7.2), x=(0, -1, 0), y=(1, 0, 0))], {0;4}: [Point(1.8, 19.8, 1.8), Point(5.4, 19.8, 1.8), Point(9, 19.8, 1.8), Point(12.6, 19.8, 1.8), Point(5.4, 19.8, 5.4), Point(-1.8, 19.8, 1.8)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], {0;5}: [Plane(origin=(0, 27, 1.8), x=(0, 0, 1), y=(0, -1, 0)), Plane(origin=(0, 27, 5.4), x=(0, 0, -1), y=(0, 1, 0)), Plane(origin=(-5.4, 34.2, 0), x=(0, -1, 0), y=(-1, 0, 0)), Plane(origin=(5.4, 34.2, 0), x=(0, 1, 0), y=(1, 0, 0)), Plane(origin=(12.6, 41.4, 0), x=(-1, 0, 0), y=(0, 1, 0)), PlaneXZ(-1.8, 36, 1.8)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], {0;6}: [PlaneXY(6.84, 19.8, 2.52), Plane(origin=(-6.84, 19.8, 2.52), x=(-1, 0, 0), y=(0, -1, 0)), Plane(origin=(-6.84, 26.28, 1.8), x=(-1, 0, 0), y=(0, 0, -1)), Plane(origin=(-6.84, 27.72, 5.4), x=(-1, 0, 0), y=(0, 0, 1)), Plane(origin=(-6.84, 20.52, 9), x=(-1, 0, 0), y=(0, 0, 1)), Plane(origin=(-6.84, 29.88, 9), x=(-1, 0, 0), y=(0, 0, -1))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]))
data_61 = Data(Tree({0;0}: ["Component_B-Pos_2-Rot_0"], {0;1}: [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], {0;2}: [Point(1.8, 19.8, 1.8), Point(5.4, 19.8, 1.8), Point(9, 19.8, 1.8), Point(12.6, 19.8, 1.8), Point(5.4, 19.8, 5.4)], {0;3}: [PlaneXZ(12.6, 18, 1.8), Plane(origin=(0, 19.8, 1.8), x=(0, -1, 0), y=(0, 0, 1)), Plane(origin=(12.6, 19.8, 3.6), x=(0, -1, 0), y=(1, 0, 0))], {0;4}: [Point(1.8, 19.8, 1.8), Point(5.4, 19.8, 1.8), Point(9, 19.8, 1.8), Point(12.6, 19.8, 1.8), Point(5.4, 19.8, 5.4), Point(-1.8, 19.8, 1.8)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], {0;5}: [Plane(origin=(12.6, 19.8, 3.6), x=(0, -1, 0), y=(1, 0, 0)), Plane(origin=(0, 55.8, 5.4), x=(0, 0, 1), y=(0, 1, 0)), Plane(origin=(-12.6, 28.8, 9), x=(0, 0, -1), y=(1, 0, 0)), Plane(origin=(3.6, 48.6, 16.2), x=(0, 0, -1), y=(0, -1, 0)), Plane(origin=(27, 57.6, 9), x=(1, 0, 0), y=(0, 0, -1)), Plane(origin=(27, 55.8, 7.2), x=(0, 1, 0), y=(1, 0, 0))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], {0;6}: [PlaneXY(6.84, 19.8, 2.52), Plane(origin=(-6.84, 19.8, 2.52), x=(-1, 0, 0), y=(0, -1, 0)), Plane(origin=(-12.6, 28.44, 2.52), x=(0, 1, 0), y=(-1, 0, 0)), Plane(origin=(-13.32, 19.8, 10.44), x=(0, 0, 1), y=(0, 1, 0)), PlaneXY(-3.96, 34.2, 2.52), Plane(origin=(7.56, 30.6, 2.52), x=(-1, 0, 0), y=(0, -1, 0))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]))
data_62 = Data(Tree({0;0}: ["Component_B-Pos_2-Rot_1"], {0;1}: [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], {0;2}: [Point(1.8, 19.8, 1.8), Point(5.4, 19.8, 1.8), Point(9, 19.8, 1.8), Point(12.6, 19.8, 1.8), Point(5.4, 19.8, 5.4)], {0;3}: [PlaneXZ(12.6, 18, 1.8), Plane(origin=(0, 19.8, 1.8), x=(0, -1, 0), y=(0, 0, 1)), Plane(origin=(12.6, 19.8, 3.6), x=(-1, 0, 0), y=(0, -1, 0))], {0;4}: [Point(1.8, 19.8, 1.8), Point(5.4, 19.8, 1.8), Point(9, 19.8, 1.8), Point(12.6, 19.8, 1.8), Point(5.4, 19.8, 5.4), Point(-1.8, 19.8, 1.8)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], {0;5}: [PlaneXZ(12.6, 18, 1.8), Plane(origin=(12.6, 19.8, 3.6), x=(-1, 0, 0), y=(0, -1, 0)), Plane(origin=(-12.6, 36, 16.2), x=(0, 0, 1), y=(1, 0, 0)), Plane(origin=(1.8, 23.4, 3.6), x=(0, -1, 0), y=(-1, 0, 0)), Plane(origin=(-23.4, 7.2, 5.4), x=(-1, 0, 0), y=(0, 0, -1)), Plane(origin=(-23.4, 9, 3.6), x=(1, 0, 0), y=(0, -1, 0))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], {0;6}: [PlaneXY(6.84, 19.8, 2.52), Plane(origin=(-6.84, 19.8, 2.52), x=(-1, 0, 0), y=(0, -1, 0)), Plane(origin=(-12.6, 28.44, 2.52), x=(0, 1, 0), y=(-1, 0, 0)), Plane(origin=(-18.36, 19.8, 4.68), x=(1, 0, 0), y=(0, -1, 0)), Plane(origin=(-6.84, 23.4, 4.68), x=(-1, 0, 0), y=(0, 1, 0)), PlaneXY(-3.96, 34.2, 2.52)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]))
data_63 = Data(Tree({0;0}: ["Component_B-Pos_2-Rot_2"], {0;1}: [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], {0;2}: [Point(1.8, 19.8, 1.8), Point(5.4, 19.8, 1.8), Point(9, 19.8, 1.8), Point(12.6, 19.8, 1.8), Point(5.4, 19.8, 5.4)], {0;3}: [Plane(origin=(12.6, 18, 1.8), x=(0, 0, 1), y=(-1, 0, 0)), Plane(origin=(0, 19.8, 1.8), x=(0, -1, 0), y=(0, 0, 1)), Plane(origin=(12.6, 19.8, 3.6), x=(-1, 0, 0), y=(0, -1, 0))], {0;4}: [Point(1.8, 19.8, 1.8), Point(5.4, 19.8, 1.8), Point(9, 19.8, 1.8), Point(12.6, 19.8, 1.8), Point(5.4, 19.8, 5.4), Point(-1.8, 19.8, 1.8)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], {0;5}: [Plane(origin=(12.6, 18, 1.8), x=(0, 0, 1), y=(-1, 0, 0)), Plane(origin=(12.6, 19.8, 3.6), x=(-1, 0, 0), y=(0, -1, 0)), Plane(origin=(-12.6, 34.2, 0), x=(1, 0, 0), y=(0, -1, 0)), Plane(origin=(-1.8, 16.2, 7.2), x=(-1, 0, 0), y=(0, -1, 0)), Plane(origin=(-25.2, 34.2, 5.4), x=(0, -1, 0), y=(0, 0, 1)), Plane(origin=(16.2, 61.2, 1.8), x=(0, 0, 1), y=(1, 0, 0))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], {0;6}: [PlaneXY(6.84, 19.8, 2.52), Plane(origin=(-6.84, 19.8, 2.52), x=(-1, 0, 0), y=(0, -1, 0)), PlaneYZ(-11.88, 28.44, 1.8), Plane(origin=(-13.32, 25.56, 5.4), x=(0, -1, 0), y=(0, 0, 1)), Plane(origin=(-21.24, 19.8, 4.68), x=(-1, 0, 0), y=(0, 1, 0)), Plane(origin=(-21.24, 16.2, 6.12), x=(-1, 0, 0), y=(0, -1, 0))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]))

data_64 = Data(Tree({0;0}: ["Component_B-Pos_0-Rot_1"], {0;1}: [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], {0;2}: [Point(1.8, 19.8, 1.8), Point(5.4, 19.8, 1.8), Point(9, 19.8, 1.8), Point(12.6, 19.8, 1.8), Point(5.4, 19.8, 5.4)], {0;3}: [PlaneXZ(12.6, 18, 1.8), Plane(origin=(0, 19.8, 1.8), x=(0, 0, 1), y=(0, 1, 0)), Plane(origin=(5.4, 19.8, 7.2), x=(0, -1, 0), y=(1, 0, 0))], {0;4}: [Point(1.8, 19.8, 1.8), Point(5.4, 19.8, 1.8), Point(9, 19.8, 1.8), Point(12.6, 19.8, 1.8), Point(5.4, 19.8, 5.4), Point(-1.8, 19.8, 12.6)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], {0;5}: [Plane(origin=(3.6, 9, 5.4), x=(0, 0, 1), y=(0, -1, 0)), Plane(origin=(10.8, 12.6, 9), x=(0, 0, -1), y=(0, 1, 0)), Plane(origin=(9, 9, 0), x=(0, 1, 0), y=(1, 0, 0)), Plane(origin=(12.6, 5.4, 0), x=(0, -1, 0), y=(-1, 0, 0)), Plane(origin=(-9, 5.4, 14.4), x=(0, 1, 0), y=(-1, 0, 0)), Plane(origin=(-9, 5.4, 0), x=(0, -1, 0), y=(-1, 0, 0))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], {0;6}: [PlaneXY(6.84, 19.8, 2.52), Plane(origin=(-1.8, 20.52, 7.56), x=(0, 0, -1), y=(-1, 0, 0)), Plane(origin=(-1.8, 29.88, 7.56), x=(0, 0, -1), y=(1, 0, 0)), Plane(origin=(-8.28, 29.16, 1.8), x=(0, -1, 0), y=(0, 0, -1)), PlaneYZ(-8.28, 17.64, 5.4), Plane(origin=(-3.24, 9, 6.12), x=(-1, 0, 0), y=(0, -1, 0))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]))
data_65 = Data(Tree({0;0}: ["Component_B-Pos_0-Rot_0"], {0;1}: [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], {0;2}: [Point(1.8, 19.8, 1.8), Point(5.4, 19.8, 1.8), Point(9, 19.8, 1.8), Point(12.6, 19.8, 1.8), Point(5.4, 19.8, 5.4)], {0;3}: [PlaneXZ(12.6, 18, 1.8), Plane(origin=(0, 19.8, 1.8), x=(0, -1, 0), y=(0, 0, 1)), Plane(origin=(5.4, 19.8, 7.2), x=(0, -1, 0), y=(1, 0, 0))], {0;4}: [Point(1.8, 19.8, 1.8), Point(5.4, 19.8, 1.8), Point(9, 19.8, 1.8), Point(12.6, 19.8, 1.8), Point(5.4, 19.8, 5.4), Point(-1.8, 9, 1.8)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], {0;5}: [Plane(origin=(-1.8, 23.4, 3.6), x=(1, 0, 0), y=(0, -1, 0)), Plane(origin=(-14.4, 23.4, 5.4), x=(0, 0, -1), y=(0, -1, 0)), Plane(origin=(5.4, 32.4, 5.4), x=(0, 0, -1), y=(1, 0, 0)), Plane(origin=(5.4, 34.2, 18), x=(0, -1, 0), y=(1, 0, 0)), PlaneXZ(27, 32.4, 1.8), PlaneYZ(28.8, 48.6, 1.8)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], {0;6}: [PlaneXY(6.84, 19.8, 2.52), Plane(origin=(-1.8, 14.04, 2.52), x=(0, 1, 0), y=(-1, 0, 0)), Plane(origin=(-1.8, 13.32, 14.04), x=(0, 0, 1), y=(1, 0, 0)), PlaneXY(-7.56, 19.8, 13.32), Plane(origin=(-19.08, 19.8, 14.04), x=(0, 0, 1), y=(0, -1, 0)), PlaneXY(-18.36, 19.8, 2.52)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]))
data_66 = Data(Tree({0;0}: ["Component_B-Pos_0-Rot_2"], {0;1}: [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], {0;2}: [Point(1.8, 19.8, 1.8), Point(5.4, 19.8, 1.8), Point(9, 19.8, 1.8), Point(12.6, 19.8, 1.8), Point(5.4, 19.8, 5.4)], {0;3}: [PlaneXZ(12.6, 18, 1.8), Plane(origin=(0, 19.8, 1.8), x=(0, 0, 1), y=(0, 1, 0)), PlaneXY(5.4, 19.8, 7.2)], {0;4}: [Point(1.8, 19.8, 1.8), Point(5.4, 19.8, 1.8), Point(9, 19.8, 1.8), Point(12.6, 19.8, 1.8), Point(5.4, 19.8, 5.4), Point(-1.8, 19.8, 12.6)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], {0;5}: [PlaneXZ(12.6, 18, 1.8), Plane(origin=(-1.8, 30.6, 3.6), x=(0, -1, 0), y=(-1, 0, 0)), Plane(origin=(5.4, 30.6, 10.8), x=(1, 0, 0), y=(0, -1, 0)), Plane(origin=(5.4, 50.4, 16.2), x=(0, 0, -1), y=(-1, 0, 0)), Plane(origin=(14.4, 45, 30.6), x=(0, 0, 1), y=(0, -1, 0)), Plane(origin=(14.4, 27, 23.4), x=(0, -1, 0), y=(0, 0, -1))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], {0;6}: [PlaneXY(6.84, 19.8, 2.52), Plane(origin=(-1.8, 20.52, 7.56), x=(0, 0, -1), y=(-1, 0, 0)), Plane(origin=(-1.8, 29.88, 10.44), x=(0, 0, 1), y=(-1, 0, 0)), Plane(origin=(6.84, 30.6, 15.48), x=(1, 0, 0), y=(0, -1, 0)), Plane(origin=(11.88, 39.24, 16.2), x=(0, 1, 0), y=(0, 0, -1)), Plane(origin=(5.4, 43.56, 15.48), x=(0, -1, 0), y=(-1, 0, 0))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]))
data_67 = Data(Tree({0;0}: ["Component_B-Pos_1-Rot_0"], {0;1}: [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], {0;2}: [Point(1.8, 19.8, 1.8), Point(5.4, 19.8, 1.8), Point(9, 19.8, 1.8), Point(12.6, 19.8, 1.8), Point(5.4, 19.8, 5.4)], {0;3}: [PlaneXZ(5.4, 18, 1.8), Plane(origin=(0, 19.8, 1.8), x=(0, -1, 0), y=(0, 0, 1)), Plane(origin=(5.4, 19.8, 7.2), x=(0, -1, 0), y=(1, 0, 0))], {0;4}: [Point(1.8, 19.8, 1.8), Point(5.4, 19.8, 1.8), Point(9, 19.8, 1.8), Point(12.6, 19.8, 1.8), Point(5.4, 19.8, 5.4), Point(-1.8, 19.8, 1.8)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], {0;5}: [Plane(origin=(0, 19.8, 12.6), x=(0, -1, 0), y=(0, 0, -1)), PlaneXZ(1.8, 25.2, 1.8), PlaneXY(-5.4, 12.6, 18), PlaneYZ(10.8, 16.2, 1.8), Plane(origin=(-1.8, 12.6, 7.2), x=(-1, 0, 0), y=(0, 1, 0)), Plane(origin=(-3.6, 27, 12.6), x=(0, 1, 0), y=(0, 0, -1))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], {0;6}: [PlaneXY(6.84, 19.8, 2.52), Plane(origin=(-6.84, 19.8, 2.52), x=(-1, 0, 0), y=(0, -1, 0)), Plane(origin=(-5.4, 28.44, 2.52), x=(0, 1, 0), y=(-1, 0, 0)), Plane(origin=(-6.84, 27.72, 9), x=(-1, 0, 0), y=(0, 0, 1)), Plane(origin=(-6.84, 19.8, 11.88), x=(-1, 0, 0), y=(0, 1, 0)), PlaneXY(3.24, 27, 2.52)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]))
data_68 = Data(Tree({0;0}: ["Component_B-Pos_1-Rot_1"], {0;1}: [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], {0;2}: [Point(1.8, 19.8, 1.8), Point(5.4, 19.8, 1.8), Point(9, 19.8, 1.8), Point(12.6, 19.8, 1.8), Point(5.4, 19.8, 5.4)], {0;3}: [Plane(origin=(5.4, 18, 1.8), x=(0, 0, 1), y=(-1, 0, 0)), Plane(origin=(0, 19.8, 1.8), x=(0, -1, 0), y=(0, 0, 1)), Plane(origin=(5.4, 19.8, 7.2), x=(0, -1, 0), y=(1, 0, 0))], {0;4}: [Point(1.8, 19.8, 1.8), Point(5.4, 19.8, 1.8), Point(9, 19.8, 1.8), Point(12.6, 19.8, 1.8), Point(5.4, 19.8, 5.4), Point(9, 12.6, 1.8)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], {0;5}: [Plane(origin=(5.4, 12.6, 0), x=(0, 1, 0), y=(1, 0, 0)), Plane(origin=(-5.4, 27, 0), x=(0, -1, 0), y=(-1, 0, 0)), Plane(origin=(-16.2, 16.2, 0), x=(0, 1, 0), y=(1, 0, 0)), Plane(origin=(-10.8, 16.2, 1.8), x=(0, 0, -1), y=(0, 1, 0)), Plane(origin=(-28.8, 19.8, 9), x=(0, 1, 0), y=(0, 0, -1)), Plane(origin=(-28.8, 19.8, 16.2), x=(0, 0, -1), y=(0, -1, 0))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], {0;6}: [PlaneXY(6.84, 19.8, 2.52), Plane(origin=(3.96, 13.32, 1.8), x=(-1, 0, 0), y=(0, 0, 1)), Plane(origin=(-6.84, 19.8, 2.52), x=(-1, 0, 0), y=(0, -1, 0)), PlaneXZ(-3.96, 26.28, 1.8), Plane(origin=(-17.64, 26.28, 1.8), x=(-1, 0, 0), y=(0, 0, -1)), Plane(origin=(-14.76, 27, 8.28), x=(1, 0, 0), y=(0, -1, 0))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]))
data_69 = Data(Tree({0;0}: ["Component_B-Pos_1-Rot_2"], {0;1}: [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], {0;2}: [Point(1.8, 19.8, 1.8), Point(5.4, 19.8, 1.8), Point(9, 19.8, 1.8), Point(12.6, 19.8, 1.8), Point(5.4, 19.8, 5.4)], {0;3}: [Plane(origin=(5.4, 18, 1.8), x=(0, 0, -1), y=(1, 0, 0)), Plane(origin=(0, 19.8, 1.8), x=(0, -1, 0), y=(0, 0, 1)), Plane(origin=(5.4, 19.8, 7.2), x=(0, -1, 0), y=(1, 0, 0))], {0;4}: [Point(1.8, 19.8, 1.8), Point(5.4, 19.8, 1.8), Point(9, 19.8, 1.8), Point(12.6, 19.8, 1.8), Point(5.4, 19.8, 5.4), Point(1.8, 19.8, 9)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], {0;5}: [Plane(origin=(0, 19.8, 9), x=(0, 0, -1), y=(0, -1, 0)), Plane(origin=(0, 19.8, 12.6), x=(0, -1, 0), y=(0, 0, -1)), Plane(origin=(5.4, 12.6, 0), x=(1, 0, 0), y=(0, -1, 0)), Plane(origin=(1.8, 18, 5.4), x=(0, 0, 1), y=(-1, 0, 0)), Plane(origin=(9, 30.6, 0), x=(0, -1, 0), y=(-1, 0, 0)), Plane(origin=(5.4, 25.2, 12.6), x=(-1, 0, 0), y=(0, 0, -1))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], {0;6}: [PlaneXY(6.84, 19.8, 2.52), PlaneXZ(6.84, 19.08, 9), Plane(origin=(-6.84, 19.8, 2.52), x=(-1, 0, 0), y=(0, -1, 0)), Plane(origin=(-6.84, 26.28, 1.8), x=(-1, 0, 0), y=(0, 0, -1)), Plane(origin=(-6.84, 27, 8.28), x=(-1, 0, 0), y=(0, 1, 0)), Plane(origin=(-6.84, 19.8, 11.88), x=(-1, 0, 0), y=(0, 1, 0))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]))
data_70 = Data(Tree({0;0}: ["Component_B-Pos_2-Rot_0"], {0;1}: [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], {0;2}: [Point(1.8, 19.8, 1.8), Point(5.4, 19.8, 1.8), Point(9, 19.8, 1.8), Point(12.6, 19.8, 1.8), Point(5.4, 19.8, 5.4)], {0;3}: [PlaneXZ(12.6, 18, 1.8), Plane(origin=(0, 19.8, 1.8), x=(0, -1, 0), y=(0, 0, 1)), Plane(origin=(12.6, 19.8, 3.6), x=(0, -1, 0), y=(1, 0, 0))], {0;4}: [Point(1.8, 19.8, 1.8), Point(5.4, 19.8, 1.8), Point(9, 19.8, 1.8), Point(12.6, 19.8, 1.8), Point(5.4, 19.8, 5.4), Point(-1.8, 9, 1.8)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], {0;5}: [PlaneXY(-1.8, 19.8, 3.6), PlaneYZ(-10.8, 34.2, 1.8), PlaneXY(-12.6, 34.2, 3.6), Plane(origin=(-16.2, 23.4, 7.2), x=(0, 1, 0), y=(-1, 0, 0)), Plane(origin=(-18, 23.4, 5.4), x=(0, 0, 1), y=(0, 1, 0)), PlaneXY(-5.4, 23.4, 3.6)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], {0;6}: [PlaneXY(6.84, 19.8, 2.52), Plane(origin=(-1.8, 14.04, 2.52), x=(0, 1, 0), y=(-1, 0, 0)), Plane(origin=(-1.8, 0.36, 2.52), x=(0, -1, 0), y=(1, 0, 0)), Plane(origin=(-10.44, -5.4, 2.52), x=(-1, 0, 0), y=(0, -1, 0)), Plane(origin=(-16.2, 3.24, 2.52), x=(0, 1, 0), y=(-1, 0, 0)), Plane(origin=(-12.6, 14.76, 2.52), x=(0, -1, 0), y=(1, 0, 0))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]))
data_71 = Data(Tree({0;0}: ["Component_B-Pos_2-Rot_1"], {0;1}: [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], {0;2}: [Point(1.8, 19.8, 1.8), Point(5.4, 19.8, 1.8), Point(9, 19.8, 1.8), Point(12.6, 19.8, 1.8), Point(5.4, 19.8, 5.4)], {0;3}: [PlaneXZ(12.6, 18, 1.8), Plane(origin=(0, 19.8, 1.8), x=(0, -1, 0), y=(0, 0, 1)), Plane(origin=(12.6, 19.8, 3.6), x=(-1, 0, 0), y=(0, -1, 0))], {0;4}: [Point(1.8, 19.8, 1.8), Point(5.4, 19.8, 1.8), Point(9, 19.8, 1.8), Point(12.6, 19.8, 1.8), Point(5.4, 19.8, 5.4), Point(-1.8, 9, 1.8)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], {0;5}: [Plane(origin=(23.4, 34.2, 0), x=(1, 0, 0), y=(0, -1, 0)), Plane(origin=(-16.2, 45, 0), x=(0, 1, 0), y=(1, 0, 0)), Plane(origin=(-14.4, 45, 1.8), x=(0, -1, 0), y=(0, 0, -1)), Plane(origin=(23.4, 30.6, 0), x=(-1, 0, 0), y=(0, 1, 0)), Plane(origin=(-16.2, 34.2, 14.4), x=(1, 0, 0), y=(0, -1, 0)), Plane(origin=(-1.8, 21.6, 16.2), x=(-1, 0, 0), y=(0, 0, -1))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], {0;6}: [PlaneXY(6.84, 19.8, 2.52), Plane(origin=(-1.8, 14.04, 2.52), x=(0, 1, 0), y=(-1, 0, 0)), Plane(origin=(-1.8, 25.56, 4.68), x=(0, -1, 0), y=(-1, 0, 0)), PlaneXZ(-7.56, 33.48, 5.4), Plane(origin=(3.96, 33.48, 1.8), x=(-1, 0, 0), y=(0, 0, -1)), PlaneXZ(17.64, 33.48, 1.8)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]))
data_72 = Data(Tree({0;0}: ["Component_B-Pos_2-Rot_2"], {0;1}: [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], {0;2}: [Point(1.8, 19.8, 1.8), Point(5.4, 19.8, 1.8), Point(9, 19.8, 1.8), Point(12.6, 19.8, 1.8), Point(5.4, 19.8, 5.4)], {0;3}: [Plane(origin=(12.6, 18, 1.8), x=(0, 0, 1), y=(-1, 0, 0)), Plane(origin=(0, 19.8, 1.8), x=(0, -1, 0), y=(0, 0, 1)), Plane(origin=(12.6, 19.8, 3.6), x=(-1, 0, 0), y=(0, -1, 0))], {0;4}: [Point(1.8, 19.8, 1.8), Point(5.4, 19.8, 1.8), Point(9, 19.8, 1.8), Point(12.6, 19.8, 1.8), Point(5.4, 19.8, 5.4), Point(-1.8, 19.8, 12.6)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], {0;5}: [Plane(origin=(-16.2, 7.2, 1.8), x=(0, 0, 1), y=(-1, 0, 0)), Plane(origin=(-19.8, 32.4, 1.8), x=(0, 0, 1), y=(1, 0, 0)), Plane(origin=(-1.8, 34.2, 0), x=(1, 0, 0), y=(0, -1, 0)), Plane(origin=(-32.4, 19.8, 5.4), x=(0, 1, 0), y=(0, 0, -1)), Plane(origin=(-32.4, 23.4, 5.4), x=(0, -1, 0), y=(0, 0, 1)), Plane(origin=(-1.8, 23.4, 18), x=(-1, 0, 0), y=(0, -1, 0))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], {0;6}: [PlaneXY(6.84, 19.8, 2.52), Plane(origin=(-1.8, 20.52, 7.56), x=(0, 0, -1), y=(-1, 0, 0)), Plane(origin=(-7.56, 19.8, 15.48), x=(1, 0, 0), y=(0, -1, 0)), Plane(origin=(-16.2, 19.08, 10.44), x=(0, 0, 1), y=(-1, 0, 0)), Plane(origin=(-16.92, 14.04, 1.8), x=(0, 1, 0), y=(0, 0, -1)), Plane(origin=(-19.08, 25.56, 1.8), x=(0, -1, 0), y=(0, 0, -1))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]))

data_73 = Data(Tree({0;0}: ["Component_C-Pos_0-Rot_1"], {0;1}: [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], {0;2}: [Point(1.8, 1.8, 1.8), Point(1.8, 5.4, 1.8), Point(5.4, 5.4, 1.8), Point(9, 5.4, 1.8), Point(9, 1.8, 1.8)], {0;3}: [Plane(origin=(1.8, 0, 1.8), x=(-1, 0, 0), y=(0, 0, -1)), Plane(origin=(7.2, 1.8, 1.8), x=(0, 1, 0), y=(0, 0, -1)), PlaneXY(1.8, 5.4, 3.6)], {0;4}: [Point(1.8, 1.8, 1.8), Point(1.8, 5.4, 1.8), Point(5.4, 5.4, 1.8), Point(9, 5.4, 1.8), Point(9, 1.8, 1.8), Point(1.8, 1.8, 5.4)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], {0;5}: [Plane(origin=(7.2, 1.8, 1.8), x=(0, 1, 0), y=(0, 0, -1)), PlaneXZ(1.8, 0, 5.4), PlaneYZ(-3.6, 1.8, 5.4), Plane(origin=(-3.6, -5.4, 5.4), x=(0, 0, 1), y=(0, -1, 0)), PlaneYZ(-3.6, -1.8, 9), PlaneXZ(-9, -3.6, 5.4)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], {0;6}: [PlaneXY(5.4, 3.96, 1.8), Plane(origin=(-1.8, 3.96, 5.4), x=(-1, 0, 0), y=(0, 1, 0)), Plane(origin=(-1.8, -3.96, 1.8), x=(-1, 0, 0), y=(0, -1, 0)), Plane(origin=(-1.8, -5.4, 7.56), x=(-1, 0, 0), y=(0, 0, 1)), Plane(origin=(-1.8, 0.36, 9), x=(-1, 0, 0), y=(0, 1, 0)), PlaneXY(-5.4, 0.36, 1.8)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]))
data_74 = Data(Tree({0;0}: ["Component_C-Pos_0-Rot_0"], {0;1}: [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], {0;2}: [Point(1.8, 1.8, 1.8), Point(1.8, 5.4, 1.8), Point(5.4, 5.4, 1.8), Point(9, 5.4, 1.8), Point(9, 1.8, 1.8)], {0;3}: [Plane(origin=(1.8, 0, 1.8), x=(-1, 0, 0), y=(0, 0, -1)), Plane(origin=(7.2, 1.8, 1.8), x=(0, 0, 1), y=(0, 1, 0)), Plane(origin=(1.8, 5.4, 3.6), x=(0, 1, 0), y=(-1, 0, 0))], {0;4}: [Point(1.8, 1.8, 1.8), Point(1.8, 5.4, 1.8), Point(5.4, 5.4, 1.8), Point(9, 5.4, 1.8), Point(9, 1.8, 1.8), Point(1.8, 5.4, 5.4)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], {0;5}: [Plane(origin=(7.2, 1.8, 1.8), x=(0, 0, 1), y=(0, 1, 0)), PlaneXZ(1.8, 10.8, 5.4), Plane(origin=(-3.6, -1.8, 1.8), x=(0, 0, -1), y=(0, -1, 0)), Plane(origin=(5.4, 10.8, 12.6), x=(-1, 0, 0), y=(0, 0, -1)), PlaneXZ(5.4, 0, 16.2), Plane(origin=(0, 1.8, 16.2), x=(0, 0, -1), y=(0, 1, 0))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], {0;6}: [PlaneXY(5.4, 3.96, 1.8), PlaneYZ(1.8, 9, 7.56), Plane(origin=(0.36, -1.8, 5.4), x=(0, 0, 1), y=(1, 0, 0)), Plane(origin=(5.4, 9, 10.44), x=(0, 1, 0), y=(0, 0, -1)), Plane(origin=(1.8, 3.96, 16.2), x=(-1, 0, 0), y=(0, 1, 0)), Plane(origin=(-5.4, -0.36, 5.4), x=(-1, 0, 0), y=(0, -1, 0))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]))
data_75 = Data(Tree({0;0}: ["Component_C-Pos_0-Rot_1"], {0;1}: [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], {0;2}: [Point(1.8, 1.8, 1.8), Point(1.8, 5.4, 1.8), Point(5.4, 5.4, 1.8), Point(9, 5.4, 1.8), Point(9, 1.8, 1.8)], {0;3}: [Plane(origin=(1.8, 0, 1.8), x=(-1, 0, 0), y=(0, 0, -1)), Plane(origin=(7.2, 1.8, 1.8), x=(0, 1, 0), y=(0, 0, -1)), Plane(origin=(1.8, 5.4, 3.6), x=(0, 1, 0), y=(-1, 0, 0))], {0;4}: [Point(1.8, 1.8, 1.8), Point(1.8, 5.4, 1.8), Point(5.4, 5.4, 1.8), Point(9, 5.4, 1.8), Point(9, 1.8, 1.8), Point(1.8, 5.4, 5.4)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], {0;5}: [Plane(origin=(7.2, 1.8, 1.8), x=(0, 1, 0), y=(0, 0, -1)), Plane(origin=(-3.6, -1.8, 1.8), x=(0, 0, -1), y=(0, -1, 0)), Plane(origin=(-1.8, -1.8, 7.2), x=(1, 0, 0), y=(0, -1, 0)), Plane(origin=(5.4, 5.4, 14.4), x=(1, 0, 0), y=(0, -1, 0)), Plane(origin=(14.4, 9, 9), x=(0, 1, 0), y=(0, 0, -1)), Plane(origin=(9, 18, 12.6), x=(0, 0, 1), y=(-1, 0, 0))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], {0;6}: [PlaneXY(5.4, 3.96, 1.8), PlaneYZ(1.8, 9, 7.56), Plane(origin=(0.36, -1.8, 5.4), x=(0, 0, 1), y=(1, 0, 0)), Plane(origin=(7.56, 5.4, 12.6), x=(0, 0, 1), y=(1, 0, 0)), PlaneXY(12.6, 11.16, 9), PlaneYZ(9, 16.2, 14.76)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]))
data_76 = Data(Tree({0;0}: ["Component_C-Pos_1-Rot_1"], {0;1}: [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], {0;2}: [Point(1.8, 1.8, 1.8), Point(1.8, 5.4, 1.8), Point(5.4, 5.4, 1.8), Point(9, 5.4, 1.8), Point(9, 1.8, 1.8)], {0;3}: [Plane(origin=(1.8, 0, 1.8), x=(0, 0, -1), y=(1, 0, 0)), Plane(origin=(7.2, 1.8, 1.8), x=(0, 0, 1), y=(0, 1, 0)), PlaneXY(5.4, 5.4, 3.6)], {0;4}: [Point(1.8, 1.8, 1.8), Point(1.8, 5.4, 1.8), Point(5.4, 5.4, 1.8), Point(9, 5.4, 1.8), Point(9, 1.8, 1.8), Point(5.4, 5.4, 5.4)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], {0;5}: [Plane(origin=(1.8, 0, 1.8), x=(0, 0, -1), y=(1, 0, 0)), Plane(origin=(7.2, 1.8, 1.8), x=(0, 0, 1), y=(0, 1, 0)), PlaneXZ(5.4, 10.8, 5.4), PlaneXZ(5.4, 7.2, 12.6), Plane(origin=(-5.4, 16.2, 7.2), x=(1, 0, 0), y=(0, -1, 0)), PlaneYZ(-18, 27, 9)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], {0;6}: [PlaneXY(5.4, 3.96, 1.8), PlaneYZ(5.4, 9, 7.56), PlaneXZ(5.4, 9, 11.16), Plane(origin=(0.36, 9, 5.4), x=(0, -1, 0), y=(1, 0, 0)), Plane(origin=(-5.4, 14.04, 5.4), x=(0, 0, 1), y=(0, -1, 0)), Plane(origin=(-5.4, 21.96, 5.4), x=(0, 0, 1), y=(0, 1, 0))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]))
data_77 = Data(Tree({0;0}: ["Component_C-Pos_1-Rot_0"], {0;1}: [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], {0;2}: [Point(1.8, 1.8, 1.8), Point(1.8, 5.4, 1.8), Point(5.4, 5.4, 1.8), Point(9, 5.4, 1.8), Point(9, 1.8, 1.8)], {0;3}: [Plane(origin=(1.8, 0, 1.8), x=(0, 0, -1), y=(1, 0, 0)), Plane(origin=(7.2, 1.8, 1.8), x=(0, 1, 0), y=(0, 0, -1)), PlaneXY(5.4, 5.4, 3.6)], {0;4}: [Point(1.8, 1.8, 1.8), Point(1.8, 5.4, 1.8), Point(5.4, 5.4, 1.8), Point(9, 5.4, 1.8), Point(9, 1.8, 1.8), Point(5.4, 5.4, 5.4)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], {0;5}: [Plane(origin=(7.2, 1.8, 1.8), x=(0, 1, 0), y=(0, 0, -1)), Plane(origin=(9, 9, 14.4), x=(1, 0, 0), y=(0, -1, 0)), Plane(origin=(18, 12.6, 12.6), x=(0, 1, 0), y=(0, 0, -1)), Plane(origin=(16.2, 21.6, 16.2), x=(0, 0, 1), y=(-1, 0, 0)), Plane(origin=(7.2, -1.8, 1.8), x=(0, -1, 0), y=(0, 0, 1)), Plane(origin=(5.4, -5.4, 0), x=(1, 0, 0), y=(0, -1, 0))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], {0;6}: [PlaneXY(5.4, 3.96, 1.8), PlaneYZ(5.4, 9, 7.56), Plane(origin=(11.16, 9, 12.6), x=(0, 0, 1), y=(1, 0, 0)), PlaneXY(16.2, 14.76, 12.6), PlaneYZ(16.2, 19.8, 18.36), Plane(origin=(5.4, -3.96, 1.8), x=(1, 0, 0), y=(0, -1, 0))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]))
data_78 = Data(Tree({0;0}: ["Component_C-Pos_1-Rot_2"], {0;1}: [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], {0;2}: [Point(1.8, 1.8, 1.8), Point(1.8, 5.4, 1.8), Point(5.4, 5.4, 1.8), Point(9, 5.4, 1.8), Point(9, 1.8, 1.8)], {0;3}: [Plane(origin=(1.8, 0, 1.8), x=(-1, 0, 0), y=(0, 0, -1)), Plane(origin=(7.2, 1.8, 1.8), x=(0, 0, 1), y=(0, 1, 0)), PlaneXY(5.4, 5.4, 3.6)], {0;4}: [Point(1.8, 1.8, 1.8), Point(1.8, 5.4, 1.8), Point(5.4, 5.4, 1.8), Point(9, 5.4, 1.8), Point(9, 1.8, 1.8), Point(5.4, 5.4, 5.4)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], {0;5}: [Plane(origin=(7.2, 1.8, 1.8), x=(0, 0, 1), y=(0, 1, 0)), Plane(origin=(10.8, 5.4, 5.4), x=(0, -1, 0), y=(0, 0, 1)), Plane(origin=(3.6, -1.8, 5.4), x=(0, 1, 0), y=(0, 0, -1)), Plane(origin=(-14.4, 9, 5.4), x=(0, -1, 0), y=(0, 0, -1)), Plane(origin=(-18, 5.4, 1.8), x=(0, 0, 1), y=(0, -1, 0)), PlaneYZ(-21.6, 1.8, 5.4)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], {0;6}: [PlaneXY(5.4, 3.96, 1.8), PlaneXZ(9, 5.4, 7.56), Plane(origin=(1.8, -1.8, 3.24), x=(1, 0, 0), y=(0, 0, -1)), Plane(origin=(-1.8, -0.36, 9), x=(1, 0, 0), y=(0, -1, 0)), Plane(origin=(-9, 7.56, 9), x=(-1, 0, 0), y=(0, 1, 0)), Plane(origin=(-12.6, 9, 3.24), x=(-1, 0, 0), y=(0, 0, -1))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]))
data_79 = Data(Tree({0;0}: ["Component_C-Pos_2-Rot_0"], {0;1}: [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], {0;2}: [Point(1.8, 1.8, 1.8), Point(1.8, 5.4, 1.8), Point(5.4, 5.4, 1.8), Point(9, 5.4, 1.8), Point(9, 1.8, 1.8)], {0;3}: [Plane(origin=(5.4, 3.6, 1.8), x=(-1, 0, 0), y=(0, 0, -1)), Plane(origin=(0, 1.8, 1.8), x=(0, -1, 0), y=(0, 0, 1)), Plane(origin=(5.4, 5.4, 3.6), x=(0, 1, 0), y=(-1, 0, 0))], {0;4}: [Point(1.8, 1.8, 1.8), Point(1.8, 5.4, 1.8), Point(5.4, 5.4, 1.8), Point(9, 5.4, 1.8), Point(9, 1.8, 1.8), Point(-1.8, 1.8, 1.8)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], {0;5}: [Plane(origin=(5.4, 3.6, 1.8), x=(-1, 0, 0), y=(0, 0, -1)), Plane(origin=(-5.4, 0, 1.8), x=(1, 0, 0), y=(0, 0, -1)), Plane(origin=(5.4, 7.2, 9), x=(0, 0, -1), y=(1, 0, 0)), PlaneXZ(-1.8, 10.8, 9), Plane(origin=(5.4, 18, 5.4), x=(0, 0, 1), y=(1, 0, 0)), Plane(origin=(1.8, 36, 12.6), x=(0, 0, -1), y=(1, 0, 0))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], {0;6}: [PlaneXY(5.4, 3.96, 1.8), Plane(origin=(-5.4, -0.36, 1.8), x=(-1, 0, 0), y=(0, -1, 0)), Plane(origin=(5.4, 7.56, 9), x=(0, 0, 1), y=(0, 1, 0)), Plane(origin=(-1.8, 11.16, 9), x=(-1, 0, 0), y=(0, 1, 0)), Plane(origin=(-1.8, 14.04, 5.4), x=(-1, 0, 0), y=(0, -1, 0)), Plane(origin=(5.4, 17.64, 5.4), x=(0, 0, -1), y=(0, -1, 0))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]))
data_80 = Data(Tree({0;0}: ["Component_C-Pos_2-Rot_1"], {0;1}: [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], {0;2}: [Point(1.8, 1.8, 1.8), Point(1.8, 5.4, 1.8), Point(5.4, 5.4, 1.8), Point(9, 5.4, 1.8), Point(9, 1.8, 1.8)], {0;3}: [Plane(origin=(5.4, 3.6, 1.8), x=(0, 0, 1), y=(-1, 0, 0)), Plane(origin=(0, 1.8, 1.8), x=(0, -1, 0), y=(0, 0, 1)), Plane(origin=(5.4, 5.4, 3.6), x=(-1, 0, 0), y=(0, -1, 0))], {0;4}: [Point(1.8, 1.8, 1.8), Point(1.8, 5.4, 1.8), Point(5.4, 5.4, 1.8), Point(9, 5.4, 1.8), Point(9, 1.8, 1.8), Point(-1.8, 1.8, 1.8)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], {0;5}: [Plane(origin=(5.4, 3.6, 1.8), x=(0, 0, 1), y=(-1, 0, 0)), Plane(origin=(-5.4, 5.4, 3.6), x=(1, 0, 0), y=(0, -1, 0)), Plane(origin=(-9, 1.8, 7.2), x=(1, 0, 0), y=(0, -1, 0)), Plane(origin=(-3.6, 5.4, 12.6), x=(0, -1, 0), y=(0, 0, -1)), Plane(origin=(-5.4, 3.6, 12.6), x=(0, 0, -1), y=(1, 0, 0)), Plane(origin=(5.4, 16.2, 3.6), x=(-1, 0, 0), y=(0, -1, 0))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], {0;6}: [PlaneXY(5.4, 3.96, 1.8), Plane(origin=(-5.4, -0.36, 1.8), x=(-1, 0, 0), y=(0, -1, 0)), PlaneYZ(-5.4, 5.4, 3.96), Plane(origin=(3.24, 5.4, 9), x=(0, 0, 1), y=(-1, 0, 0)), Plane(origin=(-3.24, -1.8, 9), x=(0, 0, 1), y=(1, 0, 0)), Plane(origin=(-9, 0.36, 9), x=(-1, 0, 0), y=(0, 1, 0))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]))
data_81 = Data(Tree({0;0}: ["Component_C-Pos_2-Rot_1"], {0;1}: [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], {0;2}: [Point(1.8, 1.8, 1.8), Point(1.8, 5.4, 1.8), Point(5.4, 5.4, 1.8), Point(9, 5.4, 1.8), Point(9, 1.8, 1.8)], {0;3}: [Plane(origin=(5.4, 3.6, 1.8), x=(0, 0, 1), y=(-1, 0, 0)), Plane(origin=(0, 1.8, 1.8), x=(0, 0, -1), y=(0, -1, 0)), Plane(origin=(5.4, 5.4, 3.6), x=(-1, 0, 0), y=(0, -1, 0))], {0;4}: [Point(1.8, 1.8, 1.8), Point(1.8, 5.4, 1.8), Point(5.4, 5.4, 1.8), Point(9, 5.4, 1.8), Point(9, 1.8, 1.8), Point(-1.8, 1.8, 1.8)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], {0;5}: [Plane(origin=(5.4, 3.6, 1.8), x=(0, 0, 1), y=(-1, 0, 0)), Plane(origin=(-5.4, 3.6, 1.8), x=(0, 0, -1), y=(1, 0, 0)), Plane(origin=(-5.4, 5.4, 0), x=(1, 0, 0), y=(0, -1, 0)), Plane(origin=(5.4, 7.2, 9), x=(-1, 0, 0), y=(0, 0, -1)), PlaneXZ(-9, 10.8, 1.8), Plane(origin=(-1.8, 5.4, 10.8), x=(0, 1, 0), y=(-1, 0, 0))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], {0;6}: [PlaneXY(5.4, 3.96, 1.8), Plane(origin=(-5.4, 3.96, 1.8), x=(-1, 0, 0), y=(0, 1, 0)), Plane(origin=(5.4, 7.56, 9), x=(0, 0, 1), y=(0, 1, 0)), Plane(origin=(-1.8, 11.16, 9), x=(-1, 0, 0), y=(0, 1, 0)), Plane(origin=(-1.8, 12.6, 6.84), x=(0, 1, 0), y=(0, 0, -1)), Plane(origin=(-9, 12.6, 3.24), x=(-1, 0, 0), y=(0, 0, -1))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]))

data_82 = Data(Tree({0;0}: ["Component_C-Pos_0-Rot_0"], {0;1}: [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], {0;2}: [Point(1.8, 1.8, 1.8), Point(1.8, 5.4, 1.8), Point(5.4, 5.4, 1.8), Point(9, 5.4, 1.8), Point(9, 1.8, 1.8)], {0;3}: [Plane(origin=(1.8, 0, 1.8), x=(-1, 0, 0), y=(0, 0, -1)), Plane(origin=(7.2, 1.8, 1.8), x=(0, 0, 1), y=(0, 1, 0)), Plane(origin=(1.8, 5.4, 3.6), x=(0, 1, 0), y=(-1, 0, 0))], {0;4}: [Point(1.8, 1.8, 1.8), Point(1.8, 5.4, 1.8), Point(5.4, 5.4, 1.8), Point(9, 5.4, 1.8), Point(9, 1.8, 1.8), Point(1.8, 9, 5.4)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], {0;5}: [Plane(origin=(1.8, 0, 1.8), x=(-1, 0, 0), y=(0, 0, -1)), Plane(origin=(7.2, 1.8, 1.8), x=(0, 0, 1), y=(0, 1, 0)), Plane(origin=(5.4, 9, 0), x=(0, -1, 0), y=(-1, 0, 0)), PlaneXZ(5.4, 14.4, 1.8), Plane(origin=(-1.8, 12.6, 0), x=(0, 1, 0), y=(1, 0, 0)), Plane(origin=(-1.8, 7.2, 1.8), x=(-1, 0, 0), y=(0, 0, 1))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], {0;6}: [PlaneXY(5.4, 3.96, 1.8), Plane(origin=(5.4, 6.84, 5.4), x=(1, 0, 0), y=(0, -1, 0)), PlaneYZ(5.4, 12.6, 3.96), Plane(origin=(-1.8, 14.76, 5.4), x=(-1, 0, 0), y=(0, 1, 0)), Plane(origin=(-1.8, 9, 3.96), x=(0, -1, 0), y=(0, 0, 1)), Plane(origin=(-1.8, 17.64, 1.8), x=(-1, 0, 0), y=(0, -1, 0))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]))
data_83 = Data(Tree({0;0}: ["Component_C-Pos_0-Rot_1"], {0;1}: [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], {0;2}: [Point(1.8, 1.8, 1.8), Point(1.8, 5.4, 1.8), Point(5.4, 5.4, 1.8), Point(9, 5.4, 1.8), Point(9, 1.8, 1.8)], {0;3}: [Plane(origin=(1.8, 0, 1.8), x=(-1, 0, 0), y=(0, 0, -1)), Plane(origin=(7.2, 1.8, 1.8), x=(0, 1, 0), y=(0, 0, -1)), Plane(origin=(1.8, 5.4, 3.6), x=(0, 1, 0), y=(-1, 0, 0))], {0;4}: [Point(1.8, 1.8, 1.8), Point(1.8, 5.4, 1.8), Point(5.4, 5.4, 1.8), Point(9, 5.4, 1.8), Point(9, 1.8, 1.8), Point(1.8, 9, 5.4)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], {0;5}: [Plane(origin=(1.8, 0, 1.8), x=(-1, 0, 0), y=(0, 0, -1)), Plane(origin=(7.2, 1.8, 1.8), x=(0, 1, 0), y=(0, 0, -1)), PlaneXZ(12.6, 7.2, 5.4), Plane(origin=(12.6, 12.6, 3.6), x=(0, 1, 0), y=(1, 0, 0)), Plane(origin=(-9, 3.6, 1.8), x=(-1, 0, 0), y=(0, 0, -1)), Plane(origin=(-3.6, 5.4, 1.8), x=(0, 1, 0), y=(0, 0, -1))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], {0;6}: [PlaneXY(5.4, 3.96, 1.8), Plane(origin=(5.4, 6.84, 5.4), x=(1, 0, 0), y=(0, -1, 0)), Plane(origin=(9, 11.16, 5.4), x=(-1, 0, 0), y=(0, 1, 0)), Plane(origin=(-1.8, 14.76, 5.4), x=(-1, 0, 0), y=(0, 1, 0)), Plane(origin=(-5.4, 10.44, 5.4), x=(1, 0, 0), y=(0, -1, 0)), PlaneXY(-5.4, 7.56, 1.8)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]))
data_84 = Data(Tree({0;0}: ["Component_C-Pos_0-Rot_1"], {0;1}: [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], {0;2}: [Point(1.8, 1.8, 1.8), Point(1.8, 5.4, 1.8), Point(5.4, 5.4, 1.8), Point(9, 5.4, 1.8), Point(9, 1.8, 1.8)], {0;3}: [Plane(origin=(1.8, 0, 1.8), x=(-1, 0, 0), y=(0, 0, -1)), Plane(origin=(7.2, 1.8, 1.8), x=(0, 1, 0), y=(0, 0, -1)), PlaneXY(1.8, 5.4, 3.6)], {0;4}: [Point(1.8, 1.8, 1.8), Point(1.8, 5.4, 1.8), Point(5.4, 5.4, 1.8), Point(9, 5.4, 1.8), Point(9, 1.8, 1.8), Point(1.8, 1.8, 5.4)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], {0;5}: [Plane(origin=(-9, 3.6, 5.4), x=(-1, 0, 0), y=(0, 0, 1)), Plane(origin=(12.6, 3.6, 1.8), x=(1, 0, 0), y=(0, 0, -1)), Plane(origin=(-3.6, -1.8, 1.8), x=(0, -1, 0), y=(0, 0, -1)), Plane(origin=(-5.4, -3.6, 9), x=(0, 0, -1), y=(1, 0, 0)), Plane(origin=(-1.8, -1.8, 18), x=(-1, 0, 0), y=(0, 1, 0)), Plane(origin=(3.6, 1.8, 16.2), x=(0, 0, 1), y=(0, 1, 0))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], {0;6}: [PlaneXY(5.4, 3.96, 1.8), Plane(origin=(-1.8, 3.96, 5.4), x=(-1, 0, 0), y=(0, 1, 0)), Plane(origin=(-5.4, -0.36, 5.4), x=(1, 0, 0), y=(0, -1, 0)), Plane(origin=(9, -0.36, 1.8), x=(-1, 0, 0), y=(0, -1, 0)), Plane(origin=(-11.16, -1.8, 5.4), x=(0, 0, -1), y=(-1, 0, 0)), Plane(origin=(-1.8, -3.96, 1.8), x=(-1, 0, 0), y=(0, -1, 0))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]))
data_85 = Data(Tree({0;0}: ["Component_C-Pos_1-Rot_0"], {0;1}: [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], {0;2}: [Point(1.8, 1.8, 1.8), Point(1.8, 5.4, 1.8), Point(5.4, 5.4, 1.8), Point(9, 5.4, 1.8), Point(9, 1.8, 1.8)], {0;3}: [Plane(origin=(1.8, 0, 1.8), x=(0, 0, -1), y=(1, 0, 0)), Plane(origin=(7.2, 1.8, 1.8), x=(0, 1, 0), y=(0, 0, -1)), PlaneXY(5.4, 5.4, 3.6)], {0;4}: [Point(1.8, 1.8, 1.8), Point(1.8, 5.4, 1.8), Point(5.4, 5.4, 1.8), Point(9, 5.4, 1.8), Point(9, 1.8, 1.8), Point(9, 1.8, 5.4)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], {0;5}: [PlaneXY(-5.4, 5.4, 3.6), Plane(origin=(-9, 5.4, 3.6), x=(-1, 0, 0), y=(0, -1, 0)), Plane(origin=(-9, 9, 7.2), x=(-1, 0, 0), y=(0, 1, 0)), Plane(origin=(-5.4, 9, 7.2), x=(1, 0, 0), y=(0, -1, 0)), PlaneXY(-5.4, 12.6, 3.6), Plane(origin=(-9, 12.6, 3.6), x=(-1, 0, 0), y=(0, -1, 0))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], {0;6}: [PlaneXY(5.4, 3.96, 1.8), Plane(origin=(5.4, 3.96, 5.4), x=(-1, 0, 0), y=(0, 1, 0)), Plane(origin=(1.8, -0.36, 5.4), x=(1, 0, 0), y=(0, -1, 0)), Plane(origin=(1.8, -0.36, 1.8), x=(-1, 0, 0), y=(0, -1, 0)), Plane(origin=(-3.24, 5.4, 5.4), x=(0, 0, -1), y=(1, 0, 0)), Plane(origin=(-11.16, 5.4, 5.4), x=(0, 0, -1), y=(-1, 0, 0))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]))
data_86 = Data(Tree({0;0}: ["Component_C-Pos_1-Rot_1"], {0;1}: [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], {0;2}: [Point(1.8, 1.8, 1.8), Point(1.8, 5.4, 1.8), Point(5.4, 5.4, 1.8), Point(9, 5.4, 1.8), Point(9, 1.8, 1.8)], {0;3}: [Plane(origin=(1.8, 0, 1.8), x=(0, 0, -1), y=(1, 0, 0)), Plane(origin=(7.2, 1.8, 1.8), x=(0, 0, 1), y=(0, 1, 0)), PlaneXY(5.4, 5.4, 3.6)], {0;4}: [Point(1.8, 1.8, 1.8), Point(1.8, 5.4, 1.8), Point(5.4, 5.4, 1.8), Point(9, 5.4, 1.8), Point(9, 1.8, 1.8), Point(9, 1.8, 5.4)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], {0;5}: [Plane(origin=(7.2, -5.4, 5.4), x=(0, 0, 1), y=(0, 1, 0)), Plane(origin=(5.4, -5.4, 0), x=(1, 0, 0), y=(0, -1, 0)), Plane(origin=(-9, 63, 3.6), x=(-1, 0, 0), y=(0, -1, 0)), Plane(origin=(34.2, 63, 3.6), x=(0, 1, 0), y=(-1, 0, 0)), Plane(origin=(-9, -9, 3.6), x=(0, -1, 0), y=(1, 0, 0)), Plane(origin=(37.8, 63, 3.6), x=(0, -1, 0), y=(1, 0, 0))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], {0;6}: [PlaneXY(5.4, 3.96, 1.8), Plane(origin=(5.4, 3.96, 5.4), x=(-1, 0, 0), y=(0, 1, 0)), Plane(origin=(5.4, 0.36, 5.4), x=(0, 0, 1), y=(0, 1, 0)), PlaneXY(5.4, -3.24, 5.4), Plane(origin=(5.4, -3.96, 1.8), x=(1, 0, 0), y=(0, -1, 0)), Plane(origin=(0.36, -9, 5.4), x=(0, 0, 1), y=(1, 0, 0))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]))
data_87 = Data(Tree({0;0}: ["Component_C-Pos_1-Rot_2"], {0;1}: [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], {0;2}: [Point(1.8, 1.8, 1.8), Point(1.8, 5.4, 1.8), Point(5.4, 5.4, 1.8), Point(9, 5.4, 1.8), Point(9, 1.8, 1.8)], {0;3}: [Plane(origin=(1.8, 0, 1.8), x=(-1, 0, 0), y=(0, 0, -1)), Plane(origin=(7.2, 1.8, 1.8), x=(0, 0, 1), y=(0, 1, 0)), PlaneXY(5.4, 5.4, 3.6)], {0;4}: [Point(1.8, 1.8, 1.8), Point(1.8, 5.4, 1.8), Point(5.4, 5.4, 1.8), Point(9, 5.4, 1.8), Point(9, 1.8, 1.8), Point(9, 1.8, 5.4)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], {0;5}: [Plane(origin=(-3.6, -1.8, 1.8), x=(0, 0, 1), y=(0, -1, 0)), PlaneYZ(-7.2, -5.4, 5.4), Plane(origin=(-9, -1.8, 3.6), x=(-1, 0, 0), y=(0, 1, 0)), Plane(origin=(-3.6, -1.8, 5.4), x=(0, -1, 0), y=(0, 0, 1)), PlaneXZ(9, -345.6, 5.4), Plane(origin=(5.4, -349.2, 1.8), x=(0, 0, -1), y=(1, 0, 0)), Plane(origin=(5.4, -347.4, 7.2), x=(-1, 0, 0), y=(0, 1, 0))], {0;6}: [PlaneXY(5.4, 3.96, 1.8), Plane(origin=(5.4, 3.96, 5.4), x=(-1, 0, 0), y=(0, 1, 0)), Plane(origin=(5.4, 0.36, 5.4), x=(0, 0, 1), y=(0, 1, 0)), PlaneXY(5.4, -3.24, 5.4), Plane(origin=(-1.8, -3.96, 1.8), x=(-1, 0, 0), y=(0, -1, 0)), Plane(origin=(-5.4, -5.4, 7.56), x=(-1, 0, 0), y=(0, 0, 1))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]))
data_88 = Data(Tree({0;0}: ["Component_C-Pos_2-Rot_0"], {0;1}: [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], {0;2}: [Point(1.8, 1.8, 1.8), Point(1.8, 5.4, 1.8), Point(5.4, 5.4, 1.8), Point(9, 5.4, 1.8), Point(9, 1.8, 1.8)], {0;3}: [Plane(origin=(5.4, 3.6, 1.8), x=(-1, 0, 0), y=(0, 0, -1)), Plane(origin=(0, 1.8, 1.8), x=(0, -1, 0), y=(0, 0, 1)), Plane(origin=(5.4, 5.4, 3.6), x=(0, 1, 0), y=(-1, 0, 0))], {0;4}: [Point(1.8, 1.8, 1.8), Point(1.8, 5.4, 1.8), Point(5.4, 5.4, 1.8), Point(9, 5.4, 1.8), Point(9, 1.8, 1.8), Point(1.8, 9, 5.4)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], {0;5}: [Plane(origin=(5.4, 3.6, 1.8), x=(-1, 0, 0), y=(0, 0, -1)), Plane(origin=(-1.8, 12.6, 0), x=(0, 1, 0), y=(1, 0, 0)), Plane(origin=(-7.2, 12.6, 1.8), x=(0, 0, -1), y=(0, -1, 0)), Plane(origin=(0, 9, 12.6), x=(0, -1, 0), y=(0, 0, 1)), Plane(origin=(-1.8, 3.6, 12.6), x=(-1, 0, 0), y=(0, 0, -1)), Plane(origin=(-5.4, 3.6, 1.8), x=(0, 0, -1), y=(-1, 0, 0)), Plane(origin=(-5.4, 10.8, 12.6), x=(1, 0, 0), y=(0, 0, -1)), Plane(origin=(-16.2, 3.6, 9), x=(0, 0, -1), y=(-1, 0, 0)), Plane(origin=(-16.2, 7.2, 1.8), x=(1, 0, 0), y=(0, 0, -1)), PlaneYZ(-10.8, 9, 1.8)], {0;6}: [PlaneXY(5.4, 3.96, 1.8), Plane(origin=(5.4, 6.84, 5.4), x=(1, 0, 0), y=(0, -1, 0)), Plane(origin=(3.96, 9, 5.4), x=(0, 0, -1), y=(1, 0, 0)), Plane(origin=(-1.8, 10.44, 5.4), x=(0, 0, 1), y=(0, -1, 0)), PlaneXZ(-1.8, 12.6, 3.96), Plane(origin=(0.36, 9, 12.6), x=(0, 1, 0), y=(1, 0, 0))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]))
data_89 = Data(Tree({0;0}: ["Component_C-Pos_2-Rot_1"], {0;1}: [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], {0;2}: [Point(1.8, 1.8, 1.8), Point(1.8, 5.4, 1.8), Point(5.4, 5.4, 1.8), Point(9, 5.4, 1.8), Point(9, 1.8, 1.8)], {0;3}: [Plane(origin=(5.4, 3.6, 1.8), x=(0, 0, 1), y=(-1, 0, 0)), Plane(origin=(0, 1.8, 1.8), x=(0, -1, 0), y=(0, 0, 1)), Plane(origin=(5.4, 5.4, 3.6), x=(-1, 0, 0), y=(0, -1, 0))], {0;4}: [Point(1.8, 1.8, 1.8), Point(1.8, 5.4, 1.8), Point(5.4, 5.4, 1.8), Point(9, 5.4, 1.8), Point(9, 1.8, 1.8), Point(5.4, 1.8, 1.8)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], {0;5}: [Plane(origin=(5.4, 0, 1.8), x=(0, 0, -1), y=(1, 0, 0)), Plane(origin=(-5.4, 5.4, 0), x=(1, 0, 0), y=(0, -1, 0)), Plane(origin=(0, 9, 5.4), x=(0, -1, 0), y=(0, 0, -1)), Plane(origin=(1.8, 9, 0), x=(1, 0, 0), y=(0, -1, 0)), Plane(origin=(-5.4, 3.6, 12.6), x=(0, 0, -1), y=(-1, 0, 0)), Plane(origin=(-12.6, 5.4, 10.8), x=(1, 0, 0), y=(0, -1, 0))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], {0;6}: [PlaneXY(5.4, 3.96, 1.8), PlaneYZ(5.4, 5.4, 3.96), Plane(origin=(-1.8, 1.8, 3.24), x=(0, -1, 0), y=(0, 0, -1)), Plane(origin=(-1.8, 3.24, 5.4), x=(1, 0, 0), y=(0, -1, 0)), Plane(origin=(-7.56, 5.4, 5.4), x=(0, 0, 1), y=(-1, 0, 0)), Plane(origin=(-7.56, 1.8, 5.4), x=(0, 0, -1), y=(-1, 0, 0))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]))
data_90 = Data(Tree({0;0}: ["Component_C-Pos_2-Rot_1"], {0;1}: [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], {0;2}: [Point(1.8, 1.8, 1.8), Point(1.8, 5.4, 1.8), Point(5.4, 5.4, 1.8), Point(9, 5.4, 1.8), Point(9, 1.8, 1.8)], {0;3}: [Plane(origin=(5.4, 3.6, 1.8), x=(0, 0, 1), y=(-1, 0, 0)), Plane(origin=(0, 1.8, 1.8), x=(0, 0, -1), y=(0, -1, 0)), Plane(origin=(5.4, 5.4, 3.6), x=(-1, 0, 0), y=(0, -1, 0))], {0;4}: [Point(1.8, 1.8, 1.8), Point(1.8, 5.4, 1.8), Point(5.4, 5.4, 1.8), Point(9, 5.4, 1.8), Point(9, 1.8, 1.8), Point(-1.8, 1.8, 1.8)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], {0;5}: [Plane(origin=(-5.4, 3.6, 1.8), x=(0, 0, -1), y=(1, 0, 0)), Plane(origin=(-5.4, 5.4, 0), x=(1, 0, 0), y=(0, -1, 0)), Plane(origin=(12.6, 3.6, 9), x=(-1, 0, 0), y=(0, 0, -1)), Plane(origin=(12.6, 16.2, 3.6), x=(0, -1, 0), y=(-1, 0, 0)), Plane(origin=(9, 14.4, 16.2), x=(-1, 0, 0), y=(0, 0, -1)), PlaneXZ(5.4, 14.4, 16.2)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], {0;6}: [PlaneXY(5.4, 3.96, 1.8), Plane(origin=(-5.4, 3.96, 1.8), x=(-1, 0, 0), y=(0, 1, 0)), PlaneYZ(5.4, 5.4, 3.96), PlaneXZ(12.6, 5.4, 7.56), Plane(origin=(11.16, 5.4, 5.4), x=(0, -1, 0), y=(1, 0, 0)), Plane(origin=(11.16, 16.2, 5.4), x=(0, 1, 0), y=(1, 0, 0))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]))

data_91 = Data(Tree({0;0}: ["Component_C-Pos_0-Rot_0"], {0;1}: [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], {0;2}: [Point(1.8, 1.8, 1.8), Point(1.8, 5.4, 1.8), Point(5.4, 5.4, 1.8), Point(9, 5.4, 1.8), Point(9, 1.8, 1.8)], {0;3}: [Plane(origin=(1.8, 0, 1.8), x=(-1, 0, 0), y=(0, 0, -1)), Plane(origin=(7.2, 1.8, 1.8), x=(0, 0, 1), y=(0, 1, 0)), Plane(origin=(1.8, 5.4, 3.6), x=(0, 1, 0), y=(-1, 0, 0))], {0;4}: [Point(1.8, 1.8, 1.8), Point(1.8, 5.4, 1.8), Point(5.4, 5.4, 1.8), Point(9, 5.4, 1.8), Point(9, 1.8, 1.8), Point(1.8, 5.4, 5.4)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], {0;5}: [Plane(origin=(1.8, 0, 1.8), x=(-1, 0, 0), y=(0, 0, -1)), Plane(origin=(7.2, 1.8, 1.8), x=(0, 0, 1), y=(0, 1, 0)), PlaneXZ(1.8, 10.8, 5.4), Plane(origin=(5.4, 5.4, 14.4), x=(0, -1, 0), y=(1, 0, 0)), PlaneXZ(-1.8, 14.4, 9), Plane(origin=(-1.8, 3.6, 5.4), x=(1, 0, 0), y=(0, 0, -1))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], {0;6}: [PlaneXY(5.4, 3.96, 1.8), PlaneYZ(1.8, 9, 7.56), Plane(origin=(5.4, 9, 10.44), x=(0, 1, 0), y=(0, 0, -1)), Plane(origin=(3.96, 9, 16.2), x=(0, 0, 1), y=(1, 0, 0)), PlaneYZ(-1.8, 12.6, 11.16), Plane(origin=(-1.8, 5.4, 3.24), x=(0, -1, 0), y=(0, 0, -1))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]))
data_92 = Data(Tree({0;0}: ["Component_C-Pos_0-Rot_1"], {0;1}: [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], {0;2}: [Point(1.8, 1.8, 1.8), Point(1.8, 5.4, 1.8), Point(5.4, 5.4, 1.8), Point(9, 5.4, 1.8), Point(9, 1.8, 1.8)], {0;3}: [Plane(origin=(1.8, 0, 1.8), x=(-1, 0, 0), y=(0, 0, -1)), Plane(origin=(7.2, 1.8, 1.8), x=(0, 1, 0), y=(0, 0, -1)), Plane(origin=(1.8, 5.4, 3.6), x=(0, 1, 0), y=(-1, 0, 0))], {0;4}: [Point(1.8, 1.8, 1.8), Point(1.8, 5.4, 1.8), Point(5.4, 5.4, 1.8), Point(9, 5.4, 1.8), Point(9, 1.8, 1.8), Point(1.8, 5.4, 5.4)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], {0;5}: [Plane(origin=(1.8, 0, 1.8), x=(-1, 0, 0), y=(0, 0, -1)), Plane(origin=(7.2, 1.8, 1.8), x=(0, 1, 0), y=(0, 0, -1)), Plane(origin=(3.6, 5.4, 9), x=(0, 0, 1), y=(0, -1, 0)), Plane(origin=(3.6, 16.2, 1.8), x=(0, 0, -1), y=(0, 1, 0)), Plane(origin=(3.6, 16.2, 12.6), x=(0, 0, 1), y=(0, -1, 0)), Plane(origin=(5.4, 27, 0), x=(0, 1, 0), y=(1, 0, 0))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], {0;6}: [PlaneXY(5.4, 3.96, 1.8), PlaneYZ(1.8, 9, 7.56), Plane(origin=(1.8, 12.6, 3.24), x=(0, -1, 0), y=(0, 0, -1)), PlaneYZ(1.8, 19.8, 11.16), Plane(origin=(1.8, 23.4, 6.84), x=(0, -1, 0), y=(0, 0, -1)), Plane(origin=(5.4, 23.4, 3.96), x=(0, -1, 0), y=(0, 0, 1))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]))
data_93 = Data(Tree({0;0}: ["Component_C-Pos_0-Rot_1"], {0;1}: [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], {0;2}: [Point(1.8, 1.8, 1.8), Point(1.8, 5.4, 1.8), Point(5.4, 5.4, 1.8), Point(9, 5.4, 1.8), Point(9, 1.8, 1.8)], {0;3}: [Plane(origin=(1.8, 0, 1.8), x=(-1, 0, 0), y=(0, 0, -1)), Plane(origin=(7.2, 1.8, 1.8), x=(0, 1, 0), y=(0, 0, -1)), PlaneXY(1.8, 5.4, 3.6)], {0;4}: [Point(1.8, 1.8, 1.8), Point(1.8, 5.4, 1.8), Point(5.4, 5.4, 1.8), Point(9, 5.4, 1.8), Point(9, 1.8, 1.8), Point(1.8, 1.8, 5.4)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], {0;5}: [Plane(origin=(1.8, 0, 1.8), x=(-1, 0, 0), y=(0, 0, -1)), Plane(origin=(7.2, 1.8, 1.8), x=(0, 1, 0), y=(0, 0, -1)), PlaneXZ(1.8, 0, 5.4), Plane(origin=(-9, 18, 1.8), x=(-1, 0, 0), y=(0, 0, -1)), Plane(origin=(-12.6, 18, 5.4), x=(0, 0, 1), y=(-1, 0, 0)), Plane(origin=(-9, 28.8, 5.4), x=(0, 0, 1), y=(-1, 0, 0))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], {0;6}: [PlaneXY(5.4, 3.96, 1.8), Plane(origin=(-1.8, 3.96, 5.4), x=(-1, 0, 0), y=(0, 1, 0)), Plane(origin=(-5.4, -0.36, 5.4), x=(1, 0, 0), y=(0, -1, 0)), Plane(origin=(-12.6, 7.56, 5.4), x=(-1, 0, 0), y=(0, 1, 0)), Plane(origin=(-6.84, 9, 5.4), x=(0, 0, -1), y=(1, 0, 0)), Plane(origin=(-14.76, 9, 12.6), x=(0, 0, 1), y=(-1, 0, 0))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]))
data_94 = Data(Tree({0;0}: ["Component_C-Pos_1-Rot_0"], {0;1}: [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], {0;2}: [Point(1.8, 1.8, 1.8), Point(1.8, 5.4, 1.8), Point(5.4, 5.4, 1.8), Point(9, 5.4, 1.8), Point(9, 1.8, 1.8)], {0;3}: [Plane(origin=(1.8, 0, 1.8), x=(0, 0, -1), y=(1, 0, 0)), Plane(origin=(7.2, 1.8, 1.8), x=(0, 1, 0), y=(0, 0, -1)), PlaneXY(5.4, 5.4, 3.6)], {0;4}: [Point(1.8, 1.8, 1.8), Point(1.8, 5.4, 1.8), Point(5.4, 5.4, 1.8), Point(9, 5.4, 1.8), Point(9, 1.8, 1.8), Point(5.4, 5.4, 5.4)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], {0;5}: [Plane(origin=(7.2, 1.8, 1.8), x=(0, 1, 0), y=(0, 0, -1)), PlaneYZ(0, 23.4, 1.8), Plane(origin=(-19.8, 19.8, 10.8), x=(-1, 0, 0), y=(0, 1, 0)), Plane(origin=(-5.4, 27, 18), x=(-1, 0, 0), y=(0, -1, 0)), Plane(origin=(-5.4, 28.8, 5.4), x=(0, 0, 1), y=(1, 0, 0)), Plane(origin=(-7.2, 37.8, 1.8), x=(0, -1, 0), y=(0, 0, -1))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], {0;6}: [PlaneXY(5.4, 3.96, 1.8), PlaneYZ(5.4, 9, 7.56), Plane(origin=(5.4, 12.6, 3.24), x=(0, -1, 0), y=(0, 0, -1)), Plane(origin=(5.4, 17.64, 9), x=(1, 0, 0), y=(0, -1, 0)), Plane(origin=(0.36, 23.4, 9), x=(0, 0, -1), y=(1, 0, 0)), Plane(origin=(-3.96, 23.4, 5.4), x=(0, 0, 1), y=(-1, 0, 0))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]))
data_95 = Data(Tree({0;0}: ["Component_C-Pos_1-Rot_1"], {0;1}: [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], {0;2}: [Point(1.8, 1.8, 1.8), Point(1.8, 5.4, 1.8), Point(5.4, 5.4, 1.8), Point(9, 5.4, 1.8), Point(9, 1.8, 1.8)], {0;3}: [Plane(origin=(1.8, 0, 1.8), x=(0, 0, -1), y=(1, 0, 0)), Plane(origin=(7.2, 1.8, 1.8), x=(0, 0, 1), y=(0, 1, 0)), PlaneXY(5.4, 5.4, 3.6)], {0;4}: [Point(1.8, 1.8, 1.8), Point(1.8, 5.4, 1.8), Point(5.4, 5.4, 1.8), Point(9, 5.4, 1.8), Point(9, 1.8, 1.8), Point(5.4, 5.4, 5.4), Point(5.4, 5.4, 9), Point(5.4, 9, 9), Point(5.4, 12.6, 9), Point(5.4, 12.6, 5.4)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], {0;5}: [Plane(origin=(7.2, 1.8, 1.8), x=(0, 0, 1), y=(0, 1, 0)), Plane(origin=(9, 9, 0), x=(0, -1, 0), y=(-1, 0, 0)), PlaneYZ(3.6, 9, 1.8), Plane(origin=(1.8, 5.4, 10.8), x=(-1, 0, 0), y=(0, 1, 0)), Plane(origin=(7.2, -1.8, 1.8), x=(0, 0, -1), y=(0, -1, 0)), Plane(origin=(5.4, -5.4, 0), x=(1, 0, 0), y=(0, -1, 0))], {0;6}: [PlaneXY(5.4, 3.96, 1.8), PlaneYZ(5.4, 9, 7.56), Plane(origin=(5.4, 9, 3.96), x=(-1, 0, 0), y=(0, 0, 1)), PlaneXZ(5.4, 9, 11.16), Plane(origin=(5.4, 9, 14.76), x=(0, -1, 0), y=(0, 0, 1)), PlaneYZ(1.8, 9, 14.76), Plane(origin=(5.4, -3.96, 1.8), x=(1, 0, 0), y=(0, -1, 0))]))
data_96 = Data(Tree({0;0}: ["Component_C-Pos_1-Rot_2"], {0;1}: [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], {0;2}: [Point(1.8, 1.8, 1.8), Point(1.8, 5.4, 1.8), Point(5.4, 5.4, 1.8), Point(9, 5.4, 1.8), Point(9, 1.8, 1.8)], {0;3}: [Plane(origin=(1.8, 0, 1.8), x=(-1, 0, 0), y=(0, 0, -1)), Plane(origin=(7.2, 1.8, 1.8), x=(0, 0, 1), y=(0, 1, 0)), PlaneXY(5.4, 5.4, 3.6)], {0;4}: [Point(1.8, 1.8, 1.8), Point(1.8, 5.4, 1.8), Point(5.4, 5.4, 1.8), Point(9, 5.4, 1.8), Point(9, 1.8, 1.8), Point(9, 1.8, 5.4)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], {0;5}: [Plane(origin=(7.2, 1.8, 1.8), x=(0, 0, 1), y=(0, 1, 0)), Plane(origin=(3.6, 1.8, 5.4), x=(0, 0, -1), y=(0, 1, 0)), Plane(origin=(3.6, -1.8, 5.4), x=(0, 1, 0), y=(0, 0, -1)), Plane(origin=(-14.4, 9, 5.4), x=(0, -1, 0), y=(0, 0, -1)), Plane(origin=(-10.8, 5.4, 5.4), x=(0, 1, 0), y=(0, 0, -1)), Plane(origin=(-19.8, 5.4, 3.6), x=(0, -1, 0), y=(-1, 0, 0))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], {0;6}: [PlaneXY(5.4, 3.96, 1.8), Plane(origin=(5.4, 3.96, 5.4), x=(-1, 0, 0), y=(0, 1, 0)), Plane(origin=(1.8, -1.8, 3.24), x=(1, 0, 0), y=(0, 0, -1)), Plane(origin=(-1.8, -0.36, 9), x=(1, 0, 0), y=(0, -1, 0)), Plane(origin=(-9, 7.56, 9), x=(-1, 0, 0), y=(0, 1, 0)), Plane(origin=(-12.6, 9, 3.24), x=(-1, 0, 0), y=(0, 0, -1))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]))
data_97 = Data(Tree({0;0}: ["Component_C-Pos_2-Rot_0"], {0;1}: [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], {0;2}: [Point(1.8, 1.8, 1.8), Point(1.8, 5.4, 1.8), Point(5.4, 5.4, 1.8), Point(9, 5.4, 1.8), Point(9, 1.8, 1.8)], {0;3}: [Plane(origin=(5.4, 3.6, 1.8), x=(-1, 0, 0), y=(0, 0, -1)), Plane(origin=(0, 1.8, 1.8), x=(0, -1, 0), y=(0, 0, 1)), Plane(origin=(5.4, 5.4, 3.6), x=(0, 1, 0), y=(-1, 0, 0))], {0;4}: [Point(1.8, 1.8, 1.8), Point(1.8, 5.4, 1.8), Point(5.4, 5.4, 1.8), Point(9, 5.4, 1.8), Point(9, 1.8, 1.8), Point(-1.8, 1.8, 1.8)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], {0;5}: [Plane(origin=(5.4, 3.6, 1.8), x=(-1, 0, 0), y=(0, 0, -1)), Plane(origin=(-5.4, 14.4, 1.8), x=(1, 0, 0), y=(0, 0, -1)), Plane(origin=(5.4, 14.4, 1.8), x=(0, 0, -1), y=(1, 0, 0)), Plane(origin=(1.8, 9, 10.8), x=(-1, 0, 0), y=(0, -1, 0)), PlaneYZ(0, 9, 12.6), Plane(origin=(-5.4, 3.6, 1.8), x=(0, 0, -1), y=(-1, 0, 0))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], {0;6}: [PlaneXY(5.4, 3.96, 1.8), Plane(origin=(-5.4, -0.36, 1.8), x=(-1, 0, 0), y=(0, -1, 0)), Plane(origin=(5.4, 6.84, 5.4), x=(1, 0, 0), y=(0, -1, 0)), Plane(origin=(-5.4, 11.16, 5.4), x=(-1, 0, 0), y=(0, 1, 0)), Plane(origin=(-5.4, 14.04, 1.8), x=(-1, 0, 0), y=(0, -1, 0)), Plane(origin=(-3.96, 9, 5.4), x=(0, 0, -1), y=(-1, 0, 0))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]))
data_98 = Data(Tree({0;0}: ["Component_C-Pos_2-Rot_1"], {0;1}: [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], {0;2}: [Point(1.8, 1.8, 1.8), Point(1.8, 5.4, 1.8), Point(5.4, 5.4, 1.8), Point(9, 5.4, 1.8), Point(9, 1.8, 1.8)], {0;3}: [Plane(origin=(5.4, 3.6, 1.8), x=(0, 0, 1), y=(-1, 0, 0)), Plane(origin=(0, 1.8, 1.8), x=(0, -1, 0), y=(0, 0, 1)), Plane(origin=(5.4, 5.4, 3.6), x=(-1, 0, 0), y=(0, -1, 0))], {0;4}: [Point(1.8, 1.8, 1.8), Point(1.8, 5.4, 1.8), Point(5.4, 5.4, 1.8), Point(9, 5.4, 1.8), Point(9, 1.8, 1.8), Point(-1.8, 5.4, 5.4)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], {0;5}: [Plane(origin=(5.4, 3.6, 1.8), x=(0, 0, 1), y=(-1, 0, 0)), Plane(origin=(-9, 18, 1.8), x=(0, 0, 1), y=(1, 0, 0)), Plane(origin=(-9, 32.4, 1.8), x=(0, 0, 1), y=(1, 0, 0)), Plane(origin=(1.8, 32.4, 1.8), x=(0, 0, -1), y=(1, 0, 0)), Plane(origin=(9, 34.2, 3.6), x=(-1, 0, 0), y=(0, 1, 0)), Plane(origin=(7.2, 41.4, 1.8), x=(0, -1, 0), y=(0, 0, 1))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], {0;6}: [PlaneXY(5.4, 3.96, 1.8), Plane(origin=(-1.8, 1.8, 3.24), x=(0, -1, 0), y=(0, 0, -1)), PlaneYZ(-1.8, 12.6, 7.56), PlaneXY(-1.8, 11.16, 5.4), Plane(origin=(-7.56, 9, 5.4), x=(0, 0, -1), y=(-1, 0, 0)), PlaneYZ(-9, 16.2, 7.56)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]))
data_99 = Data(Tree({0;0}: ["Component_C-Pos_2-Rot_1"], {0;1}: [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], {0;2}: [Point(1.8, 1.8, 1.8), Point(1.8, 5.4, 1.8), Point(5.4, 5.4, 1.8), Point(9, 5.4, 1.8), Point(9, 1.8, 1.8)], {0;3}: [Plane(origin=(5.4, 3.6, 1.8), x=(0, 0, 1), y=(-1, 0, 0)), Plane(origin=(0, 1.8, 1.8), x=(0, 0, -1), y=(0, -1, 0)), Plane(origin=(5.4, 5.4, 3.6), x=(-1, 0, 0), y=(0, -1, 0))], {0;4}: [Point(1.8, 1.8, 1.8), Point(1.8, 5.4, 1.8), Point(5.4, 5.4, 1.8), Point(9, 5.4, 1.8), Point(9, 1.8, 1.8), Point(-1.8, 1.8, 1.8)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], {0;5}: [Plane(origin=(5.4, 3.6, 1.8), x=(0, 0, 1), y=(-1, 0, 0)), Plane(origin=(-5.4, 3.6, 1.8), x=(0, 0, -1), y=(1, 0, 0)), Plane(origin=(-5.4, 5.4, 0), x=(1, 0, 0), y=(0, -1, 0)), Plane(origin=(5.4, 7.2, 9), x=(-1, 0, 0), y=(0, 0, -1)), PlaneXZ(-9, 10.8, 1.8), PlaneXZ(-16.2, 25.2, 9)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], {0;6}: [PlaneXY(5.4, 3.96, 1.8), Plane(origin=(-5.4, 3.96, 1.8), x=(-1, 0, 0), y=(0, 1, 0)), Plane(origin=(5.4, 7.56, 9), x=(0, 0, 1), y=(0, 1, 0)), Plane(origin=(-1.8, 11.16, 9), x=(-1, 0, 0), y=(0, 1, 0)), Plane(origin=(-1.8, 12.6, 6.84), x=(0, 1, 0), y=(0, 0, -1)), Plane(origin=(-9, 12.6, 3.24), x=(-1, 0, 0), y=(0, 0, -1))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]))

data_100 = Data(Tree({0;0}: ["Component_C-Pos_0-Rot_0"], {0;1}: [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], {0;2}: [Point(1.8, 1.8, 1.8), Point(1.8, 5.4, 1.8), Point(5.4, 5.4, 1.8), Point(9, 5.4, 1.8), Point(9, 1.8, 1.8)], {0;3}: [Plane(origin=(1.8, 0, 1.8), x=(-1, 0, 0), y=(0, 0, -1)), Plane(origin=(7.2, 1.8, 1.8), x=(0, 0, 1), y=(0, 1, 0)), Plane(origin=(1.8, 5.4, 3.6), x=(0, 1, 0), y=(-1, 0, 0))], {0;4}: [Point(1.8, 1.8, 1.8), Point(1.8, 5.4, 1.8), Point(5.4, 5.4, 1.8), Point(9, 5.4, 1.8), Point(9, 1.8, 1.8), Point(1.8, 5.4, 5.4)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], {0;5}: [Plane(origin=(-3.6, -1.8, 1.8), x=(0, 0, -1), y=(0, -1, 0)), PlaneXZ(5.4, 0, 16.2), Plane(origin=(0, 1.8, 16.2), x=(0, 0, -1), y=(0, 1, 0)), PlaneXZ(-5.4, -3.6, 12.6), Plane(origin=(-10.8, -1.8, 12.6), x=(0, 0, -1), y=(0, 1, 0)), PlaneXZ(-12.6, 10.8, 5.4)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], {0;6}: [PlaneXY(5.4, 3.96, 1.8), PlaneYZ(1.8, 9, 7.56), Plane(origin=(0.36, -1.8, 5.4), x=(0, 0, 1), y=(1, 0, 0)), Plane(origin=(5.4, 9, 10.44), x=(0, 1, 0), y=(0, 0, -1)), Plane(origin=(1.8, 3.96, 16.2), x=(-1, 0, 0), y=(0, 1, 0)), Plane(origin=(-5.4, -0.36, 5.4), x=(-1, 0, 0), y=(0, -1, 0))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]))
data_101 = Data(Tree({0;0}: ["Component_C-Pos_0-Rot_1"], {0;1}: [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], {0;2}: [Point(1.8, 1.8, 1.8), Point(1.8, 5.4, 1.8), Point(5.4, 5.4, 1.8), Point(9, 5.4, 1.8), Point(9, 1.8, 1.8)], {0;3}: [Plane(origin=(1.8, 0, 1.8), x=(-1, 0, 0), y=(0, 0, -1)), Plane(origin=(7.2, 1.8, 1.8), x=(0, 1, 0), y=(0, 0, -1)), Plane(origin=(1.8, 5.4, 3.6), x=(0, 1, 0), y=(-1, 0, 0))], {0;4}: [Point(1.8, 1.8, 1.8), Point(1.8, 5.4, 1.8), Point(5.4, 5.4, 1.8), Point(9, 5.4, 1.8), Point(9, 1.8, 1.8), Point(1.8, 5.4, 5.4)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], {0;5}: [Plane(origin=(-3.6, -1.8, 1.8), x=(0, 0, -1), y=(0, -1, 0)), Plane(origin=(10.8, 12.6, 16.2), x=(0, 0, 1), y=(0, -1, 0)), Plane(origin=(3.6, 16.2, 1.8), x=(0, 0, -1), y=(0, 1, 0)), Plane(origin=(5.4, 27, 0), x=(0, 1, 0), y=(1, 0, 0)), Plane(origin=(5.4, 21.6, 1.8), x=(0, 0, 1), y=(1, 0, 0)), PlaneXZ(12.6, 28.8, 12.6)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], {0;6}: [PlaneXY(5.4, 3.96, 1.8), PlaneYZ(1.8, 9, 7.56), Plane(origin=(0.36, -1.8, 5.4), x=(0, 0, 1), y=(1, 0, 0)), Plane(origin=(7.56, 5.4, 12.6), x=(0, 0, 1), y=(1, 0, 0)), PlaneXY(12.6, 11.16, 9), PlaneYZ(9, 16.2, 14.76)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]))
data_102 = Data(Tree({0;0}: ["Component_C-Pos_0-Rot_1"], {0;1}: [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], {0;2}: [Point(1.8, 1.8, 1.8), Point(1.8, 5.4, 1.8), Point(5.4, 5.4, 1.8), Point(9, 5.4, 1.8), Point(9, 1.8, 1.8)], {0;3}: [Plane(origin=(1.8, 0, 1.8), x=(-1, 0, 0), y=(0, 0, -1)), Plane(origin=(7.2, 1.8, 1.8), x=(0, 1, 0), y=(0, 0, -1)), PlaneXY(1.8, 5.4, 3.6)], {0;4}: [Point(1.8, 1.8, 1.8), Point(1.8, 5.4, 1.8), Point(5.4, 5.4, 1.8), Point(9, 5.4, 1.8), Point(9, 1.8, 1.8), Point(1.8, 1.8, 5.4)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], {0;5}: [PlaneXZ(1.8, 0, 5.4), PlaneYZ(-3.6, 1.8, 5.4), Plane(origin=(-19.8, 14.4, 1.8), x=(-1, 0, 0), y=(0, 0, -1)), Plane(origin=(-19.8, 9, 7.2), x=(0, -1, 0), y=(-1, 0, 0)), Plane(origin=(-19.8, 14.4, 9), x=(0, 0, 1), y=(-1, 0, 0)), Plane(origin=(-23.4, 14.4, 5.4), x=(0, 0, 1), y=(-1, 0, 0))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], {0;6}: [PlaneXY(5.4, 3.96, 1.8), Plane(origin=(-1.8, 3.96, 5.4), x=(-1, 0, 0), y=(0, 1, 0)), Plane(origin=(-1.8, -3.96, 1.8), x=(-1, 0, 0), y=(0, -1, 0)), Plane(origin=(-1.8, -5.4, 7.56), x=(-1, 0, 0), y=(0, 0, 1)), Plane(origin=(-1.8, 0.36, 9), x=(-1, 0, 0), y=(0, 1, 0)), PlaneXY(-5.4, 0.36, 1.8)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]))
data_103 = Data(Tree({0;0}: ["Component_C-Pos_1-Rot_1"], {0;1}: [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], {0;2}: [Point(1.8, 1.8, 1.8), Point(1.8, 5.4, 1.8), Point(5.4, 5.4, 1.8), Point(9, 5.4, 1.8), Point(9, 1.8, 1.8)], {0;3}: [Plane(origin=(1.8, 0, 1.8), x=(0, 0, -1), y=(1, 0, 0)), Plane(origin=(7.2, 1.8, 1.8), x=(0, 0, 1), y=(0, 1, 0)), PlaneXY(5.4, 5.4, 3.6)], {0;4}: [Point(1.8, 1.8, 1.8), Point(1.8, 5.4, 1.8), Point(5.4, 5.4, 1.8), Point(9, 5.4, 1.8), Point(9, 1.8, 1.8), Point(5.4, 5.4, 5.4)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], {0;5}: [Plane(origin=(7.2, 1.8, 1.8), x=(0, 0, 1), y=(0, 1, 0)), PlaneXZ(5.4, 10.8, 5.4), Plane(origin=(-5.4, 16.2, 7.2), x=(1, 0, 0), y=(0, -1, 0)), Plane(origin=(-3.6, 16.2, 5.4), x=(0, 0, 1), y=(0, 1, 0)), Plane(origin=(-16.2, 25.2, 5.4), x=(-1, 0, 0), y=(0, 0, 1)), Plane(origin=(-7.2, 9, 9), x=(0, 1, 0), y=(0, 0, -1))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], {0;6}: [PlaneXY(5.4, 3.96, 1.8), PlaneYZ(5.4, 9, 7.56), PlaneXZ(5.4, 9, 11.16), Plane(origin=(0.36, 9, 5.4), x=(0, -1, 0), y=(1, 0, 0)), Plane(origin=(-5.4, 14.04, 5.4), x=(0, 0, 1), y=(0, -1, 0)), Plane(origin=(-5.4, 21.96, 5.4), x=(0, 0, 1), y=(0, 1, 0))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]))
data_104 = Data(Tree({0;0}: ["Component_C-Pos_1-Rot_0"], {0;1}: [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], {0;2}: [Point(1.8, 1.8, 1.8), Point(1.8, 5.4, 1.8), Point(5.4, 5.4, 1.8), Point(9, 5.4, 1.8), Point(9, 1.8, 1.8)], {0;3}: [Plane(origin=(1.8, 0, 1.8), x=(0, 0, -1), y=(1, 0, 0)), Plane(origin=(7.2, 1.8, 1.8), x=(0, 1, 0), y=(0, 0, -1)), PlaneXY(5.4, 5.4, 3.6)], {0;4}: [Point(1.8, 1.8, 1.8), Point(1.8, 5.4, 1.8), Point(5.4, 5.4, 1.8), Point(9, 5.4, 1.8), Point(9, 1.8, 1.8), Point(5.4, 5.4, 5.4)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], {0;5}: [Plane(origin=(7.2, 1.8, 1.8), x=(0, 1, 0), y=(0, 0, -1)), Plane(origin=(18, 12.6, 12.6), x=(0, 1, 0), y=(0, 0, -1)), Plane(origin=(7.2, -1.8, 1.8), x=(0, -1, 0), y=(0, 0, 1)), Plane(origin=(5.4, -5.4, 0), x=(1, 0, 0), y=(0, -1, 0)), Plane(origin=(19.8, 19.8, 25.2), x=(1, 0, 0), y=(0, -1, 0)), Plane(origin=(28.8, 23.4, 23.4), x=(0, 1, 0), y=(0, 0, -1))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], {0;6}: [PlaneXY(5.4, 3.96, 1.8), PlaneYZ(5.4, 9, 7.56), Plane(origin=(11.16, 9, 12.6), x=(0, 0, 1), y=(1, 0, 0)), PlaneXY(16.2, 14.76, 12.6), PlaneYZ(16.2, 19.8, 18.36), Plane(origin=(5.4, -3.96, 1.8), x=(1, 0, 0), y=(0, -1, 0))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]))
data_105 = Data(Tree({0;0}: ["Component_C-Pos_1-Rot_2"], {0;1}: [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], {0;2}: [Point(1.8, 1.8, 1.8), Point(1.8, 5.4, 1.8), Point(5.4, 5.4, 1.8), Point(9, 5.4, 1.8), Point(9, 1.8, 1.8)], {0;3}: [Plane(origin=(1.8, 0, 1.8), x=(-1, 0, 0), y=(0, 0, -1)), Plane(origin=(7.2, 1.8, 1.8), x=(0, 0, 1), y=(0, 1, 0)), PlaneXY(5.4, 5.4, 3.6)], {0;4}: [Point(1.8, 1.8, 1.8), Point(1.8, 5.4, 1.8), Point(5.4, 5.4, 1.8), Point(9, 5.4, 1.8), Point(9, 1.8, 1.8), Point(5.4, 5.4, 5.4)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], {0;5}: [Plane(origin=(7.2, 1.8, 1.8), x=(0, 0, 1), y=(0, 1, 0)), Plane(origin=(10.8, 5.4, 5.4), x=(0, -1, 0), y=(0, 0, 1)), Plane(origin=(3.6, -1.8, 5.4), x=(0, 1, 0), y=(0, 0, -1)), Plane(origin=(-14.4, 9, 5.4), x=(0, -1, 0), y=(0, 0, -1)), Plane(origin=(-18, 5.4, 1.8), x=(0, 0, 1), y=(0, -1, 0)), Plane(origin=(-9, 1.8, 10.8), x=(-1, 0, 0), y=(0, 1, 0))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], {0;6}: [PlaneXY(5.4, 3.96, 1.8), PlaneXZ(9, 5.4, 7.56), Plane(origin=(1.8, -1.8, 3.24), x=(1, 0, 0), y=(0, 0, -1)), Plane(origin=(-1.8, -0.36, 9), x=(1, 0, 0), y=(0, -1, 0)), Plane(origin=(-9, 7.56, 9), x=(-1, 0, 0), y=(0, 1, 0)), Plane(origin=(-12.6, 9, 3.24), x=(-1, 0, 0), y=(0, 0, -1))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]))
data_106 = Data(Tree({0;0}: ["Component_C-Pos_2-Rot_1"], {0;1}: [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], {0;2}: [Point(1.8, 1.8, 1.8), Point(1.8, 5.4, 1.8), Point(5.4, 5.4, 1.8), Point(9, 5.4, 1.8), Point(9, 1.8, 1.8)], {0;3}: [Plane(origin=(5.4, 3.6, 1.8), x=(0, 0, 1), y=(-1, 0, 0)), Plane(origin=(0, 1.8, 1.8), x=(0, -1, 0), y=(0, 0, 1)), Plane(origin=(5.4, 5.4, 3.6), x=(-1, 0, 0), y=(0, -1, 0))], {0;4}: [Point(1.8, 1.8, 1.8), Point(1.8, 5.4, 1.8), Point(5.4, 5.4, 1.8), Point(9, 5.4, 1.8), Point(9, 1.8, 1.8), Point(-1.8, 1.8, 1.8)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], {0;5}: [Plane(origin=(5.4, 3.6, 1.8), x=(0, 0, 1), y=(-1, 0, 0)), Plane(origin=(-5.4, 5.4, 3.6), x=(1, 0, 0), y=(0, -1, 0)), Plane(origin=(5.4, 16.2, 3.6), x=(-1, 0, 0), y=(0, -1, 0)), Plane(origin=(-1.8, 19.8, 3.6), x=(1, 0, 0), y=(0, -1, 0)), Plane(origin=(-1.8, 18, 12.6), x=(0, 0, -1), y=(1, 0, 0)), Plane(origin=(5.4, 16.2, 10.8), x=(-1, 0, 0), y=(0, 1, 0))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], {0;6}: [PlaneXY(5.4, 3.96, 1.8), Plane(origin=(-5.4, -0.36, 1.8), x=(-1, 0, 0), y=(0, -1, 0)), PlaneYZ(-5.4, 5.4, 3.96), Plane(origin=(3.24, 5.4, 9), x=(0, 0, 1), y=(-1, 0, 0)), Plane(origin=(-3.24, -1.8, 9), x=(0, 0, 1), y=(1, 0, 0)), Plane(origin=(-9, 0.36, 9), x=(-1, 0, 0), y=(0, 1, 0))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]))
data_107 = Data(Tree({0;0}: ["Component_C-Pos_2-Rot_0"], {0;1}: [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], {0;2}: [Point(1.8, 1.8, 1.8), Point(1.8, 5.4, 1.8), Point(5.4, 5.4, 1.8), Point(9, 5.4, 1.8), Point(9, 1.8, 1.8)], {0;3}: [Plane(origin=(5.4, 3.6, 1.8), x=(-1, 0, 0), y=(0, 0, -1)), Plane(origin=(0, 1.8, 1.8), x=(0, -1, 0), y=(0, 0, 1)), Plane(origin=(5.4, 5.4, 3.6), x=(0, 1, 0), y=(-1, 0, 0))], {0;4}: [Point(1.8, 1.8, 1.8), Point(1.8, 5.4, 1.8), Point(5.4, 5.4, 1.8), Point(9, 5.4, 1.8), Point(9, 1.8, 1.8), Point(-1.8, 1.8, 1.8)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], {0;5}: [Plane(origin=(5.4, 3.6, 1.8), x=(-1, 0, 0), y=(0, 0, -1)), Plane(origin=(5.4, 7.2, 9), x=(0, 0, -1), y=(1, 0, 0)), PlaneXZ(-1.8, 10.8, 9), Plane(origin=(-3.6, 19.8, 1.8), x=(0, 0, -1), y=(0, 1, 0)), Plane(origin=(1.8, 16.2, 0), x=(1, 0, 0), y=(0, -1, 0)), Plane(origin=(-5.4, 14.4, 12.6), x=(-1, 0, 0), y=(0, 0, 1))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], {0;6}: [PlaneXY(5.4, 3.96, 1.8), Plane(origin=(-5.4, -0.36, 1.8), x=(-1, 0, 0), y=(0, -1, 0)), Plane(origin=(5.4, 7.56, 9), x=(0, 0, 1), y=(0, 1, 0)), Plane(origin=(-1.8, 11.16, 9), x=(-1, 0, 0), y=(0, 1, 0)), Plane(origin=(-1.8, 14.04, 5.4), x=(-1, 0, 0), y=(0, -1, 0)), Plane(origin=(5.4, 17.64, 5.4), x=(0, 0, -1), y=(0, -1, 0))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]))
data_108 = Data(Tree({0;0}: ["Component_C-Pos_2-Rot_1"], {0;1}: [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], {0;2}: [Point(1.8, 1.8, 1.8), Point(1.8, 5.4, 1.8), Point(5.4, 5.4, 1.8), Point(9, 5.4, 1.8), Point(9, 1.8, 1.8)], {0;3}: [Plane(origin=(5.4, 3.6, 1.8), x=(0, 0, 1), y=(-1, 0, 0)), Plane(origin=(0, 1.8, 1.8), x=(0, 0, -1), y=(0, -1, 0)), Plane(origin=(5.4, 5.4, 3.6), x=(-1, 0, 0), y=(0, -1, 0))], {0;4}: [Point(1.8, 1.8, 1.8), Point(1.8, 5.4, 1.8), Point(5.4, 5.4, 1.8), Point(9, 5.4, 1.8), Point(9, 1.8, 1.8), Point(-1.8, 1.8, 1.8)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], {0;5}: [Plane(origin=(5.4, 3.6, 1.8), x=(0, 0, 1), y=(-1, 0, 0)), Plane(origin=(-5.4, 3.6, 1.8), x=(0, 0, -1), y=(1, 0, 0)), Plane(origin=(-5.4, 5.4, 0), x=(1, 0, 0), y=(0, -1, 0)), Plane(origin=(5.4, 7.2, 9), x=(-1, 0, 0), y=(0, 0, -1)), PlaneXZ(-9, 10.8, 1.8), Plane(origin=(-10.8, 23.4, 12.6), x=(0, -1, 0), y=(0, 0, -1))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], {0;6}: [PlaneXY(5.4, 3.96, 1.8), Plane(origin=(-5.4, 3.96, 1.8), x=(-1, 0, 0), y=(0, 1, 0)), Plane(origin=(5.4, 7.56, 9), x=(0, 0, 1), y=(0, 1, 0)), Plane(origin=(-1.8, 11.16, 9), x=(-1, 0, 0), y=(0, 1, 0)), Plane(origin=(-1.8, 12.6, 6.84), x=(0, 1, 0), y=(0, 0, -1)), Plane(origin=(-9, 12.6, 3.24), x=(-1, 0, 0), y=(0, 0, -1))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]))

multiplication = Multiplication(A="3.6", B=Slider(35, range=0..100))
multiplication_2 = Multiplication(A="3.6", B=Slider(30, range=0..100))

data_109 = Data(data)

# ----
# Imported
# assemblage
# data
bang = ExplodeTree(Data=data_109)  # -> Branch0, Branch1, Branch2, Branch3, Branch4, Branch5, Branch6
txt = Text(flatten(bang.Branch0))
pt = Point(flatten(bang.Branch2))
pln = Plane(flatten(bang.Branch5))
pln_2 = Plane(flatten(bang.Branch6))
mesh = Mesh(flatten(bang.Branch1))
pln_3 = Plane(flatten(bang.Branch3))
pt_2 = Point(flatten(bang.Branch4))

pt_3 = Point(pln_3)
pt_4 = ConstructPoint(XCoordinate=expr("x*2", multiplication), YCoordinate=0, ZCoordinate=0)  # disabled
pt_5 = ConstructPoint(XCoordinate=expr("x*1", multiplication), YCoordinate=multiplication_2, ZCoordinate=0)  # disabled
pt_6 = ConstructPoint(XCoordinate=expr("x*1", multiplication), YCoordinate=0, ZCoordinate=0)
# 3
pt_7 = Point(flatten(pt_2))  # disabled
pln_4 = Plane(flatten(pln))  # disabled
pln_5 = Plane(flatten(pln_2))  # disabled
# 2
pt_8 = Point(flatten(pt_2))  # disabled
pln_6 = Plane(flatten(pln))  # disabled
pln_7 = Plane(flatten(pln_2))  # disabled
mesh_2 = Mesh(mesh)  # disabled
pt_9 = Point(pt)  # disabled
# 5
pt_10 = Point(flatten(pt_2))
pln_8 = Plane(flatten(pln))
# 6
pln_9 = Plane(flatten(pln_2))
panel_19 = Panel("600,0,0")  # disabled
pln_10 = Plane(flatten(pln))  # disabled
pln_11 = Plane(flatten(pln_2))  # disabled
# 4
pt_11 = Point(flatten(pt_2))  # disabled
pt_12 = ConstructPoint(XCoordinate=0, YCoordinate=multiplication_2, ZCoordinate=0)  # disabled
# MAA01 23/24
# ASSEMBLED ARCHITECTURE
# Computational Logic of Iterative Assemblage Processes
# BCN . Jan-Feb-Mar 2024
# Tutor: Andrea Graziano - Co-de-iT
# Assistant: Akshay Madapura
pt_13 = Point(flatten(pt_2))  # disabled
pln_12 = Plane(flatten(pln))  # disabled
# 1
pln_13 = Plane(flatten(pln_2))  # disabled
avr = Average(Input=pt_9)  # disabled
move = Move(Geometry=pt_8, Motion=pt_5)  # -> Geometry, Transform; disabled
move_2 = Move(Geometry=pt_7, Motion=pt_4)  # -> Geometry, Transform; disabled
move_3 = Move(Geometry=pln_5, Motion=pt_4)  # -> Geometry, Transform; disabled
move_4 = Move(Geometry=pt_11, Motion=pt_12)  # -> Geometry, Transform; disabled
move_5 = Move(Geometry=pt_10, Motion=pt_6)  # -> Geometry, Transform
# POROSITY
xy = XYPlane(Origin=avr)  # disabled
pt_14 = Point(pt_13)  # disabled

# ---- group: extract walls
# PRIVACY INDEX
pt_15 = Point(pt_10)
voxel = Voxel(Points=pt_15, X="3.6", Y="3.6", Z="3.6")
facen = FaceNormals(Mesh=voxel)  # -> Centers, Normals
Z = UnitZ(Factor=1)
dprod = DotProduct(VectorA=facen.Normals, VectorB=Z, Unitize=False)
vdis = VectorDisplay(Anchor=facen.Centers, Vector=facen.Normals)
int = Integer(dprod)
equals = Equality(FirstNumber=int, SecondNumber="0")  # -> Equality, Inequality
cullf = CullFaces(Mesh=voxel, Pattern=equals.Inequality)
cullf_2 = CullFaces(Mesh=voxel, Pattern=equals.Equality)
facen_2 = FaceNormals(Mesh=cullf)  # -> Centers, Normals
amp = Amplitude(Vector=facen_2.Normals, Amplitude="0.01")
move_6 = Move(Geometry=facen_2.Centers, Motion=amp)  # -> Geometry, Transform
line = LineSDL(Start=move_6.Geometry, Direction=facen_2.Normals, Length="12")
mcx = MeshCurve(Mesh=voxel, Curve=line)  # -> Points, Faces
item = ListItem(List=mcx.Points, Index=0, Wrap=True)
dist = Distance(PointA=graft(facen_2.Centers), PointB=item)  # -> simplify(Distance)
nullrep = ReplaceNulls(Items=dist, Replacements="14.4")  # -> Items, Count
item_2 = ListItem(List=nullrep.Items, Index=0, Wrap=True)
bnd = Bounds(Numbers=flatten(item_2))
dedomain = DeconstructDomain(Domain=bnd)  # -> Start, End
gradient = Gradient(
    LowerLimit=dedomain.End,
    UpperLimit=dedomain.Start,
    Parameter=item_2,
    stops=[0: RGB(0, 192, 0), 0.5: RGB(255, 255, 0), 1: RGB(255, 0, 0)])
remap = RemapNumbers(Value=item_2, Source="3.6 to 14.4", Target="0 to 1")  # -> Mapped, Clipped
avr_2 = Average(Input=flatten(remap.Mapped))
explode = MeshExplode(Mesh=cullf, Interpolate=False)
expression = Expression(x=avr_2, Expression="Round(x,2)")
swatch = ColourSwatch(SwatchColor=RGB(255, 255, 255))
mcol = MeshColours(Mesh=graft(explode), Colours=gradient)
mcol_2 = MeshColours(Mesh=graft(cullf_2), Colours=ColourSwatch(SwatchColor=RGB(99, 99, 99)))
privacy_index = Panel(expression)
preview = CustomPreview(Geometry=mcol, Material=swatch)
preview_2 = CustomPreview(Geometry=mcol_2, Material=swatch)
panel_20 = Panel("""Privacy index
------------------""")
bbox = BoundingBox(Content=voxel, Plane=PlaneXY(0, 0, 0), UnionBox=True)  # -> Box, Box_2
edges = BrepEdges(Brep=bbox.Box)  # -> Naked, Interior, NonManifold
merge = Merge(Data1=flatten(panel_20), Data2=flatten(expression))
item_3 = ListItem(List=edges.Interior, Index=0, Wrap=True)
curvepoint = PointOnCurve(item_3, parameter=0.5)
join = TextJoin(Text=merge)
tag = TextTag3D(
    Location=curvepoint,
    Text=join,
    Size=Slider(2, range=0..10),
    Colour=ColourSwatch(SwatchColor=RGB(102, 102, 102)),
    Justification=2)

# ----
# Porosity (%) = { ( Total Volume - Volume of the Solid ) / Total Volume } x 100
pt_16 = Point(move_4.Geometry)  # disabled
pdecon = Deconstruct(Point=pt_16)  # -> XComponent, YComponent, ZComponent; disabled
panel_21 = Panel("3.6")  # disabled
sort = SortList(Keys=pdecon.YComponent)  # -> Keys, ValuesA; disabled
sort_2 = SortList(Keys=pdecon.ZComponent)  # -> Keys, ValuesA; disabled
voxel_2 = Voxel(Points=pt_16, X=panel_21, Y=panel_21, Z=panel_21)  # disabled
sort_3 = SortList(Keys=pdecon.XComponent)  # -> Keys, ValuesA; disabled
cset = CreateSet(List=sort.Keys)  # -> Set, Map; disabled
cset_2 = CreateSet(List=sort_3.Keys)  # -> Set, Map; disabled
cset_3 = CreateSet(List=sort_2.Keys)  # -> Set, Map; disabled
swatch_2 = ColourSwatch(SwatchColor=RGB(168, 168, 168))  # disabled
pt_17 = ConstructPoint(XCoordinate=cset_2.Set, YCoordinate=0, ZCoordinate=0)  # disabled
crossref = CrossReference(ListA=cset_2.Set, ListB=cset.Set, ListC=cset_3.Set, CrossMode=1)  # -> ListA, ListB, ListC; disabled
mcol_3 = MeshColours(Mesh=graft(voxel_2), Colours=swatch_2)  # disabled
swatch_3 = ColourSwatch(SwatchColor=RGB(255, 255, 255))  # disabled
yz = YZPlane(Origin=pt_17)  # disabled
pt_18 = ConstructPoint(XCoordinate=crossref.ListA, YCoordinate=crossref.ListB, ZCoordinate=crossref.ListC)  # disabled
preview_3 = CustomPreview(Geometry=mcol_3, Material=swatch_3)  # disabled
pdecon_2 = Deconstruct(Point=pt_18)  # -> XComponent, YComponent, ZComponent; disabled
sec = MeshPlane(Mesh=voxel_2, Plane=yz)  # disabled
sort_4 = SortList(Keys=pdecon_2.XComponent)  # -> Keys, ValuesA; disabled
disc = Discontinuity(Curve=sec, Level=1)  # -> Points, Parameters; disabled
cset_4 = CreateSet(List=sort_4.Keys)  # -> Set, Map; disabled
pshift = ShiftPaths(Data=disc.Points, Offset=-1)  # disabled
mindex = MemberIndex(Set=pdecon_2.XComponent, Member=cset_4.Set)  # -> Index, Count; disabled
hull = ConvexHull(Points=pshift, Plane=graft(yz))  # -> simplify(Hull), HullZ, Indices; disabled
item_4 = ListItem(List=pt_18, Index=mindex.Index, Wrap=True)  # -> simplify(Item); disabled
incurve = PointInCurve(Point=item_4, Curve=hull.Hull)  # -> Relationship, Point; disabled
panel_22 = Panel("2")  # disabled
equals_2 = Equality(FirstNumber=incurve.Relationship, SecondNumber=panel_22)  # -> Equality, Inequality; disabled
dispatch = Dispatch(List=item_4, DispatchPattern=equals_2.Inequality)  # -> ListA, flatten(ListB); disabled
panel_23 = Panel("3.6")  # disabled
voxel_3 = Voxel(Points=dispatch.ListB, X=panel_23, Y=panel_23, Z=panel_23)  # disabled
swatch_4 = ColourSwatch(SwatchColor=RGB(255, 0, 0))  # disabled
f_mseea = MeshExtractEdgesWithToleranceAngle(Mesh=voxel_3, Angle=45)  # -> InternalEdges, NakedEdges; disabled
volume = MeshVolume(Mesh=voxel_2)  # -> Volume, Centroid; disabled
volume_2 = MeshVolume(Mesh=voxel_3)  # -> Volume, Centroid; disabled
preview_4 = CustomPreview(Geometry=f_mseea.InternalEdges, Material=swatch_4)  # disabled
expression_2 = Expression(x=volume_2.Volume, y=volume.Volume, Expression="Round((x-y)/x,2)")  # disabled
bbox_2 = BoundingBox(Content=pt_16, Plane=PlaneXY(0, 0, 0), UnionBox=True)  # -> Box, Box_2; disabled
panel_24 = Panel("""Porosity index
------------------""")  # disabled
edges_2 = BrepEdges(Brep=bbox_2.Box)  # -> Naked, Interior, NonManifold; disabled
porosity = Panel(expression_2)  # disabled
item_5 = ListItem(List=edges_2.Interior, Index=0, Wrap=True)  # disabled
merge_2 = Merge(Data1=flatten(panel_24), Data2=flatten(expression_2))  # disabled
number_slider = Slider(2, range=0..10)  # disabled
panel_25 = Panel("")  # disabled
curvepoint_2 = PointOnCurve(item_5, parameter=0.5)  # disabled
swatch_5 = ColourSwatch(SwatchColor=RGB(102, 102, 102))  # disabled
join_2 = TextJoin(Text=merge_2, Join=panel_25)  # disabled
tag_2 = TextTag3D(Location=curvepoint_2, Text=join_2, Size=number_slider, Colour=swatch_5, Justification=2)  # disabled

panel_26 = Panel("3.6")  # disabled
voxel_4 = Voxel(Points=move.Geometry, X=panel_26, Y=panel_26, Z=panel_26)  # disabled
pdecon_3 = Deconstruct(Point=move.Geometry)  # -> XComponent, YComponent, ZComponent; disabled
facen_3 = FaceNormals(Mesh=voxel_4)  # -> flatten(Centers), Normals; disabled
cset_5 = CreateSet(List=pdecon_3.XComponent)  # -> Set, Map; disabled
cset_6 = CreateSet(List=pdecon_3.YComponent)  # -> Set, Map; disabled
panel_27 = Panel("0.01")  # disabled
pt_19 = ConstructPoint(XCoordinate=pdecon_3.XComponent, YCoordinate=pdecon_3.YComponent, ZCoordinate=0)  # disabled
pdecon_4 = Deconstruct(Point=facen_3.Centers)  # -> XComponent, YComponent, ZComponent; disabled
smaller = SmallerThan(FirstNumber=pdecon_4.ZComponent, SecondNumber=panel_27)  # -> SmallerThan, OrEqualTo; disabled
crossref_2 = CrossReference(ListA=cset_5.Set, ListB=cset_6.Set, CrossMode=1)  # -> ListA, ListB; disabled
cullpt = CullDuplicates(Points=pt_19, Tolerance=0.1, CullMode=3)  # -> Points, Indices, Valence; disabled
dispatch_2 = Dispatch(List=facen_3.Centers, DispatchPattern=smaller.OrEqualTo)  # -> ListA, ListB; disabled
pt_20 = ConstructPoint(XCoordinate=crossref_2.ListA, YCoordinate=crossref_2.ListB, ZCoordinate=0)  # disabled
lng = ListLength(List=cullpt.Points)  # disabled
lng_2 = ListLength(List=dispatch_2.ListA)  # disabled
panel_28 = Panel("""1.8,1.8,0
-1.8,1.8,0
-1.8,-1.8,0
1.8,-1.8,0""")  # disabled
division = Division(A=lng_2, B=lng)  # disabled
difference = SetDifference(SetA=cullpt.Points, SetB=dispatch_2.ListA)  # disabled
exdiff = SetDifferenceS(SetA=cullpt.Points, SetB=pt_20)  # disabled
move_7 = Move(Geometry=graft(difference), Motion=panel_28)  # -> Geometry, Transform; disabled
move_8 = Move(Geometry=graft(exdiff), Motion=panel_28)  # -> Geometry, Transform; disabled
move_9 = Move(Geometry=graft(dispatch_2.ListA), Motion=panel_28)  # -> Geometry, Transform; disabled
swatch_6 = ColourSwatch(SwatchColor=RGB(232, 232, 232))  # disabled
swatch_7 = ColourSwatch(SwatchColor=RGB(191, 191, 191))  # disabled
conmesh = ConstructMesh(Vertices=move_8.Geometry, Faces={A=0, B=1, C=2, D=3})  # disabled
swatch_8 = ColourSwatch(SwatchColor=RGB(41, 41, 41))  # disabled
conmesh_2 = ConstructMesh(Vertices=move_7.Geometry, Faces={A=0, B=1, C=2, D=3})  # disabled
conmesh_3 = ConstructMesh(Vertices=move_9.Geometry, Faces={A=0, B=1, C=2, D=3})  # disabled
mcol_4 = MeshColours(Mesh=graft(conmesh), Colours=swatch_6)  # disabled
mcol_5 = MeshColours(Mesh=graft(conmesh_2), Colours=swatch_7)  # disabled
mcol_6 = MeshColours(Mesh=graft(conmesh_3), Colours=swatch_8)  # disabled
swatch_9 = ColourSwatch(SwatchColor=RGB(255, 255, 255))  # disabled
preview_5 = CustomPreview(Geometry=mcol_5, Material=swatch_9)  # disabled
preview_6 = CustomPreview(Geometry=mcol_4, Material=swatch_9)  # disabled
preview_7 = CustomPreview(Geometry=mcol_6, Material=swatch_9)  # disabled
bbox_3 = BoundingBox(Content=move.Geometry, Plane=PlaneXY(0, 0, 0), UnionBox=True)  # -> Box, Box_2; disabled
expression_3 = Expression(x=division, Expression="Round(x,2)")  # disabled
edges_3 = BrepEdges(Brep=bbox_3.Box)  # -> Naked, Interior, NonManifold; disabled
panel_29 = Panel("""Contact area index
------------------""")  # disabled
item_6 = ListItem(List=edges_3.Interior, Index=0, Wrap=True)  # disabled
contact_area_index = Panel(expression_3)  # disabled
curvepoint_3 = PointOnCurve(item_6, parameter=0.5)  # disabled
merge_3 = Merge(Data1=flatten(panel_29), Data2=flatten(expression_3))  # disabled
number_slider_2 = Slider(2, range=0..10)  # disabled
panel_30 = Panel("")  # disabled
swatch_10 = ColourSwatch(SwatchColor=RGB(102, 102, 102))  # disabled
join_3 = TextJoin(Text=merge_3, Join=panel_30)  # disabled
tag_3 = TextTag3D(Location=curvepoint_3, Text=join_3, Size=number_slider_2, Colour=swatch_10, Justification=flatten(2))  # disabled

# ----
# CONTACT AREA INDEX
panel_31 = Panel("3.6")  # disabled

# ---- group: Vertical & horizontal blocks
panel_32 = Panel("3.6")  # disabled
# OCCLUSION INDEX
voxel_5 = Voxel(Points=move_2.Geometry, X=panel_32, Y=panel_32, Z=panel_32)  # disabled
orient = Orient(Geometry=mesh_2, Source=xy, Target=move_3.Geometry)  # -> Geometry, Transform; disabled
mesh_3 = Mesh(voxel_5)  # disabled
mesh_4 = Mesh(orient.Geometry)  # disabled
facen_4 = FaceNormals(Mesh=mesh_3)  # -> Centers, Normals; disabled
facen_5 = FaceNormals(Mesh=mesh_4)  # -> Centers, Normals; disabled
Z_2 = UnitZ(Factor=1)  # disabled
dprod_2 = DotProduct(VectorA=facen_5.Normals, VectorB=Z_2, Unitize=False)  # disabled
mindex_2 = MemberIndex(Set=facen_4.Centers, Member=facen_5.Centers)  # -> Index, Count; disabled
abs = Absolute(Value=dprod_2)  # disabled
pshift_2 = ShiftPaths(Data=mindex_2.Index, Offset=-1)  # disabled
int_2 = Integer(abs)  # disabled
panel_33 = Panel("0")  # disabled
item_7 = ListItem(List=facen_4.Normals, Index=pshift_2, Wrap=True)  # disabled
equals_3 = Equality(FirstNumber=int_2, SecondNumber=panel_33)  # -> Equality, Inequality; disabled
Z_3 = UnitZ(Factor=1)  # disabled
dispatch_3 = Dispatch(List=facen_5.Centers, DispatchPattern=equals_3.Equality)  # -> ListA, ListB; disabled
dprod_3 = DotProduct(VectorA=item_7, VectorB=Z_3, Unitize=False)  # disabled
lng_3 = ListLength(List=dispatch_3.ListA)  # disabled
abs_2 = Absolute(Value=dprod_3)  # disabled
not = GateNot(A=abs_2)  # disabled
ma = MassAddition(Input=not)  # -> Result, PartialResults; disabled
panel_34 = Panel("0")  # disabled
nullrep_2 = ReplaceNulls(Items=ma.Result, Replacements=panel_34)  # -> Items, Count; disabled
number_slider_3 = Slider(1, range=0..1)  # disabled
division_2 = Division(A=nullrep_2.Items, B=lng_3)  # -> flatten(Result); disabled
gradient_2 = Gradient(LowerLimit=0, UpperLimit=1, Parameter=division_2, stops=[0: RGB(0, 0, 0), 0.5: RGB(255, 255, 0), 1: RGB(0, 192, 0)])  # disabled
num = Number(division_2)  # disabled
smaller_2 = SmallerThan(FirstNumber=division_2, SecondNumber=number_slider_3)  # -> SmallerThan, OrEqualTo; disabled
avr_3 = Average(Input=num)  # disabled
expression_4 = Expression(x=avr_3, Expression="Round(x,2)")  # disabled
dispatch_4 = Dispatch(List=mesh_4, DispatchPattern=smaller_2.OrEqualTo)  # -> ListA, ListB; disabled
dispatch_5 = Dispatch(List=gradient_2, DispatchPattern=smaller_2.OrEqualTo)  # -> ListA, ListB; disabled
mcol_7 = MeshColours(Mesh=graft(mesh_4), Colours=graft(gradient_2))  # disabled
swatch_11 = ColourSwatch(SwatchColor=RGB(255, 255, 255))  # disabled
mcol_8 = MeshColours(Mesh=graft(dispatch_4.ListA), Colours=graft(dispatch_5.ListA))  # disabled
occlusion_index = Panel(expression_4)  # disabled
swatch_12 = ColourSwatch(SwatchColor=RGB(255, 255, 255))  # disabled
preview_8 = CustomPreview(Geometry=mcol_7, Material=swatch_11)  # disabled
preview_9 = CustomPreview(Geometry=mcol_8, Material=swatch_12)  # disabled
panel_35 = Panel("""Occlusion index
------------------""")  # disabled
bbox_4 = BoundingBox(Content=mesh_3, Plane=PlaneXY(0, 0, 0), UnionBox=True)  # -> Box, Box_2; disabled
edges_4 = BrepEdges(Brep=bbox_4.Box)  # -> Naked, Interior, NonManifold; disabled
merge_4 = Merge(Data1=flatten(panel_35), Data2=flatten(expression_4))  # disabled
number_slider_4 = Slider(2, range=0..10)  # disabled
item_8 = ListItem(List=edges_4.Interior, Index=0, Wrap=True)  # disabled
panel_36 = Panel("")  # disabled
curvepoint_4 = PointOnCurve(item_8, parameter=0.5)  # disabled
swatch_13 = ColourSwatch(SwatchColor=RGB(102, 102, 102))  # disabled
join_4 = TextJoin(Text=merge_4, Join=panel_36)  # disabled
tag_4 = TextTag3D(Location=curvepoint_4, Text=join_4, Size=number_slider_4, Colour=swatch_13, Justification=2)  # disabled

# ----
mbox = MeshBox(Base={Plane=PlaneXY(0, 0, 0), X=Domain(-10, 10), Y=Domain(-10, 10), Z=Domain(-10, 10)}, XCount=10, YCount=10, ZCount=10)  # disabled
voxel_6 = Voxel(Points=pt_14, X=panel_31, Y=panel_31, Z=panel_31)  # disabled

# ---- group: D0
# ADD YOUR NEW EVALUATION CRITERIA HERE !!!
pt_21 = Point(pt_15)

# ----
explode_2 = MeshExplode(Mesh=voxel_6, Interpolate=False)  # disabled

# ----
# Grid
pdecon_5 = Deconstruct(Point=pt_21)  # -> XComponent, YComponent, ZComponent
bnd_2 = Bounds(Numbers=pdecon_5.XComponent)
bnd_3 = Bounds(Numbers=pdecon_5.YComponent)
dedomain_2 = DeconstructDomain(Domain=bnd_3)  # -> Start, End
dedomain_3 = DeconstructDomain(Domain=bnd_2)  # -> Start, End
expression_5 = Expression(x=dedomain_3.Start, y="3.6", Expression="x-(y/2)*7")
expression_6 = Expression(x=dedomain_2.Start, y="3.6", Expression="x-(y/2)*7")
expression_7 = Expression(x=dedomain_3.End, y=dedomain_3.Start, z="3.6", Expression="((x-y)/z)+7")
expression_8 = Expression(x=dedomain_2.End, y=dedomain_2.Start, z="3.6", Expression="((x-y)/z)+7")
pt_22 = ConstructPoint(XCoordinate=expression_5, YCoordinate=expression_6, ZCoordinate=0)
sqgrid = Square(Plane=pt_22, Size="3.6", ExtentX=expression_7, ExtentY=expression_8)  # -> Cells, flatten(Points)
vec2pt = Vector2Pt(PointA="0,0,0", PointB=sqgrid.Points, Unitize=False)  # -> Vector, Length
crv = Curve([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])
move_10 = Move(Geometry=crv, Motion=graft(vec2pt.Vector))  # -> Geometry, Transform
# ... AND INSERT THE INDEX VALUE THERE !!!
preview_10 = CustomPreview(Geometry=move_10.Geometry, Material=ColourSwatch(SwatchColor=RGB(48, 48, 48)))

lng_4 = ListLength(List=pt_14)  # disabled
lng_5 = ListLength(List=explode_2)  # disabled
swatch_14 = ColourSwatch(SwatchColor=RGBA(204, 204, 204, 42))  # disabled
expression_9 = Expression(x=lng_5, y=lng_4, Expression="Round((pow(x,1.5))/y,2)")  # -> flatten(R); disabled
lng_6 = ListLength(List=pt_14)  # disabled
unifynormals = MeshUnifyNormals(Mesh=voxel_4)  # disabled
expression_10 = Expression(x=lng_6, Expression="x*(Pow(3.6,3))")  # disabled
swatch_15 = ColourSwatch(SwatchColor=RGB(102, 102, 102))  # disabled
f_mseea_2 = MeshExtractEdgesWithToleranceAngle(Mesh=unifynormals, Angle=45)  # -> InternalEdges, NakedEdges; disabled
mcol_9 = MeshColours(Mesh=unifynormals, Colours=swatch_14)  # disabled
preview_11 = CustomPreview(Geometry=f_mseea_2.InternalEdges, Material=swatch_15)  # disabled
panel_37 = Panel("15 to 200")  # disabled
panel_38 = Panel("0 to 1")  # disabled
volume_3 = Panel(expression_10)  # disabled
compactness = Panel(expression_9)  # disabled
# Plugins:
# Meshedit2000
# MeshPipe
# Weaverbird
# froGH
# Elefront(R6)
docinfo = DocumentInfo(AutoUpdate=False, Recursive=False)  # -> DocumentName, DocumentFilePath, Components, Params, _3rdPartyAssemblies

Z_4 = UnitZ(Factor=1)
num_2 = Number(item_2)
mesh_5 = Mesh(cullf)
facen_6 = FaceNormals(Mesh=mesh_5)  # -> Centers, Normals
flatten = FlattenTree(Tree=num_2, Path="{0}")
cset_7 = CreateSet(List=flatten(flatten))  # -> Set, Map
rev = Reverse(Vector=Z_4)
sort_5 = SortList(Keys=cset_7.Set)  # -> Keys, ValuesA
xprod = CrossProduct(VectorA=facen_6.Normals, VectorB=rev, Unitize=False)  # -> Vector, Length
mindex_3 = MemberIndex(Set=flatten, Member=graft(sort_5.Keys))  # -> Index, Count
pl = ConstructPlane(Origin=facen_6.Centers, XAxis=xprod.Vector, YAxis=Z_4)
item_9 = ListItem(List=pl, Index=mindex_3.Index, Wrap=True)  # -> simplify(Item)
bang_2 = ExplodeTree(Data=item_9)  # -> Branch0, Branch1, Branch2, Branch3

expression_11 = Expression(x=flatten, Expression="((x/3.6)-1)")

# ----
# Shell
panel_39 = Panel("7.2,1.8,1.8")
mesh_6 = Mesh(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)
xy_2 = XYPlane(Origin=panel_39)
block_r6 = DefineBlockR6(Geometry=mesh_6, BlockName="Shell", BasePlane=xy_2)

# ----
# Frame
panel_40 = Panel("7.2,1.8,1.8")
mesh_7 = Mesh(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)
xy_3 = XYPlane(Origin=panel_40)
block_r6_2 = DefineBlockR6(Geometry=mesh_7, BlockName="Frame", BasePlane=xy_3)

mesh_8 = Mesh(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)
xz = XZPlane(Origin="1.8,0,1.8")
block_r6_3 = DefineBlockR6(Geometry=mesh_8, BlockName="Face_0", BasePlane=xz)

mesh_9 = Mesh(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)
xz_2 = XZPlane(Origin="1.8,0,1.8")
block_r6_4 = DefineBlockR6(Geometry=mesh_9, BlockName="Face_1", BasePlane=xz_2)

mesh_10 = Mesh(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)
xz_3 = XZPlane(Origin="1.8,0,1.8")
block_r6_5 = DefineBlockR6(Geometry=mesh_10, BlockName="Face_2", BasePlane=xz_3)

mesh_11 = Mesh(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)
xz_4 = XZPlane(Origin="1.8,0,1.8")
block_r6_6 = DefineBlockR6(Geometry=mesh_11, BlockName="Face_3", BasePlane=xz_4)

tag_5 = TextTag3D(Location=pl, Text=expression_11, Size="1", Colour=ColourSwatch(SwatchColor=RGB(102, 102, 102)), Justification=5)
orient_2 = Orient(Geometry=mesh_6, Source=panel_39, Target=pln_9)  # -> Geometry, Transform
orient_3 = Orient(Geometry=mesh_7, Source=xy_3, Target=pln_9)  # -> Geometry, Transform
preview_12 = CustomPreview(Geometry=orient_2.Geometry, Material=ColourSwatch(SwatchColor=RGB(150, 150, 150)))
preview_13 = CustomPreview(Geometry=orient_3.Geometry, Material=ColourSwatch(SwatchColor=RGB(84, 84, 84)))
cset_8 = CreateSet(List=flatten(gradient))  # -> Set, Map
item_10 = ListItem(List=cset_8.Set, Index=0, Wrap=True)  # -> Item, Item1, Item2, Item3
swatch_16 = ColourSwatch(SwatchColor=RGB(150, 150, 150))
inblock = InsertBlock(BlockName="Face_1", SourcePlane=bang_2.Branch1)
inblock_2 = InsertBlock(BlockName="Face_3", SourcePlane=bang_2.Branch3)
inblock_3 = InsertBlock(BlockName="Face_2", SourcePlane=bang_2.Branch2)
inblock_4 = InsertBlock(BlockName="Face_0", SourcePlane=bang_2.Branch0)
preview_14 = CustomPreview(Geometry=inblock, Material=item_10.Item1)
preview_15 = CustomPreview(Geometry=inblock_2, Material=item_10.Item3)
preview_16 = CustomPreview(Geometry=inblock_3, Material=item_10.Item2)
preview_17 = CustomPreview(Geometry=inblock_4, Material=item_10.Item)

# ---- group: Assemblage Data
# https://en.wikipedia.org/wiki/Compactness_measure
panel_41 = Panel("3.6")  # disabled
voxel_7 = Voxel(Points=pt_13, X=panel_41, Y=panel_41, Z=panel_41)  # disabled
swatch_17 = ColourSwatch(SwatchColor=RGB(102, 102, 102))  # disabled
bbox_5 = BoundingBox(Content=voxel_7, Plane=PlaneXY(0, 0, 0), UnionBox=True)  # -> Box, Box_2; disabled
area = MeshArea(Mesh=voxel_7)  # -> Area, Centroid; disabled
volume_4 = MeshVolume(Mesh=voxel_7)  # -> Volume, Centroid; disabled
edges_5 = BrepEdges(Brep=bbox_5.Box)  # -> Naked, Interior, NonManifold; disabled
expression_12 = Expression(x=area.Area, y=volume_4.Volume, Expression="Round((pow(x,1.5))/y,2)")  # -> flatten(R); disabled
panel_42 = Panel("""0
1
9""")  # disabled
swatch_18 = ColourSwatch(SwatchColor=RGB(255, 255, 255))  # disabled
item_11 = ListItem(List=edges_5.Interior, Index=panel_42, Wrap=True)  # disabled
len = Length(Curve=item_11)  # disabled
panel_43 = Panel("{0} x {1} x {2} m")  # disabled
item_12 = ListItem(List=len, Index=0, Wrap=True)  # -> Item, Item1, Item2; disabled
panel_44 = Panel(expression_12)  # disabled
format = Format(Format=panel_43, Culture=127, Data0=item_12.Item, Data1=item_12.Item1, Data2=item_12.Item2)  # disabled
panel_45 = Panel(format)  # disabled
panel_46 = Panel("Volume")  # disabled
panel_47 = Panel("Size")  # disabled
panel_48 = Panel(" =")  # disabled
panel_49 = Panel(" sqm")  # disabled
panel_50 = Panel(" =")  # disabled
panel_51 = Panel("""Compactness index
---------------""")  # disabled
concat = Concatenate(FragmentA=panel_46, FragmentB=panel_50, FragmentC=volume_4.Volume, FragmentD=panel_49)  # disabled
concat_2 = Concatenate(FragmentA=panel_47, FragmentB=panel_48, FragmentC=panel_45)  # disabled
number_slider_5 = Slider(2, range=0..10)  # disabled
panel_52 = Panel("")  # disabled
swatch_19 = ColourSwatch(SwatchColor=RGB(102, 102, 102))  # disabled

# ----
# SIZE, VOLUME & COMPACTNESS
unifynormals_2 = MeshUnifyNormals(Mesh=voxel_7)  # disabled
remap_2 = RemapNumbers(Value=expression_12, Source=panel_37, Target=panel_38)  # -> simplify(Mapped), simplify(Clipped); disabled
expression_13 = Expression(x=remap_2.Clipped, Expression="Round(x,2)")  # disabled
item_13 = ListItem(List=item_11, Index=0, Wrap=True)  # disabled
compactness_index = Panel(expression_13)  # disabled
curvepoint_5 = PointOnCurve(item_13, parameter=0.5)  # disabled

# ---- group: Assemblage Data (continued)
# seminar
mcol_10 = MeshColours(Mesh=unifynormals_2, Colours=swatch_17)  # disabled
preview_18 = CustomPreview(Geometry=mcol_10, Material=swatch_18)  # disabled
merge_5 = Merge(Data1=flatten(panel_51), Data2=flatten(expression_13))  # disabled
join_5 = TextJoin(Text=merge_5, Join=panel_52)  # disabled
tag_6 = TextTag3D(Location=curvepoint_5, Text=join_5, Size=number_slider_5, Colour=swatch_19, Justification=2)  # disabled

# ----
merge_6 = Merge(
    Data1=flatten(txt),
    Data2=flatten(expression_13),
    Data3=flatten(expression_3),
    Data4=flatten(expression_4),
    Data5=flatten(expression_2),
    Data6=flatten(expression))  # disabled
panel_53 = Panel(merge_6)  # disabled
rec = DataRecorder(merge_6, DataLimit=-10, RecordData=False)  # disabled

# ----
# Record your data here !!!
panel_54 = Panel(rec)  # disabled
