# Grasshopper definition Ex_03 - Multidimensional data VIZ v4.gh (Grasshopper 1.0.7)
# plug-ins: Human, Bifocals

# ----
# Insert your
# recorded data
# panel here
panel = Panel("""Component A-Pos_0-Rot_0
0.75
0.46
0.84
0.66
0.75
Component A-Pos_0-Rot_0
0.73
0.57
0.83
0.6
0.68
Component A-Pos_0-Rot_2
0.76
0.33
0.85
0.7
0.72
Component A-Pos_1-Rot_0
0.7
0.54
0.8
0.64
0.72
Component A-Pos_1-Rot_1
0.74
0.42
0.83
0.63
0.75
Component A-Pos_1-Rot_2
0.74
0.33
0.84
0.69
0.86
Component A-Pos_2-Rot_0
0.69
0.24
0.83
0.71
0.78
Component A-Pos_2-Rot_1
0.66
0.52
0.8
0.6
0.68
Component A-Pos_2-Rot_2
0.6
0.4
0.75
0.53
0.71
Component_B-Pos_0-Rot_0
0.83
0.54
0.86
0.66
0.73
Component_B-Pos_0-Rot_1
0.53
0.48
0.67
0.5
0.63
Component_B-Pos_0-Rot_2
0.84
0.51
0.86
0.66
0.67
Component_B-Pos_1-Rot_0
0.77
0.43
0.82
0.59
0.63
Component_B-Pos_1-Rot_1
0.84
0.49
0.85
0.65
0.59
Component_B-Pos_1-Rot_2
0.74
0.52
0.81
0.54
0.59
Component_B-Pos_2-Rot_0
0.86
0.49
0.87
0.7
0.72
Component_B-Pos_2-Rot_1
0.84
0.33
0.86
0.69
0.71
Component_B-Pos_2-Rot_2
0.83
0.46
0.86
0.7
0.73
Component_C-Pos_0-Rot_0
0.59
0.54
0.7
0.52
0.57
Component_C-Pos_0-Rot_1
0.69
0.47
0.75
0.63
0.62
Component_C-Pos_0-Rot_1
0.51
0.53
0.65
0.54
0.63
Component_C-Pos_1-Rot_0
0.69
0.27
0.75
0.68
0.72
Component_C-Pos_1-Rot_1
0.61
0.41
0.7
0.53
0.67
Component_C-Pos_1-Rot_2
0.66
0.42
0.75
0.56
0.51
Component_C-Pos_2-Rot_0
0.68
0.18
0.77
0.61
0.68
Component_C-Pos_2-Rot_1
0.31
0.18
0.49
0.46
0.88
Component_C-Pos_2-Rot_1
0.7
0.26
0.77
0.61
0.68
Component A-Pos_0-Rot_0
0.26
0.53
0.39
0.34
0.79
Component A-Pos_0-Rot_0
0.3
1
0.53
0.46
0.67
Component A-Pos_0-Rot_2
0.13
0.57
0.31
0.19
0.72
Component A-Pos_1-Rot_0
0.25
0.19
0.47
0.42
0.8
Component A-Pos_1-Rot_1
0.25
0.61
0.46
0.38
0.88
Component A-Pos_1-Rot_2
0.34
0.51
0.52
0.46
0.85
Component A-Pos_2-Rot_0
0.19
0.91
0.31
0.21
0.75
Component A-Pos_2-Rot_1
0.2
1
0.29
0.14
0.7
Component A-Pos_2-Rot_2
0.15
0.15
0.33
0.4
0.95
Component_B-Pos_0-Rot_0
0.63
0.43
0.71
0.61
0.73
Component_B-Pos_0-Rot_1
0.53
0.48
0.67
0.5
0.63
Component_B-Pos_0-Rot_2
0.53
0.24
0.66
0.6
0.65
Component_B-Pos_1-Rot_0
0.51
0.39
0.59
0.53
0.68
Component_B-Pos_1-Rot_1
0.4
0.29
0.55
0.5
0.63
Component_B-Pos_1-Rot_2
0.37
0.24
0.55
0.4
0.59
Component_B-Pos_2-Rot_0
0.58
0.34
0.72
0.62
0.72
Component_B-Pos_2-Rot_1
0.59
0.39
0.69
0.62
0.66
Component_B-Pos_2-Rot_2
0.34
0.21
0.52
0.42
0.69
Component_C-Pos_0-Rot_0
0.4
0.35
0.54
0.44
0.63
Component_C-Pos_0-Rot_1
0.36
0.78
0.45
0.36
0.67
Component_C-Pos_0-Rot_1
0.36
0.31
0.53
0.46
0.76
Component_C-Pos_1-Rot_0
0.28
1
0.28
0.16
0.85
Component_C-Pos_1-Rot_1
0.39
0.41
0.52
0.68
0.97
Component_C-Pos_1-Rot_2
0.38
0.36
0.43
0.16
0.98
Component_C-Pos_2-Rot_0
0.14
0.7
0.65
0.26
0.85
Component_C-Pos_2-Rot_1
0.46
0.1
0.62
0.34
0.85
Component_C-Pos_2-Rot_1
0.37
0.31
0.51
0.5
0.76
Component A-Pos_0-Rot_0
0.35
0.75
0.51
0.49
0.71
Component A-Pos_0-Rot_0
0.35
0.59
0.54
0.43
0.68
Component A-Pos_0-Rot_2
0.36
0.66
0.55
0.42
0.72
Component A-Pos_1-Rot_0
0.4
0.68
0.6
0.49
0.72
Component A-Pos_1-Rot_1
0.3
0.6
0.5
0.39
0.82
Component A-Pos_1-Rot_2
0.42
0.66
0.66
0.5
0.77
Component A-Pos_2-Rot_0
0.32
0.56
0.52
0.47
0.76
Component A-Pos_2-Rot_1
0.36
0.65
0.56
0.4
0.68
Component A-Pos_2-Rot_2
0.23
0.49
0.54
0.33
0.79
Component_B-Pos_0-Rot_0
0.62
0.46
0.7
0.52
0.68
Component_B-Pos_0-Rot_1
0.64
0.39
0.74
0.56
0.67
Component_B-Pos_0-Rot_2
0.6
0.57
0.71
0.51
0.66
Component_B-Pos_1-Rot_0
0.59
0.42
0.69
0.56
0.65
Component_B-Pos_1-Rot_1
0.59
0.51
0.75
0.54
0.62
Component_B-Pos_1-Rot_2
0.52
0.41
0.67
0.48
0.55
Component_B-Pos_2-Rot_0
0.6
0.39
0.7
0.51
0.66
Component_B-Pos_2-Rot_1
0.63
0.55
0.74
0.58
0.63
Component_B-Pos_2-Rot_2
0.54
0.54
0.72
0.45
0.63
Component_C-Pos_0-Rot_0
0.42
0.55
0.56
0.43
0.6
Component_C-Pos_0-Rot_1
0.46
0.69
0.57
0.45
0.64
Component_C-Pos_0-Rot_1
0.41
0.37
0.58
0.4
0.64
Component_C-Pos_1-Rot_0
0.39
0.49
0.55
0.52
0.72
Component_C-Pos_1-Rot_1
0.08
0.8
0.68
0.41
0.9
Component_C-Pos_1-Rot_2
0.41
0.32
0.56
0.53
0.69
Component_C-Pos_2-Rot_0
0.41
0.32
0.59
0.5
0.71
Component_C-Pos_2-Rot_1
0.34
0.5
0.51
0.46
0.65
Component_C-Pos_2-Rot_1
0.44
0.42
0.56
0.5
0.67
Component A-Pos_0-Rot_0
0.24
0.34
0.45
0.51
0.79
Component A-Pos_0-Rot_0
0.32
0.55
0.51
0.48
0.72
Component A-Pos_0-Rot_2
0.27
0.52
0.5
0.39
0.7
Component A-Pos_1-Rot_0
0.27
0.76
0.5
0.47
0.74
Component A-Pos_1-Rot_1
0.21
0.76
0.4
0.38
0.81
Component A-Pos_1-Rot_2
0.3
0.62
0.5
0.44
0.74
Component A-Pos_2-Rot_0
0.26
0.45
0.47
0.4
0.79
Component A-Pos_2-Rot_1
0.26
0.82
0.38
0.37
0.7
Component A-Pos_2-Rot_2
0.21
0.48
0.41
0.41
0.83
Component_B-Pos_0-Rot_0
0.63
0.38
0.75
0.59
0.73
Component_B-Pos_0-Rot_1
0.53
0.47
0.67
0.53
0.64
Component_B-Pos_0-Rot_2
0.56
0.39
0.68
0.56
0.71
Component_B-Pos_1-Rot_0
0.51
0.47
0.6
0.54
0.6
Component_B-Pos_1-Rot_1
0.48
0.4
0.64
0.54
0.7
Component_B-Pos_1-Rot_2
0.44
0.35
0.64
0.47
0.61
Component_B-Pos_2-Rot_0
0.5
0.42
0.65
0.49
0.65
Component_B-Pos_2-Rot_1
0.6
0.48
0.72
0.53
0.67
Component_B-Pos_2-Rot_2
0.4
0.36
0.57
0.53
0.71
Component_C-Pos_0-Rot_0
0.44
0.24
0.59
0.51
0.63
Component_C-Pos_0-Rot_1
0.32
0.22
0.49
0.51
0.72
Component_C-Pos_0-Rot_1
0.38
0.5
0.52
0.49
0.7
Component_C-Pos_1-Rot_0
0.27
0.41
0.43
0.46
0.81
Component_C-Pos_1-Rot_1
0.41
0.38
0.52
0.42
0.92
Component_C-Pos_1-Rot_2
0.41
0.37
0.45
0.04
0.92
Component_C-Pos_2-Rot_0
0.37
0.25
0.53
0.49
0.74
Component_C-Pos_2-Rot_1
0.3
0.29
0.47
0.47
0.79
Component_C-Pos_2-Rot_1
0.38
0.19
0.54
0.52
0.76""")

# ---- group: Target Values
# MAA01 23/24
# ASSEMBLED ARCHITECTURE
# Computational Logic of Iterative Assemblage Processes
# BCN . Jan-Feb-Mar 2024
# Tutor: Andrea Graziano - Co-de-iT
# Assistant: Akshay Madapura
# Target values
genes = GenePool(Decimals=2, Maximum=1, Minimum=0, Value=[0.34, 0.59, 0.55, 0.52, 0.7])

# ---- group: DataSet
txt = Text(panel)
partition = PartitionList(List=txt, Size="6")
cull_i = CullIndex(List=partition, Indices="0", Wrap=True)  # -> simplify(List)
item = ListItem(List=partition, Index="0", Wrap=True)  # -> simplify(Item)

# ----
# seminar
num = Number(genes)
flip = FlipMatrix(Data=cull_i)
bnd = Bounds(Numbers=flip)  # -> flatten(Domain)
list = ValueList({"2D": 0, "3D": 1}, selected="3D")
bang = ExplodeTree(Data=flip)  # -> Branch0, Branch1, Branch2, Branch3, Branch4
indexes_name = Panel("""C
T
O
P
Y""")

# ----
# The part we explained in class
panel_2 = Panel("6")
partition_2 = PartitionList(List=txt, Size=panel_2)  # -> simplify(Chunks)
genes_2 = GenePool(Decimals=2, Maximum=1, Minimum=0, Value=[0.47, 0.69, 0.35, 0.52, 0.11])
cull_i_2 = CullIndex(List=partition_2, Indices="0", Wrap=True)  # -> simplify(List)
flip_2 = FlipMatrix(Data=cull_i_2)
item_2 = ListItem(List=partition_2, Index="0", Wrap=True)  # -> simplify(Item)
bnd_2 = Bounds(Numbers=flip_2)  # -> flatten(Domain)
bang_2 = ExplodeTree(Data=flip_2)  # -> Branch0, Branch1, Branch2, Branch3, Branch4
panel_3 = Panel(cull_i_2)
panel_4 = Panel(item_2)
expression = Expression(x=genes_2, y=cull_i_2, Expression="Pow(x-y,2)")
bar_graph = BarGraph(bang_2.Branch0, BarColor=RGB(255, 0, 90))
panel_5 = Panel(bnd_2)
ma = MassAddition(Input=expression)  # -> Result, PartialResults
sqrt = SquareRoot(Value=ma.Result)  # -> flatten(Result)
index = ItemIndex(List=sqrt, Item=sqrt)
sort = SortList(Keys=sqrt, ValuesA=index)  # -> Keys, ValuesA
item_3 = ListItem(List=sort.ValuesA, Index=0, Wrap=True)
panel_6 = Panel(sort.Keys)
branch = TreeBranch(Tree=item_2, Path=item_3, MaintainPaths=True)
branch_2 = TreeBranch(Tree=cull_i_2, Path=item_3, MaintainPaths=True)
panel_7 = Panel(branch)
panel_8 = Panel(branch_2)

panel_9 = Panel(bnd)
bar_graph_2 = BarGraph(bang.Branch4, BarColor=RGB(255, 0, 90))
int = Integer(list)
num_2 = Number(cull_i)
txt_2 = Text(indexes_name)

# ---- group: Multidimension check
lng = ListLength(List=num_2)
avr = Average(Input=flatten(lng))

# ---- group: Grid of points
tstat = TreeStatistics(Tree=num_2)  # -> Paths, Length, Count
sqrt_2 = SquareRoot(Value=tstat.Count)
expression_2 = Expression(x=sqrt_2, Expression="Ceiling(x)")
sqgrid = Square(Plane=PlaneXY(0, 0, 0), Size=Slider(3, range=0..10), ExtentX="12", ExtentY="9")  # -> flatten(Cells), flatten(Points)
disc = Discontinuity(Curve=graft(sqgrid.Cells), Level=1)  # -> Points, Parameters
avr_2 = Average(Input=disc.Points)  # -> simplify(flatten(ArithmeticMean))
split = SplitList(List=avr_2, Index=tstat.Count)  # -> ListA, ListB
pt = Point(simplify(graft(split.ListA)))

# ---- group: Best candidate selection
expression_3 = Expression(x=num, y=num_2, Expression="Pow(x-y,2)")
ma_2 = MassAddition(Input=expression_3)  # -> Result, PartialResults
sqrt_3 = SquareRoot(Value=ma_2.Result)  # -> flatten(Result)
index_2 = ItemIndex(List=sqrt_3, Item=sqrt_3)
sort_2 = SortList(Keys=sqrt_3, ValuesA=index_2)  # -> Keys, ValuesA
item_4 = ListItem(List=sort_2.ValuesA, Index=0, Wrap=True)

# ----
# Plugins:
# Human
expression_4 = Expression(x=num, y=num_2, Expression="Abs(x-y)")
ma_3 = MassAddition(Input=expression_4)  # -> Result, PartialResults
expression_5 = Expression(x=ma_3.Result, y=avr, Expression="x/y")

conmesh = ConstructMesh(Vertices=disc.Points, Faces={A=0, B=1, C=2, D=3})  # -> flatten(Mesh)
split_2 = SplitList(List=conmesh, Index=tstat.Count)  # -> ListA, ListB
num_3 = Number(expression_5)
mesh = Mesh(simplify(graft(split_2.ListA)))
expression_6 = Expression(x=num_3, Expression="1-x")
hsv = ColourHSV(Alpha=1, Hue=0, Saturation="0", Value=expression_6)
mcol = MeshColours(Mesh=mesh, Colours=graft(hsv))
preview = CustomPreview(Geometry=mcol, Material=ColourSwatch(SwatchColor=RGB(255, 255, 255)))

num_4 = Number(flatten(expression_5))
index_3 = ItemIndex(List=num_4, Item=num_4)

# ---- group: Geometries
cir = Circle(Plane=pt, Radius=1)
divide = DivideCurve(Curve=cir, Count=avr, Kinks=False)  # -> Points, Tangents, Parameters
vec2pt = Vector2Pt(PointA=pt, PointB=divide.Points, Unitize=False)  # -> simplify(Vector), Length
amp = Amplitude(Vector=vec2pt.Vector, Amplitude=num_2)
move = Move(Geometry=pt, Motion=amp)  # -> simplify(Geometry), Transform
Z = UnitZ(Factor=num_2)
move_2 = Move(Geometry=move.Geometry, Motion=Z)  # -> Geometry, Transform
merge = Merge(Data1=pt, Data2=move.Geometry)
merge_2 = Merge(Data1=pt, Data2=move_2.Geometry)
pline = PolyLine(Vertices=move.Geometry, Closed=Toggle(True))
ln = Line(StartPoint=pt, EndPoint=divide.Points)
ln_2 = Line(StartPoint=move.Geometry, EndPoint=move_2.Geometry)

# ---- group: Colored mesh
series = Series(Start=0, Step=1, Count=avr)
gradient = Gradient(
    LowerLimit=0,
    UpperLimit=avr,
    Parameter=series,
    stops=[0: RGB(243, 57, 0), 0.1: RGB(236, 27, 60), 0.2: RGB(210, 0, 118), 0.3: RGB(103, 0, 120), 0.4: RGB(39, 72, 161), 0.5: RGB(1, 192, 229), 0.6: RGB(18, 178, 90), 0.7: RGB(79, 186, 8), 0.8: RGB(220, 237, 32), 0.9: RGB(247, 159, 20), 1: RGB(243, 57, 0)])
swatch = ColourSwatch(SwatchColor=RGB(255, 255, 255))
dup = DuplicateData(Data=swatch, Number=avr, Order=True)  # -> graft(Data)
flip_3 = FlipMatrix(Data=simplify(num_2))
col = Colour(graft(gradient))
col_2 = Colour(dup)
dup_2 = DuplicateData(Data="0", Number=avr, Order=True)  # -> simplify(graft(Data))
series_2 = Series(Start="1", Step=1, Count=avr)  # -> graft(Series)
argb = SplitARGB(Colour=col_2, IntegerChannels=True)  # -> Alpha, Red, Green, Blue
argb_2 = SplitARGB(Colour=col, IntegerChannels=True)  # -> Alpha, Red, Green, Blue
num_5 = Number(flip_3)
shift = ShiftList(List=flatten(series_2), Shift=1, Wrap=True)  # -> simplify(graft(List))
dom = ConstructDomain(DomainStart=argb.Red, DomainEnd=argb_2.Red)
dom_2 = ConstructDomain(DomainStart=argb.Green, DomainEnd=argb_2.Green)
dom_3 = ConstructDomain(DomainStart=argb.Blue, DomainEnd=argb_2.Blue)
remap = RemapNumbers(Value=num_5, Source=Domain(0, 1), Target=dom)  # -> Mapped, Clipped
remap_2 = RemapNumbers(Value=num_5, Source=Domain(0, 1), Target=dom_2)  # -> Mapped, Clipped
remap_3 = RemapNumbers(Value=num_5, Source=Domain(0, 1), Target=dom_3)  # -> Mapped, Clipped
expression_7 = Expression(x=dup_2, y=series_2, z=shift, Expression="\"T{\"&x&\";\"&y&\";\"&z&\"}\"")  # -> flatten(R)
rgb = ColourRGB(Alpha=255, Red=remap.Mapped, Green=remap_2.Mapped, Blue=remap_3.Mapped)
flip_4 = FlipMatrix(Data=rgb)
filter = StreamFilter(Gate=int, Stream0=merge, Stream1=merge_2)
ins = InsertItems(List=flip_4, Item=swatch, Indices="0", Wrap=True)  # -> simplify(List)
conmesh_2 = ConstructMesh(Vertices=filter, Faces=expression_7, Colours=ins)

# ----
sort_3 = SortList(Keys=num_4, ValuesA=index_3)  # -> Keys, ValuesA
item_5 = ListItem(List=sort_3.ValuesA, Index=0, Wrap=True)
disjoint = Disjoint(SetA=item_5, SetB=item_4)
not = GateNot(A=disjoint)
panel_10 = Panel(not)

# ---- group: Best candidate VIZ
branch_3 = TreeBranch(Tree=simplify(expression_5), Path=item_4, MaintainPaths=True)
branch_4 = TreeBranch(Tree=simplify(pt), Path=item_4, MaintainPaths=True)
branch_5 = TreeBranch(Tree=simplify(vec2pt.Vector), Path=item_4, MaintainPaths=True)
Z_2 = UnitZ(Factor="1.5")
expression_8 = Expression(x=branch_3, Expression="Round(x*100,1)&\"%\"")
amp_2 = Amplitude(Vector=branch_5, Amplitude=num)
move_3 = Move(Geometry=branch_4, Motion=Z_2)  # -> Geometry, Transform
Z_3 = UnitZ(Factor=1)
move_4 = Move(Geometry=branch_4, Motion=amp_2)  # -> simplify(Geometry), Transform
line = LineSDL(Start=move_3.Geometry, Direction=Z_3, Length=Slider(3.2, range=0..10))
end = EndPoints(Curve=line)  # -> Start, End
Z_4 = UnitZ(Factor="0.4")
cir_2 = Circle(Plane=branch_4, Radius=expr("x+0.4", "1"))  # disabled
pline_2 = PolyLine(Vertices=move_4.Geometry, Closed=Toggle(True))
move_5 = Move(Geometry=end.End, Motion=Z_4)  # -> Geometry, Transform
deviation = Panel(expression_8)
swatch_2 = ColourSwatch(SwatchColor=RGB(255, 0, 0))
boundary = BoundarySurfaces(Edges=pline_2)
xz = XZPlane(Origin=move_5.Geometry)
preview_2 = CustomPreview(Geometry=boundary, Material=ColourSwatch(SwatchColor=RGBA(76, 76, 76, 35)))
previewlw = CustomPreviewLineweights(Geometry=[pline_2, line, cir_2], Shader=swatch_2, Thickness=Slider(5, range=0..10), Absolute=False)
tag = TextTag3D(Location=xz, Text=expression_8, Size="0.5", Colour=swatch_2, Justification=8)

# ----
panel_11 = Panel("""0.1
0.05""")

# ---- group: Candidate VIZ
filter_2 = StreamFilter(Gate=int, Stream1=ln_2)
panel_12 = Panel("""0.05
0.05""")
number_slider = Slider(0.03, range=0..0.1)
amp_3 = Amplitude(Vector=vec2pt.Vector, Amplitude="0.15")
dash = DashPattern(Curve=ln, Pattern=panel_11)  # -> Dashes, Gaps
swatch_3 = ColourSwatch(SwatchColor=RGB(125, 125, 125))
dash_2 = DashPattern(Curve=filter_2, Pattern=panel_12)  # -> Dashes, Gaps
move_6 = Move(Geometry=divide.Points, Motion=amp_3)  # -> Geometry, Transform
preview_3 = CustomPreview(Geometry=[pline, cir], Material=swatch_3)
preview_4 = CustomPreview(Geometry=dash.Dashes, Material=swatch_3)
preview_5 = CustomPreview(Geometry=dash_2.Dashes, Material=swatch_3)
preview_6 = CustomPreview(Geometry=conmesh_2, Material=swatch_3)
tag_2 = TextTag3D(Location=move_6.Geometry, Text=txt_2, Size=Slider(0.15, range=0..1), Colour=swatch_3, Justification=5)
dots = DotDisplay(Point=move.Geometry, Colour=flip_4, Size=number_slider)
dots_2 = DotDisplay(Point=divide.Points, Colour=gradient, Size=number_slider)

# ----
move_7 = Move(Geometry=pt, Motion="0,-1.3,0")  # -> Geometry, Transform
tag_3 = TextTag3D(Location=move_7.Geometry, Text=item, Size="0.12", Colour=swatch_3, Justification=5)
